# Grasshopper definition Blocks_Web.gh (Grasshopper 1.0.7)
# plug-ins: Human

# ----
# KPFui GH Standards
# Results
data = Data(True)

python = GhPythonScript()  # -> out, breps, curves, points, meshes, geo
# ---------- python: Python ----------
__author__ = "jason"
__version__ = "2020.02.27"

import Rhino
import Rhino.Geometry as rg

breps = []
curves = []
points = []
meshes = []
geo = []

for rObj in Rhino.RhinoDoc.ActiveDoc.Objects:
    geo.append(rObj.Geometry)
    if(rObj.ObjectType == Rhino.DocObjects.ObjectType.Brep):
        breps.append(rObj.Geometry)
    elif(rObj.ObjectType == Rhino.DocObjects.ObjectType.Curve):
        curves.append(rObj.Geometry)
    elif(rObj.ObjectType == Rhino.DocObjects.ObjectType.Point):
        points.append(rObj.Geometry)
    elif(rObj.ObjectType == Rhino.DocObjects.ObjectType.Mesh):
        meshes.append(rObj.Geometry)
# ---------- end python ----------
geo = Geometry(python.geo)

# ----
# Viz
data_2 = Data(True)

# ----
# Action
button = Button()

# ----
# Inputs
data_3 = Data(True)

# ----
# Intermediate
data_4 = Data(True)

# ----
# DO NOT TOUCH
data_5 = Data(True)

# ----
# Warning
data_6 = Data(True)

brep = Brep(<brep referenced from the Rhino model>)
python_2 = GhPythonScript()  # -> out, a
# ---------- python_2: Python ----------
__author__ = "jason"
__version__ = "2020.02.28"

import Rhino
import System

guid_string = 'b64fa0bd-28f0-4894-baa7-ae1937d3e124'
guid = System.Guid.Parse(guid_string)

for rObj in Rhino.RhinoDoc.ActiveDoc.Objects:
    if rObj.Id == guid:
        my_brep = rObj.Geometry

a = my_brep
# ---------- end python_2 ----------
id = Guid(brep)

# ----
# Note
note_2 = Panel("")

panel = Panel(python_2.a)
panel_2 = Panel(id)
merge = Merge(
    Data1=Slider(5, range=0..378),
    Data2=Slider(328, range=323..354),
    Data3=Slider(329, range=323..354),
    Data4=Slider(330, range=323..354),
    Data5=Slider(331, range=323..354))
geo_2 = Geometry(geo)
merge_2 = Merge(
    Data1=Slider(4, range=0..378),
    Data2=Slider(317, range=303..324),
    Data3=Slider(318, range=303..324),
    Data4=Slider(319, range=303..324),
    Data5=Slider(320, range=303..324),
    Data6=Slider(347, range=323..354),
    Data7=Slider(348, range=323..354),
    Data8=Slider(349, range=323..354),
    Data9=Slider(350, range=323..354),
    Data10=Slider(351, range=323..354),
    Data11=Slider(352, range=323..354),
    Data12=Slider(353, range=323..354),
    Data13=Slider(354, range=323..354),
    Data14=Slider(355, range=353..384),
    Data15=Slider(356, range=353..384))
geo_3 = Geometry(geo)
merge_3 = Merge(
    Data1=Slider(8, range=0..378),
    Data2=Slider(326, range=323..354),
    Data3=Slider(327, range=323..354),
    Data4=Slider(343, range=323..354),
    Data5=Slider(344, range=323..354))
geo_4 = Geometry(geo)
merge_4 = Merge(
    Data1=Slider(0, range=0..378),
    Data2=Slider(2, range=0..378),
    Data3=Slider(313, range=0..378),
    Data4=Slider(314, range=0..378),
    Data5=Slider(315, range=0..378))
merge_5 = Merge(
    Data1=Slider(9, range=0..378),
    Data2=Slider(324, range=303..324),
    Data3=Slider(325, range=323..354),
    Data4=Slider(360, range=353..384),
    Data5=Slider(361, range=353..384))
geo_5 = Geometry(geo)
# TUBE 2
geo_6 = Geometry(geo)
merge_6 = Merge(
    Data1=Slider(7, range=0..378),
    Data2=Slider(339, range=323..354),
    Data3=Slider(340, range=323..354),
    Data4=Slider(341, range=323..354),
    Data5=Slider(342, range=323..354))
geo_7 = Geometry(geo)
merge_7 = Merge(
    Data1=Slider(11, range=0..378),
    Data2=Slider(322, range=303..324),
    Data3=Slider(323, range=303..324),
    Data4=Slider(362, range=353..384),
    Data5=Slider(363, range=353..384))
# SNAP 3
item = ListItem(List=geo_2, Index=merge, Wrap=True)
# TUBE 3
geo_8 = Geometry(geo)
# TUBE 1
item_2 = ListItem(List=geo_4, Index=merge_3, Wrap=True)
merge_8 = Merge(
    Data1=Slider(10, range=0..378),
    Data2=Slider(365, range=353..384),
    Data3=Slider(366, range=353..384),
    Data4=Slider(367, range=353..384),
    Data5=Slider(368, range=353..384),
    Data6=Slider(369, range=353..384),
    Data7=Slider(370, range=353..384),
    Data8=Slider(371, range=353..384),
    Data9=Slider(372, range=353..384),
    Data10=Slider(373, range=353..384),
    Data11=Slider(374, range=353..384))
merge_9 = Merge(
    Data1=Slider(6, range=0..378),
    Data2=Slider(335, range=323..354),
    Data3=Slider(336, range=323..354),
    Data4=Slider(337, range=323..354),
    Data5=Slider(338, range=323..354))
# SNAP 1
geo_9 = Geometry(geo)
# BASE
item_3 = ListItem(List=geo_5, Index=merge_4, Wrap=True)
# WEDGE
geo_10 = Geometry(geo)
item_4 = ListItem(List=geo_6, Index=merge_5, Wrap=True)
item_5 = ListItem(List=item, Index=0, Wrap=True)  # -> Item, Item1, Item2, Item3, Item4
# SNAP 2
item_6 = ListItem(List=geo_7, Index=merge_6, Wrap=True)
item_7 = ListItem(List=geo_8, Index=merge_7, Wrap=True)
item_8 = ListItem(List=geo_3, Index=merge_2, Wrap=True)
item_9 = ListItem(List=item_2, Index=0, Wrap=True)  # -> Item, Item1, Item2, Item3, Item4
item_10 = ListItem(List=geo_9, Index=merge_9, Wrap=True)
item_11 = ListItem(List=item_3, Index=0, Wrap=True)  # -> Item, Item1, Item2, Item3, Item4
item_12 = ListItem(List=item_6, Index=0, Wrap=True)  # -> Item, Item1, Item2, Item3, Item4
item_13 = ListItem(List=geo_10, Index=merge_8, Wrap=True)
item_14 = ListItem(List=item_4, Index=0, Wrap=True)  # -> Item, Item1, Item2, Item3, Item4
# ARC
item_15 = ListItem(List=item_8, Index=0, Wrap=True)  # -> Item, Item1, Item2, Item3, Item4, Item5, Item6, Item7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
item_16 = ListItem(List=item_7, Index=0, Wrap=True)  # -> Item, Item1, Item2, Item3, Item4
item_17 = ListItem(List=item_10, Index=0, Wrap=True)  # -> Item, Item1, Item2, Item3, Item4
item_18 = ListItem(List=item_13, Index=0, Wrap=True)  # -> Item, Item1, Item2, Item3, Item4, Item5, Item6, Item7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
pt = Point(item_12.Item2)
pt_2 = Point(item_12.Item1)
pt_3 = Point(item_12.Item4)
geo_11 = Geometry(item_12.Item)
pt_4 = Point(item_12.Item3)
pt_5 = Point(item_5.Item2)
pt_6 = Point(item_5.Item1)
geo_tube = Geometry(item_11.Item1)
pt_7 = Point(item_17.Item2)
geo_12 = Geometry(item_5.Item)
geo_base = Geometry(item_11.Item2)
pt_8 = Point(item_17.Item1)
pt_9 = Point(item_17.Item4)
pt_10 = Point(item_17.Item3)
pt_11 = Point(item_5.Item4)
pt_1 = Point(item_11.Item3)
pt_12 = Point(item_5.Item3)
pt_1_2 = Point(item_11.Item4)
crv_axis = Curve(item_11.Item)
pt_13 = Point(item_15.Item12)
pt_14 = Point(item_15.Item7)
pt_15 = Point(item_15.Item10)
pt_16 = Point(item_15.Item9)
pt_17 = Point(item_15.Item8)
pt_18 = Point(item_15.Item11)
pt_19 = Point(item_15.Item13)
pt_20 = Point(item_15.Item14)
pt_21 = Point(item_15.Item3)
pt_22 = Point(item_15.Item4)
pt_23 = Point(item_15.Item1)
pt_24 = Point(item_15.Item2)
pt_25 = Point(item_15.Item5)
pt_26 = Point(item_15.Item6)
pt_1_3 = Point(item_9.Item2)
pt_2_2 = Point(item_9.Item4)
merge_10 = Merge(Data1=pt, Data2=pt_2)
pt_1_4 = Point(item_9.Item3)
merge_11 = Merge(Data1=pt_3, Data2=pt_4)
geo_13 = Geometry(item_9.Item)
pt_2_3 = Point(item_9.Item1)
pt_4_2 = Point(item_14.Item1)
pt_2_4 = Point(item_14.Item4)
pt_3_2 = Point(item_14.Item3)
geo_14 = Geometry(item_16.Item)
pt_2_5 = Point(item_16.Item3)
geo_15 = Geometry(item_14.Item)
pt_1_5 = Point(item_14.Item2)
pt_1_6 = Point(item_16.Item1)
merge_12 = Merge(Data1=pt_6, Data2=pt_5)
pt_3_3 = Point(item_16.Item4)
pt_4_3 = Point(item_16.Item2)
merge_13 = Merge(Data1=pt_7, Data2=pt_8)
merge_14 = Merge(Data1=pt_9, Data2=pt_10)
merge_15 = Merge(Data1=pt_11, Data2=pt_12)
geo_16 = Geometry(item_17.Item)
merge_16 = Merge(Data1=pt_14, Data2=pt_15, Data3=pt_16, Data4=pt_17)
merge_17 = Merge(Data1=pt_18, Data2=pt_13, Data3=pt_19, Data4=pt_20)
merge_18 = Merge(Data1=pt_21, Data2=pt_22, Data3=pt_23, Data4=pt_24)
merge_19 = Merge(Data1=pt_25, Data2=pt_26)
geo_17 = Geometry(item_15.Item)
pt_27 = Point(item_18.Item7)
pt_28 = Point(item_18.Item10)
pt_29 = Point(item_18.Item9)
pt_30 = Point(item_18.Item8)
xy = XYPlane(Origin=pt_1_3)
xy_2 = XYPlane(Origin=pt_2_2)
xy_3 = XYPlane(Origin=pt_2_3)
pt_31 = Point(item_18.Item3)
pt_32 = Point(item_18.Item5)
xy_4 = XYPlane(Origin=pt_1_4)
pt_33 = Point(item_18.Item6)
pt_34 = Point(item_18.Item4)
pt_35 = Point(item_18.Item2)
pt_36 = Point(item_18.Item1)
pt_tube_2_b = Point(merge_11)
pt_tube_2_a = Point(merge_10)
pt_tube_1 = Point(merge_12)
pt_tube_2 = Point(merge_15)
xy_5 = XYPlane(Origin=pt_1_2)
pt_tube_2_b_2 = Point(merge_14)
xy_6 = XYPlane(Origin=pt_1)
pt_tube_2_a_2 = Point(merge_13)
pt_group_1a = Point(merge_16)
pt_group_1b = Point(merge_17)
pt_group_2 = Point(merge_18)
pt_tube_1a = Point(merge_19)
vec2pt = Vector2Pt(PointA=pt_2_5, PointB=pt_1_6, Unitize=False)  # -> Vector, Length
vec2pt_2 = Vector2Pt(PointA=pt_4_3, PointB=pt_3_3, Unitize=False)  # -> Vector, Length
vec2pt_3 = Vector2Pt(PointA=pt_4_2, PointB=pt_3_2, Unitize=False)  # -> Vector, Length
vec2pt_4 = Vector2Pt(PointA=pt_2_4, PointB=pt_1_5, Unitize=False)  # -> Vector, Length
merge_20 = Merge(Data1=pt_27, Data2=pt_28, Data3=pt_29, Data4=pt_30)
merge_21 = Merge(Data1=pt_36, Data2=pt_35)
merge_22 = Merge(Data1=pt_31, Data2=pt_33, Data3=pt_32, Data4=pt_34)
geo_18 = Geometry(item_18.Item)
pln_tube1_a = Plane(xy_6)
pln_tube1_a_2 = Plane(xy_5)
pt_group_2_2 = Point(merge_22)
pt_group_1 = Point(merge_20)
pt_tube_2_2 = Point(merge_21)
tar_tube = TarTube(pt_tube_2=pt_tube_2_b)
tar_tube_2 = TarTube(pt_tube_2=pt_tube_2_a)
tar_tube_3 = TarTube(pt_tube_2=pt_tube_1)
tar_tube_4 = TarTube(pt_tube_2=pt_tube_2)
pl = PlaneNormal(Origin=pt_3_3, ZAxis=vec2pt_2.Vector)
pl_2 = PlaneNormal(Origin=pt_4_3, ZAxis=vec2pt_2.Vector)
pl_3 = PlaneNormal(Origin=pt_1_6, ZAxis=vec2pt.Vector)
tar_tube_5 = TarTube(pt_tube_2=pt_tube_2_b_2)
pl_4 = PlaneNormal(Origin=pt_2_4, ZAxis=vec2pt_4.Vector)
pl_5 = PlaneNormal(Origin=pt_2_5, ZAxis=vec2pt.Vector)
tar_tube_6 = TarTube(pt_tube_2=pt_tube_2_a_2)
pl_6 = PlaneNormal(Origin=pt_1_5, ZAxis=vec2pt_4.Vector)
pl_7 = PlaneNormal(Origin=pt_3_2, ZAxis=vec2pt_3.Vector)
pl_8 = PlaneNormal(Origin=pt_4_2, ZAxis=vec2pt_3.Vector)
merge_23 = Merge(
    Data1=Slider(1, range=0..378),
    Data2=Slider(303, range=0..378),
    Data3=Slider(304, range=0..378),
    Data4=Slider(306, range=0..378),
    Data5=Slider(307, range=0..378),
    Data6=Slider(308, range=0..378),
    Data7=Slider(309, range=0..378),
    Data8=Slider(310, range=0..378),
    Data9=Slider(311, range=0..378))
geo_19 = Geometry(geo)
merge_24 = Merge(
    Data1=flatten(geo_base),
    Data2=flatten(geo_tube),
    Data3=flatten(crv_axis),
    Data4=flatten(pln_tube1_a_2),
    Data5=flatten(pln_tube1_a))

# ---- group: Visualize Plane and Vector
cluster = Cluster()

# ----
pln_1 = Plane(xy)
pln_1_2 = Plane(xy_4)
pln_3 = Plane(xy_2)
pln_1_3 = Plane(pl_4)
pln_1_4 = Plane(pl_6)
pln_1_5 = Plane(pl_3)
pln_3_2 = Plane(xy_3)

# ---- group: Visualize Plane and Vector
cluster_2 = Cluster(pln=pln_3_2)

# ----
pln_1_6 = Plane(pl_5)
pln_2 = Plane(pl)
pln_2_2 = Plane(pl_2)

# ---- group: Visualize Plane and Vector
cluster_3 = Cluster(pln=pln_1_4)

cluster_4 = Cluster()

# ----
pln_2_3 = Plane(pl_7)
pln_2_4 = Plane(pl_8)
data_inputs = Data(merge_24)
item_19 = ListItem(List=geo_19, Index=merge_23, Wrap=True)
# NIB
item_20 = ListItem(List=item_19, Index=0, Wrap=True)  # -> Item, Item1, Item2, Item3, Item4, Item5, Item6, Item7, Item8
panel_3 = Panel("""tube1_a_outer
tube1_a_inner
tube1_b_outer
tube1_b_inner""")
merge_25 = Merge(Data1=flatten(geo_13), Data2=flatten(pln_1_2), Data3=flatten(pln_1), Data4=flatten(pln_3), Data5=flatten(pln_3_2))
merge_26 = Merge(Data1=flatten(pln_1_2), Data2=flatten(pln_1), Data3=flatten(pln_3), Data4=flatten(pln_3_2))
src_tube = SrcTube(P=tar_tube)  # -> i, item_1, item_2, item_3
src_tube_2 = SrcTube(P=tar_tube_2)  # -> i, item_1, item_2, item_3
panel_4 = Panel("""tube2_a_outer
tube2_b_outer""")
panel_5 = Panel("""tube3_a_outer
tube3_b_outer""")
src_tube_3 = SrcTube(P=tar_tube_4)  # -> i, item_1, item_2, item_3
src_tube_4 = SrcTube(P=tar_tube_3)  # -> i, item_1, item_2, item_3
merge_27 = Merge(Data1=flatten(pln_1_6), Data2=flatten(pln_2))
src_tube_5 = SrcTube(P=tar_tube_5)  # -> i, item_1, item_2, item_3
src_tube_6 = SrcTube(P=tar_tube_6)  # -> i, item_1, item_2, item_3
merge_28 = Merge(
    Data1=flatten(geo_14),
    Data2=flatten(pt_1_6),
    Data3=flatten(pt_2_5),
    Data4=flatten(pt_3_3),
    Data5=flatten(pt_4_3),
    Data6=flatten(pln_1_6),
    Data7=flatten(pln_1_5),
    Data8=flatten(pln_2),
    Data9=flatten(pln_2_2))
merge_29 = Merge(
    Data1=flatten(geo_15),
    Data2=flatten(pt_1_5),
    Data3=flatten(pt_2_4),
    Data4=flatten(pt_3_2),
    Data5=flatten(pt_4_2),
    Data6=flatten(pln_1_3),
    Data7=flatten(pln_1_4),
    Data8=flatten(pln_2_3),
    Data9=flatten(pln_2_4))
merge_30 = Merge(Data1=flatten(pln_1_3), Data2=flatten(pln_2_3))
tar_plug = TarPlug(pt_group_source=pt_group_2_2)
tar_plug_2 = TarPlug(pt_group_source=pt_group_1)
tar_tube_7 = TarTube(pt_tube_2=pt_tube_2_2)
src_plug = SrcPlug(pt_group_1=pt_group_1)  # -> P, P_2
merge_31 = Merge(Data1=flatten(geo_11), Data2=flatten(tar_tube_2), Data3=flatten(tar_tube))
merge_32 = Merge(
    Data1=flatten(src_tube_2.i),
    Data2=flatten(src_tube_2.item_1),
    Data3=flatten(src_tube_2.item_2),
    Data4=flatten(src_tube_2.item_3),
    Data5=flatten(src_tube.i),
    Data6=flatten(src_tube.item_1),
    Data7=flatten(src_tube.item_2),
    Data8=flatten(src_tube.item_3))
merge_33 = Merge(
    Data1=flatten("snap2_tube2_a"),
    Data2=flatten("snap2_tube2_a"),
    Data3=flatten("snap2_tube2_a"),
    Data4=flatten("snap2_tube2_a"),
    Data5=flatten("snap2_tube2_b"),
    Data6=flatten("snap2_tube2_b"),
    Data7=flatten("snap2_tube2_b"),
    Data8=flatten("snap2_tube2_b"))
merge_34 = Merge(Data1=flatten(geo_12), Data2=flatten(tar_tube_3), Data3=flatten(tar_tube_4))
merge_35 = Merge(
    Data1=flatten(src_tube_4.i),
    Data2=flatten(src_tube_4.item_1),
    Data3=flatten(src_tube_4.item_2),
    Data4=flatten(src_tube_4.item_3),
    Data5=flatten(src_tube_3.i),
    Data6=flatten(src_tube_3.item_1),
    Data7=flatten(src_tube_3.item_2),
    Data8=flatten(src_tube_3.item_3))
merge_36 = Merge(
    Data1=flatten("snap3_tube1"),
    Data2=flatten("snap3_tube1"),
    Data3=flatten("snap3_tube1"),
    Data4=flatten("snap3_tube1"),
    Data5=flatten("snap3_tube2"),
    Data6=flatten("snap3_tube2"),
    Data7=flatten("snap3_tube2"),
    Data8=flatten("snap3_tube2"))
merge_37 = Merge(Data1=flatten(geo_16), Data2=flatten(tar_tube_6), Data3=flatten(tar_tube_5))
merge_38 = Merge(
    Data1=flatten(src_tube_6.i),
    Data2=flatten(src_tube_6.item_1),
    Data3=flatten(src_tube_6.item_2),
    Data4=flatten(src_tube_6.item_3),
    Data5=flatten(src_tube_5.i),
    Data6=flatten(src_tube_5.item_1),
    Data7=flatten(src_tube_5.item_2),
    Data8=flatten(src_tube_5.item_3))
merge_39 = Merge(
    Data1=flatten("snap1_tube2_a"),
    Data2=flatten("snap1_tube2_a"),
    Data3=flatten("snap1_tube2_a"),
    Data4=flatten("snap1_tube2_a"),
    Data5=flatten("snap1_tube2_b"),
    Data6=flatten("snap1_tube2_b"),
    Data7=flatten("snap1_tube2_b"),
    Data8=flatten("snap1_tube2_b"))
src_tube_7 = SrcTube(P=tar_tube_7)  # -> i, item_1, item_2, item_3
python_3 = GhPythonScript(target_inputs=merge_25, source_planes=merge_26, source_tags=panel_3)  # -> out, a; inputs target_inputs: list, source_planes: list, source_tags: list
# ---------- python_3: Python ----------
__author__ = "jason"
__version__ = "2020.02.05"

import rhinoscriptsyntax as rs

inputs = [target_inputs, source_planes, source_tags]

a = inputs
# ---------- end python_3 ----------
python_4 = GhPythonScript(target_inputs=merge_28, source_planes=merge_27, source_tags=panel_5)  # -> out, a; inputs target_inputs: list, source_planes: list, source_tags: list; same code as python_3
python_5 = GhPythonScript(target_inputs=merge_29, source_planes=merge_30, source_tags=panel_4)  # -> out, a; inputs target_inputs: list, source_planes: list, source_tags: list; same code as python_3
tar_plug_3 = TarPlug(pt_group_source=pt_group_1a)
tar_plug_4 = TarPlug(pt_group_source=pt_group_1b)
tar_plug_5 = TarPlug(pt_group_source=pt_group_2)
tar_tube_8 = TarTube(pt_tube_2=pt_tube_1a)
pt_37 = Point(item_20.Item2)
pt_38 = Point(item_20.Item7)
pt_39 = Point(item_20.Item8)
pt_40 = Point(item_20.Item6)
pt_41 = Point(item_20.Item5)
pt_42 = Point(item_20.Item3)
pt_43 = Point(item_20.Item4)
pln_source_tube_2_180_deg = Plane(src_tube_7.item_2)
pln_source_tube_2_270_deg = Plane(src_tube_7.item_3)
pln_source_plug_1_180_deg = Plane(src_plug.P_2)
pln_source_tube_2_90_deg = Plane(src_tube_7.item_1)
pln_source_tube_2_0_deg = Plane(src_tube_7.i)
pln_source_plug_1_0_deg = Plane(src_plug.P)
src_plug_2 = SrcPlug(pt_group_1=pt_group_1a)  # -> P, P_2
pln_target_tube_2 = Plane(tar_tube_7)
pln_target_plug_1 = Plane(tar_plug_2)
pln_target_plug_2 = Plane(tar_plug)
src_plug_3 = SrcPlug(pt_group_1=pt_group_1b)  # -> P, P_2
merge_40 = Merge(Data1=pt_42, Data2=pt_43, Data3=pt_37)
merge_41 = Merge(Data1=pt_38, Data2=pt_39, Data3=pt_40, Data4=pt_41)
geo_20 = Geometry(item_20.Item)
pt_nib = Point(item_20.Item1)
src_plug_4 = SrcPlug(pt_group_1=pt_group_2)  # -> P, P_2
data_inputs_2 = Data(python_3.a)
data_inputs_3 = Data(python_5.a)
data_inputs_4 = Data(python_4.a)
python_6 = GhPythonScript(target_inputs=merge_31, source_planes=merge_32, source_tags=merge_33)  # -> out, a; inputs target_inputs: list, source_planes: list, source_tags: list; same code as python_3
src_tube_8 = SrcTube(P=tar_tube_8)  # -> i, item_1, item_2, item_3
python_7 = GhPythonScript(target_inputs=merge_34, source_planes=merge_35, source_tags=merge_36)  # -> out, a; inputs target_inputs: list, source_planes: list, source_tags: list; same code as python_3
python_8 = GhPythonScript(target_inputs=merge_37, source_planes=merge_38, source_tags=merge_39)  # -> out, a; inputs target_inputs: list, source_planes: list, source_tags: list; same code as python_3

# ---- group: Nib only
src_plug_5 = SrcPlug_2(pt_group_1=merge_41)  # -> P, P_2

# ---- group: Nib Only
tar_tube_9 = TarTube_2(pt_tube_2=merge_40)  # -> P, P_2, P_3, P_5, P_6, P_4

# ----
pln_source_tube_1_180 = Plane(src_tube_8.item_2)
pln_source_tube_1_270 = Plane(src_tube_8.item_3)
pln_source_tube_1_90 = Plane(src_tube_8.item_1)
pln_source_plug_1a_180 = Plane(src_plug_2.P_2)
pln_source_plug_1b_180 = Plane(src_plug_3.P_2)
pln_source_tube_1_0 = Plane(src_tube_8.i)
pln_source_plug_2_180 = Plane(src_plug_4.P_2)
pln_source_plug_1a_0 = Plane(src_plug_2.P)
pln_source_plug_1b_0 = Plane(src_plug_3.P)
pln_target_plug_1a = Plane(tar_plug_3)
pln_target_plug_1b = Plane(tar_plug_4)
pln_source_plug_2_0 = Plane(src_plug_4.P)
pln_target_tube_1 = Plane(tar_tube_8)
pln_target_plug_2_2 = Plane(tar_plug_5)

# ---- group: Visualize Plane and Vector
cluster_5 = Cluster(pln=pln_target_plug_2)

cluster_6 = Cluster(pln=pln_target_plug_1)

# ----
data_inputs_5 = Data(python_6.a)
data_inputs_6 = Data(python_7.a)
data_inputs_7 = Data(python_8.a)

# ---- group: Visualize Plane and Vector
cluster_7 = Cluster(pln=pln_target_plug_2_2)

# ----
pln_source_plug_2 = Plane(tar_tube_9.P_5)
pln_source_plug_2_2 = Plane(tar_tube_9.P_6)
pln_source_plug_1 = Plane(src_plug_5.P_2)
pln_source_plug_2_3 = Plane(tar_tube_9.P_2)
pln_source_plug_1_2 = Plane(src_plug_5.P)
pln_source_plug_2_4 = Plane(tar_tube_9.P_3)
pln_source_plug_2_5 = Plane(tar_tube_9.P_4)
pln_source_plug_2_6 = Plane(tar_tube_9.P)
pt_nib_2 = Point(pt_nib)
merge_42 = Merge(
    Data1=flatten(pln_source_tube_2_0_deg),
    Data2=flatten(pln_source_tube_2_90_deg),
    Data3=flatten(pln_source_tube_2_180_deg),
    Data4=flatten(pln_source_tube_2_270_deg),
    Data5=flatten(pln_source_plug_1_0_deg),
    Data6=flatten(pln_source_plug_1_180_deg))  # -> flatten(Result)
merge_43 = Merge(
    Data1=flatten("wedge_tube2"),
    Data2=flatten("wedge_tube2"),
    Data3=flatten("wedge_tube2"),
    Data4=flatten("wedge_tube2"),
    Data5=flatten("wedge_plug1"),
    Data6=flatten("wedge_plug1"))  # -> flatten(Result)
merge_44 = Merge(
    Data1=flatten(geo_18),
    Data2=flatten(pln_target_plug_1),
    Data3=flatten(pln_target_plug_2),
    Data4=flatten(pln_target_tube_2))  # -> flatten(Result)
merge_45 = Merge(Data1=flatten(geo_20), Data2=flatten(pt_nib_2))
merge_46 = Merge(
    Data1=flatten("nib_plug2_a"),
    Data2=flatten("nib_plug2_b"),
    Data3=flatten("nib_tube1_a"),
    Data4=flatten("nib_tube1_b"),
    Data5=flatten("nib_tube2_a"),
    Data6=flatten("nib_tube2_b"),
    Data7=flatten("nib_snap_a"),
    Data8=flatten("nib_snap_b"))
merge_47 = Merge(
    Data1=flatten(pln_source_plug_1_2),
    Data2=flatten(pln_source_plug_1),
    Data3=flatten(pln_source_plug_2_3),
    Data4=flatten(pln_source_plug_2_6),
    Data5=flatten(pln_source_plug_2),
    Data6=flatten(pln_source_plug_2_4),
    Data7=flatten(pln_source_plug_2_2),
    Data8=flatten(pln_source_plug_2_5))
merge_48 = Merge(
    Data1=flatten(pln_source_tube_1_0),
    Data2=flatten(pln_source_tube_1_90),
    Data3=flatten(pln_source_tube_1_180),
    Data4=flatten(pln_source_tube_1_270),
    Data5=flatten(pln_source_plug_1a_0),
    Data6=flatten(pln_source_plug_1a_180),
    Data7=flatten(pln_source_plug_1b_0),
    Data8=flatten(pln_source_plug_1b_180),
    Data9=flatten(pln_source_plug_2_0),
    Data10=flatten(pln_source_plug_2_180))
merge_49 = Merge(
    Data1=flatten("arc_tube1"),
    Data2=flatten("arc_tube1"),
    Data3=flatten("arc_tube1"),
    Data4=flatten("arc_tube1"),
    Data5=flatten("arc_plug1_a"),
    Data6=flatten("arc_plug1_a"),
    Data7=flatten("arc_plug1_b"),
    Data8=flatten("arc_plug1_b"),
    Data9=flatten("arc_plug2"),
    Data10=flatten("arc_plug2"))
merge_50 = Merge(
    Data1=flatten(geo_17),
    Data2=flatten(pln_target_plug_1a),
    Data3=flatten(pln_target_plug_1b),
    Data4=flatten(pln_target_plug_2_2),
    Data5=flatten(pln_target_tube_1))

# ---- group: Visualize Plane and Vector
cluster_8 = Cluster()

# ----
python_9 = GhPythonScript(target_inputs=merge_44, source_planes=merge_42, source_tags=merge_43)  # -> out, a; inputs target_inputs: list, source_planes: list, source_tags: list; same code as python_3
python_10 = GhPythonScript(target_inputs=merge_45, source_planes=merge_47, source_tags=merge_46)  # -> out, a; inputs target_inputs: list, source_planes: list, source_tags: list; same code as python_3
python_11 = GhPythonScript(target_inputs=merge_50, source_planes=merge_48, source_tags=merge_49)  # -> out, a; inputs target_inputs: list, source_planes: list, source_tags: list; same code as python_3
data_inputs_8 = Data(python_9.a)
data_inputs_9 = Data(python_10.a)
data_inputs_10 = Data(python_11.a)
panel_6 = Panel(data_inputs_8)

# ---- group: Tweak list to adjust frequency
block_list = Panel("""Tube 1
Tube 1
Tube 2
Tube 2
Tube 3
Snap 1
Snap 2
Snap 3
Arc
Arc
Wedge
Wedge""")

# ----
number_slider = Slider(40, range=0..50)
number_slider_2 = Slider(1, range=0..10)
lng = ListLength(List=block_list)
block_list_2 = Panel("""Tube 1
Tube 2
Tube 3
Snap 1
Snap 2
Snap 3
Arc
Sliver
Wedge
Nib""")
dom = ConstructDomain(DomainStart=0, DomainEnd=expr("x-1", lng))
dom_2 = ConstructDomain(DomainStart=0, DomainEnd=Slider(100, range=0..100))

# ---- group: Add Nibs last
division = Division(A=number_slider, B=Slider(8, range=0..10))
int = Integer(division)
random = Random(Range=dom_2, Number=int, Seed=Slider(0, range=0..10), Integers=True)
repeat = RepeatData(Data="Nib", Length=int)

# ----
rad = Radians(Degrees=Slider(0, range=0..359))
num_rotation = Number(rad)

random_2 = Random(Range=dom, Number=number_slider, Seed=number_slider_2, Integers=True)
random_3 = Random(Range=dom_2, Number=number_slider, Seed=number_slider_2, Integers=True)
number_slider_3 = Slider(0, range=0..20)
item_21 = ListItem(List=block_list, Index=random_2, Wrap=True)
list = ItemSelector(
    block_list_2,
    {"Tube 1", "Tube 2", "Tube 3", "Snap 1", "Snap 2", "Snap 3", "Arc", "Sliver", "Wedge", "Nib"}, selected="Tube 3")
list_2 = ItemSelector(
    block_list_2,
    {"Tube 1", "Tube 2", "Tube 3", "Snap 1", "Snap 2", "Snap 3", "Arc", "Sliver", "Wedge", "Nib"}, selected="Wedge")
list_3 = ItemSelector(
    block_list_2,
    {"Tube 1", "Tube 2", "Tube 3", "Snap 1", "Snap 2", "Snap 3", "Arc", "Sliver", "Wedge", "Nib"}, selected="Snap 1")
list_4 = ItemSelector(
    block_list_2,
    {"Tube 1", "Tube 2", "Tube 3", "Snap 1", "Snap 2", "Snap 3", "Arc", "Sliver", "Wedge", "Nib"}, selected="Nib")
list_5 = ItemSelector(
    block_list_2,
    {"Tube 1", "Tube 2", "Tube 3", "Snap 1", "Snap 2", "Snap 3", "Arc", "Sliver", "Wedge", "Nib"}, selected="Arc")
list_6 = ItemSelector(
    block_list_2,
    {"Tube 1", "Tube 2", "Tube 3", "Snap 1", "Snap 2", "Snap 3", "Arc", "Sliver", "Wedge", "Nib"}, selected="Tube 2")
list_7 = ItemSelector(
    block_list_2,
    {"Tube 1", "Tube 2", "Tube 3", "Snap 1", "Snap 2", "Snap 3", "Arc", "Sliver", "Wedge", "Nib"}, selected="Tube 3")
list_8 = ItemSelector(
    block_list_2,
    {"Tube 1", "Tube 2", "Tube 3", "Snap 1", "Snap 2", "Snap 3", "Arc", "Sliver", "Wedge", "Nib"}, selected="Tube 2")
list_9 = ItemSelector(
    block_list_2,
    {"Tube 1", "Tube 2", "Tube 3", "Snap 1", "Snap 2", "Snap 3", "Arc", "Sliver", "Wedge", "Nib"}, selected="Nib")
list_10 = ItemSelector(
    block_list_2,
    {"Tube 1", "Tube 2", "Tube 3", "Snap 1", "Snap 2", "Snap 3", "Arc", "Sliver", "Wedge", "Nib"}, selected="Wedge")
list_11 = ItemSelector(
    block_list_2,
    {"Tube 1", "Tube 2", "Tube 3", "Snap 1", "Snap 2", "Snap 3", "Arc", "Sliver", "Wedge", "Nib"}, selected="Tube 1")
list_12 = ItemSelector(
    block_list_2,
    {"Tube 1", "Tube 2", "Tube 3", "Snap 1", "Snap 2", "Snap 3", "Arc", "Sliver", "Wedge", "Nib"}, selected="Snap 3")
list_13 = ItemSelector(
    block_list_2,
    {"Tube 1", "Tube 2", "Tube 3", "Snap 1", "Snap 2", "Snap 3", "Arc", "Sliver", "Wedge", "Nib"}, selected="Nib")
list_14 = ItemSelector(
    block_list_2,
    {"Tube 1", "Tube 2", "Tube 3", "Snap 1", "Snap 2", "Snap 3", "Arc", "Sliver", "Wedge", "Nib"}, selected="Tube 2")
list_15 = ItemSelector(
    block_list_2,
    {"Tube 1", "Tube 2", "Tube 3", "Snap 1", "Snap 2", "Snap 3", "Arc", "Sliver", "Wedge", "Nib"}, selected="Wedge")
list_16 = ItemSelector(
    block_list_2,
    {"Tube 1", "Tube 2", "Tube 3", "Snap 1", "Snap 2", "Snap 3", "Arc", "Sliver", "Wedge", "Nib"}, selected="Tube 2")
list_17 = ItemSelector(
    block_list_2,
    {"Tube 1", "Tube 2", "Tube 3", "Snap 1", "Snap 2", "Snap 3", "Arc", "Sliver", "Wedge", "Nib"}, selected="Arc")
list_18 = ItemSelector(
    block_list_2,
    {"Tube 1", "Tube 2", "Tube 3", "Snap 1", "Snap 2", "Snap 3", "Arc", "Sliver", "Wedge", "Nib"}, selected="Tube 1")
merge_51 = Merge(Data1=item_21, Data2=repeat)
merge_52 = Merge(Data1=random_3, Data2=random)
merge_53 = Merge(
    Data1=Slider(0, range=0..20),
    Data2=Slider(0, range=0..20),
    Data3=Slider(4, range=0..20),
    Data4=Slider(0, range=0..20),
    Data5=Slider(0, range=0..20),
    Data6=Slider(7, range=0..20),
    Data7=Slider(1, range=0..20),
    Data8=Slider(8, range=0..20),
    Data9=Slider(0, range=0..20),
    Data10=Slider(9, range=0..20),
    Data11=Slider(0, range=0..20),
    Data12=Slider(9, range=0..20),
    Data13=Slider(14, range=0..20),
    Data14=Slider(1, range=0..20),
    Data15=Slider(1, range=0..20),
    Data16=Slider(5, range=0..20),
    Data17=Slider(7, range=0..20),
    Data18=Slider(15, range=0..20))
merge_54 = Merge(
    Data1=list,
    Data2=list_2,
    Data3=list_5,
    Data4=list_11,
    Data5=list_14,
    Data6=list_12,
    Data7=list_6,
    Data8=list_10,
    Data9=list_7,
    Data10=list_3,
    Data11=list_16,
    Data12=list_15,
    Data13=list_17,
    Data14=list_18,
    Data15=list_8,
    Data16=list_9,
    Data17=list_13,
    Data18=list_4)
selection_list = Data(merge_52)
block_list_3 = Data(merge_51)
panel_7 = Panel(block_list_3)
selection_list_2 = Data(merge_53)
selection_list_3 = Data(selection_list_2)
block_list_4 = Data(merge_54)
block_list_5 = Data(block_list_4)
python_12 = GhPythonScript(
    run=Toggle(False),
    rotation_angle=num_rotation,
    block_list=block_list_5,
    selection_list=selection_list_3,
    inputs_base=data_inputs,
    inputs_tube1=data_inputs_2,
    inputs_tube2=data_inputs_3,
    inputs_tube3=data_inputs_4,
    inputs_snap1=data_inputs_7,
    inputs_snap2=data_inputs_5,
    inputs_snap3=data_inputs_6,
    inputs_wedge=data_inputs_8,
    inputs_arc=data_inputs_10,
    inputs_nib=data_inputs_9)  # -> out, blocks, block_meshes, block_edges, traces_lines; inputs run: Boolean, block_list: list, selection_list: list of Int32, inputs_base: list, inputs_tube1: list, inputs_tube2: list, inputs_tube3: list, inputs_snap1: list, inputs_snap2: list, inputs_snap3: list, inputs_wedge: list, inputs_arc: list, inputs_sliver: list, inputs_nib: list
# ---------- python_12: Python ----------
__author__ = "jason"
__version__ = "2020.02.05"

import time
import Rhino.Geometry as rg

#Inputs
global rotation_angle
global block_list
global selection_list
global inputs_base
global inputs_tube1
global inputs_tube2
global inputs_tube3
global inputs_snap1
global inputs_snap2
global inputs_snap3
global inputs_wedge
global inputs_arc
global inputs_sliver
global inputs_nib

global nib_sequence
global traces_points
global traces_lines

#Tags
global tag_tube1_a_outer
global tag_tube1_a_inner
global tag_tube1_b_outer
global tag_tube1_b_inner

global tag_tube2_a_outer
global tag_tube2_a_inner
global tag_tube2_b_outer
global tag_tube2_b_inner

global tag_tube3_a_outer
global tag_tube3_a_inner
global tag_tube3_b_outer
global tag_tube3_b_inner

global tag_snap1_tube2_a
global tag_snap1_tube2_b

global tag_snap2_tube2_a
global tag_snap2_tube2_b

global tag_snap3_tube1
global tag_snap3_tube2

global tag_arc_plug1_a
global tag_arc_plug1_b
global tag_arc_plug2
global tag_arc_tube1

global tag_sliver_plug1
global tag_sliver_plug1
global tag_sliver_tube1
global tag_sliver_tube2

global tag_wedge_plug1
global tag_wedge_plug2
global tag_wedge_tube2

global tag_nib_plug
global tag_nib_tube1_a
global tag_nib_tube1_b
global tag_nib_tube2_a
global tag_nib_tube2_b
global tag_nib_snap

tag_tube1_a_outer = "arc_tube1, sliver_tube1, snap3_tube1" 
tag_tube1_a_inner = "tube2_b_outer, tube3_b_outer, nib_tube1_a"
tag_tube1_b_outer = "arc_tube1, sliver_tube1, snap3_tube1"
tag_tube1_b_inner = "tube2_a_outer, tube3_a_outer, nib_tube1_b"

tag_tube2_a_outer = "wedge_tube2, sliver_tube2, tube1_b_inner, snap1_tube2_a, snap1_tube2_b, snap2_tube2_a, snap2_tube2_b, snap3_tube2"
tag_tube2_a_inner = "nib_tube2_a"
tag_tube2_b_outer = "wedge_tube2, sliver_tube2, tube1_a_inner, snap1_tube2_a, snap1_tube2_b, snap2_tube2_a, snap2_tube2_b, snap3_tube2"
tag_tube2_b_inner = "nib_tube2_b"

#This is a little wonky, but tube3 accepts tube 2 tags (b/c those targets share the same locations)
tag_tube3_a_outer = "wedge_tube2, sliver_tube2, tube1_b_inner, snap1_tube2_a, snap1_tube2_b, snap2_tube2_a, snap2_tube2_b, snap3_tube2"
tag_tube3_a_inner = "nib_tube2_a"
tag_tube3_b_outer = "wedge_tube2, sliver_tube2, tube1_a_inner, snap1_tube2_a, snap1_tube2_b, snap2_tube2_a, snap2_tube2_b, snap3_tube2"
tag_tube3_b_inner = "nib_tube2_b"

tag_snap1_tube2_a = "tube2_a_outer, tube2_b_outer, tube3_a_outer, tube3_b_outer, nib_snap_a, nib_snap_b"
tag_snap1_tube2_b = "tube2_a_outer, tube2_b_outer, tube3_a_outer, tube3_b_outer, nib_snap_a, nib_snap_b"

tag_snap2_tube2_a = "tube2_a_outer, tube2_b_outer, tube3_a_outer, tube3_b_outer, nib_snap_a, nib_snap_b"
tag_snap2_tube2_b = "tube2_a_outer, tube2_b_outer, tube3_a_outer, tube3_b_outer, nib_snap_a, nib_snap_b"

tag_snap3_tube1 = "tube1_a_outer, tube1_b_outer"
tag_snap3_tube2 = "tube2_a_outer, tube2_b_outer, tube3_a_outer, tube3_b_outer, nib_snap_a, nib_snap_b"

tag_arc_plug1_a = "arc_plug1_a, arc_plug1_b, sliver_plug1, wedge_plug1"
tag_arc_plug1_b = "arc_plug1_a, arc_plug1_b, sliver_plug1, wedge_plug1"
tag_arc_plug2 = "nib_plug2_a, nib_plug2_b"
tag_arc_tube1 = "tube1_a_outer, tube1_b_outer"

tag_sliver_plug1 = "arc_plug1_a, arc_plug1_b, sliver_plug1, wedge_plug1"
tag_sliver_plug2 = "nib_plug2_a, nib_plug2_b"
tag_sliver_tube1 = "tube1_a_outer, tube1_b_outer"
tag_sliver_tube2 = "tube2_a_outer, tube2_b_outer, tube3_a_outer, tube3_b_outer"

tag_wedge_plug1 = "arc_plug1_a, arc_plug1_b, sliver_plug1, wedge_plug1"
tag_wedge_plug2 = "nib_plug2_a, nib_plug2_b"
tag_wedge_tube2 = "tube2_a_outer, tube2_b_outer, tube3_a_outer, tube3_b_outer"

tag_nib_plug2_a = "arc_plug2, sliver_plug2, wedge_plug2"
tag_nib_plug2_b = "arc_plug2, sliver_plug2, wedge_plug2"
tag_nib_tube1_a = "tube1_a_inner"
tag_nib_tube1_b = "tube1_b_inner"
tag_nib_tube2_a = "tube2_a_inner, tube3_a_inner"
tag_nib_tube2_b = "tube2_a_inner, tube3_a_inner"
tag_nib_snap_a = "snap1_tube2_a, snap1_tube2_b, snap2_tube2_a, snap2_tube2_b, snap3_tube2"
tag_nib_snap_b = "snap1_tube2_a, snap1_tube2_b, snap2_tube2_a, snap2_tube2_b, snap3_tube2"

traces_points = []
traces_lines = []


#---------------------------------------------------------------------------------------------------------------------------------------------------------



def generate_selection_pairs(selection, source_tags, target_tags):
    #Generate list of tuples containing indices for all permutations of available source/target pairs
    pair_list = []
    
    for i, target_tag in enumerate(target_tags):
        for j, source_tag in enumerate(source_tags):
            if source_tag in target_tag.split(", "):
                pair_list.append((j, i))
    
    return pair_list



def next_block(blocks, target_planes, target_tags, count, nib_sequence):
    
#    print "All target tags"
#    for i in target_tags: print i
#    print " "
    
    if len(block_list) > count:
        block = block_list[count]
        
        if block_list[count] == "Tube 1":
            try:
                tube1(blocks, target_planes, target_tags, count, nib_sequence)
            except:
                count += 1
                next_block(blocks, target_planes, target_tags, count, nib_sequence)
        
        elif block_list[count] == "Tube 2":
            try:
                tube2(blocks, target_planes, target_tags, count, nib_sequence)
            except:
                count += 1
                next_block(blocks, target_planes, target_tags, count, nib_sequence)
        
        elif block_list[count] == "Tube 3":
            try:
                tube3(blocks, target_planes, target_tags, count, nib_sequence)
            except:
                count += 1
                next_block(blocks, target_planes, target_tags, count, nib_sequence)
        
        elif block_list[count] == "Snap 1":
            try:
                snap1(blocks, target_planes, target_tags, count, nib_sequence)
            except:
                count += 1
                next_block(blocks, target_planes, target_tags, count, nib_sequence)
        
        elif block_list[count] == "Snap 2":
            try:
                snap2(blocks, target_planes, target_tags, count, nib_sequence)
            except:
                count += 1
                next_block(blocks, target_planes, target_tags, count, nib_sequence)
        
        elif block_list[count] == "Snap 3":
            try:
                snap3(blocks, target_planes, target_tags, count, nib_sequence)
            except:
                count += 1
                next_block(blocks, target_planes, target_tags, count, nib_sequence)
        
        elif block_list[count] == "Arc":
            try:
                arc(blocks, target_planes, target_tags, count, nib_sequence)
            except:
                count += 1
                next_block(blocks, target_planes, target_tags, count, nib_sequence)
        
        elif block_list[count] == "Sliver":
            
            try:
                sliver(blocks, target_planes, target_tags, count, nib_sequence)
            except:
                count +=1 
                next_block(blocks, target_planes, target_tags, count, nib_sequence)
        
        elif block_list[count] == "Wedge":
            try:
                wedge(blocks, target_planes, target_tags, count, nib_sequence)
            except:
                count += 1
                next_block(blocks, target_planes, target_tags, count, nib_sequence)
        
        elif block_list[count] == "Nib":
            try:
                nib(blocks, target_planes, target_tags, count, nib_sequence)
            except:
                count += 1
                next_block(blocks, target_planes, target_tags, count, nib_sequence)
        
        else:
            print "Block does not exist."
            count += 1
            next_block(blocks, target_planes, target_tags, count, nib_sequence)
        
    else:
        print "Done"
        return blocks



def base():
    #Define geometry
    sphere = inputs_base[0]
    tube = inputs_base[1]
    axis = inputs_base[2]
    
    #Make duplicates of initial plane or else recomputing will continuously modify planes
    plane_tube1_a_outer = rg.Plane(inputs_base[3]) #For attaching blocks
    plane_tube1_a_inner = rg.Plane(inputs_base[4]) #For inserting Tube2
    
    #Transform
    axis_vector = rg.Vector3d(axis.PointAtEnd - axis.PointAtStart)
    rotation = rg.Transform.Rotation(rotation_angle, axis_vector, axis.PointAtEnd)
    sphere.Transform(rotation)
    tube.Transform(rotation)
    plane_tube1_a_outer.Transform(rotation)
    plane_tube1_a_inner.Transform(rotation)
    
    #Modify master lists (blocks, target_planes, target_tags)
    nib_sequence = 0
    blocks = []
    target_planes = []
    target_tags = []
    
    blocks.append(sphere)
    blocks.append(tube)
    
    target_planes.append(plane_tube1_a_outer)
    target_planes.append(plane_tube1_a_inner)
    target_tags.append(tag_tube1_a_outer)
    target_tags.append(tag_tube1_a_inner)
    
    count = 0
    
    next_block(blocks, target_planes, target_tags, count, nib_sequence)
    
    return blocks



def tube1(blocks, target_planes, target_tags, count, nib_sequence):
    #Inputs
    data = inputs_tube1[0]
    source_planes = inputs_tube1[1]
    source_tags = inputs_tube1[2]
    
    try:
        selection_index = selection_list[count]
    except:
        selection_index = 0 #0 is default value if no selection provided
    
    #Define Geometry
    #Make duplicates or else recomputing will continuously modify planes
    tube1 = data[0].Duplicate()
    plane_tube1_a_outer = rg.Plane(data[1])
    plane_tube1_a_inner = rg.Plane(data[2])
    plane_tube1_b_outer = rg.Plane(data[3])
    plane_tube1_b_inner = rg.Plane(data[4])
    
    #Determine source and target planes
    pair_list = generate_selection_pairs(selection_index, source_tags, target_tags)
    source_target_pair = pair_list[selection_index % len(pair_list)]
    source_plane = source_planes[source_target_pair[0]]
    source_tag_choice = source_tags[source_target_pair[0]]
    target_plane = target_planes.pop(source_target_pair[1])
    target_tag = target_tags.pop(source_target_pair[1])
    
    #Transform Orientation
    orient = rg.Transform.PlaneToPlane(source_plane, target_plane)
    tube1.Transform(orient)
    plane_tube1_a_outer.Transform(orient)
    plane_tube1_a_inner.Transform(orient)
    plane_tube1_b_outer.Transform(orient)
    plane_tube1_b_inner.Transform(orient)
    
    #Transform Rotation
    axis_vector = rg.Vector3d(plane_tube1_a_outer.Origin - plane_tube1_b_outer.Origin)
    rotation = rg.Transform.Rotation(rotation_angle, axis_vector, plane_tube1_b_outer.Origin)
    tube1.Transform(rotation)
    plane_tube1_a_outer.Transform(rotation)
    plane_tube1_a_inner.Transform(rotation)
    plane_tube1_b_outer.Transform(rotation)
    plane_tube1_b_inner.Transform(rotation)
    
    #Modify master lists (blocks, planes, tags)
    print "Adding Tube 1"
    blocks.append(tube1)
    
    #If Tube 1 is placed on Tube 2/3, then we have to remove the corresponding Tube 2/3 inner plane
    #I.E. you can't place a nib in the end of Tube 2/3 that is already in Tube 1
    if target_tag == tag_tube2_a_outer or target_tag == tag_tube2_b_outer or target_tag == tag_tube3_a_outer or target_tag == tag_tube3_b_outer:
        remove_plane = target_planes.pop(source_target_pair[1]) #Inner plane will always follow the available outer plane
        removve_tag = target_tags.pop(source_target_pair[1]) #Use source_target_pair[1] b/c the index has already been popped, shortening the list, so no need for +1
    
    temp_list_target_planes = [plane_tube1_a_outer, plane_tube1_a_inner, plane_tube1_b_outer, plane_tube1_b_inner]
    temp_list_target_tags = [tag_tube1_a_outer, tag_tube1_a_inner, tag_tube1_b_outer, tag_tube1_b_inner]
    temp_list_source_tags = ["tube1_a_outer", "tube1_a_inner", "tube1_b_outer", "tube1_b_inner"]
    
    for i, tag in enumerate(temp_list_source_tags):
        if tag == source_tag_choice:
            pass
        else:
            target_planes.append(temp_list_target_planes[i])
            target_tags.append(temp_list_target_tags[i])
    
    #Create next block
    count += 1
    next_block(blocks, target_planes, target_tags, count, nib_sequence)



def tube2(blocks, target_planes, target_tags, count, nib_sequence):
    #Inputs
    data = inputs_tube2[0]
    source_planes = inputs_tube2[1]
    source_tags = inputs_tube2[2]
    try:
        selection_index = selection_list[count]
    except:
        selection_index = 0
    
    #Define Geometry
    #Make duplicates or else recomputing will continuously modify planes
    tube2 = data[0].Duplicate()
    pt1 = rg.Point3d(data[1])
    pt2 = rg.Point3d(data[2])
    pt3 = rg.Point3d(data[3])
    pt4 = rg.Point3d(data[4])
    plane_tube2_a_outer = rg.Plane(data[5])
    plane_tube2_a_inner = rg.Plane(data[6])
    plane_tube2_b_outer = rg.Plane(data[7])
    plane_tube2_b_inner = rg.Plane(data[8])
    
    #Determine source and target planes
    pair_list = generate_selection_pairs(selection_index, source_tags, target_tags)
    source_target_pair = pair_list[selection_index % len(pair_list)]
    source_plane = source_planes[source_target_pair[0]]
    source_tag_choice = source_tags[source_target_pair[0]]
    target_plane = target_planes.pop(source_target_pair[1])
    target_tag = target_tags.pop(source_target_pair[1])
    
    #Transform Orientation
    orient = rg.Transform.PlaneToPlane(source_plane, target_plane)
    tube2.Transform(orient)
    pt1.Transform(orient)
    pt2.Transform(orient)
    pt3.Transform(orient)
    pt4.Transform(orient)
    plane_tube2_a_outer.Transform(orient)
    plane_tube2_a_inner.Transform(orient)
    plane_tube2_b_outer.Transform(orient)
    plane_tube2_b_inner.Transform(orient)
    
    #Transform Rotation
    if source_tag_choice == "tube2_a_outer":
        axis_vector = rg.Vector3d(pt2 - pt1)
        rotation = rg.Transform.Rotation(rotation_angle * 2, axis_vector, pt2)
    else:
        axis_vector = rg.Vector3d(pt3 - pt4)
        rotation = rg.Transform.Rotation(rotation_angle * 2, axis_vector, pt3)
    tube2.Transform(rotation)
    plane_tube2_a_outer.Transform(rotation)
    plane_tube2_a_inner.Transform(rotation)
    plane_tube2_b_outer.Transform(rotation)
    plane_tube2_b_inner.Transform(rotation)
    
    #Modify master lists (blocks, planes, tags)
    print "Adding Tube 2"
    blocks.append(tube2)
    
    #If Tube 2/3 is placed in Tube 1, then that end of Tube 2/3 does not add a tube2_inner plane for that end only
    #I.E. you can't place a nib in the end of Tube 2/3 that is already in Tube 1
    if target_tag == tag_tube1_a_inner:
        temp_list_target_planes = [plane_tube2_a_outer, plane_tube2_a_inner, plane_tube2_b_outer]
        temp_list_target_tags = [tag_tube2_a_outer, tag_tube2_a_inner, tag_tube2_b_outer]
        temp_list_source_tags = ["tube2_a_outer", "tube2_a_inner","tube2_b_outer"]
    elif target_tag == tag_tube1_b_inner:
        temp_list_target_planes = [plane_tube2_a_outer, plane_tube2_b_outer, plane_tube2_b_inner]
        temp_list_target_tags = [tag_tube2_a_outer, tag_tube2_b_outer, tag_tube2_b_inner]
        temp_list_source_tags = ["tube2_a_outer", "tube2_b_outer", "tube2_b_inner"]
    else:
        temp_list_target_planes = [plane_tube2_a_outer, plane_tube2_a_inner, plane_tube2_b_outer, plane_tube2_b_inner]
        temp_list_target_tags = [tag_tube2_a_outer, tag_tube2_a_inner, tag_tube2_b_outer, tag_tube2_b_inner]
        temp_list_source_tags = ["tube2_a_outer", "tube2_a_inner", "tube2_b_outer", "tube2_b_inner"]
    
    for i, tag in enumerate(temp_list_source_tags):
        if tag == source_tag_choice:
            pass
        else:
            target_planes.append(temp_list_target_planes[i])
            target_tags.append(temp_list_target_tags[i])
    
    #Create next block
    count += 1
    next_block(blocks, target_planes, target_tags, count, nib_sequence)



def tube3(blocks, target_planes, target_tags, count, nib_sequence):
    #Inputs
    data = inputs_tube3[0]
    source_planes = inputs_tube3[1]
    source_tags = inputs_tube3[2]
    try:
        selection_index = selection_list[count]
    except:
        selection_index = 0
    
    #Define Geometry
    #Make duplicates or else recomputing will continuously modify planes
    tube3 = data[0].Duplicate()
    pt1 = rg.Point3d(data[1])
    pt2 = rg.Point3d(data[2])
    pt3 = rg.Point3d(data[3])
    pt4 = rg.Point3d(data[4])
    plane_tube3_a_outer = rg.Plane(data[5])
    plane_tube3_a_inner = rg.Plane(data[6])
    plane_tube3_b_outer = rg.Plane(data[7])
    plane_tube3_b_inner = rg.Plane(data[8])
    
    #Determine source and target planes
    pair_list = generate_selection_pairs(selection_index, source_tags, target_tags)
    source_target_pair = pair_list[selection_index % len(pair_list)]
    source_plane = source_planes[source_target_pair[0]]
    source_tag_choice = source_tags[source_target_pair[0]]
    target_plane = target_planes.pop(source_target_pair[1])
    target_tag = target_tags.pop(source_target_pair[1])
    
    #Transform Orientation
    orient = rg.Transform.PlaneToPlane(source_plane, target_plane)
    tube3.Transform(orient)
    pt1.Transform(orient)
    pt2.Transform(orient)
    pt3.Transform(orient)
    pt4.Transform(orient)
    plane_tube3_a_outer.Transform(orient)
    plane_tube3_a_inner.Transform(orient)
    plane_tube3_b_outer.Transform(orient)
    plane_tube3_b_inner.Transform(orient)
    
    #Transform Rotation
    if source_tag_choice == "tube3_a_outer":
        axis_vector = rg.Vector3d(pt2 - pt1)
        rotation = rg.Transform.Rotation(rotation_angle * 2, axis_vector, pt2)
    else:
        axis_vector = rg.Vector3d(pt3 - pt4)
        rotation = rg.Transform.Rotation(rotation_angle * 2, axis_vector, pt3)
    tube3.Transform(rotation)
    plane_tube3_a_outer.Transform(rotation)
    plane_tube3_a_inner.Transform(rotation)
    plane_tube3_b_outer.Transform(rotation)
    plane_tube3_b_inner.Transform(rotation)
    
    #Modify master lists (blocks, planes, tags)
    print "Adding Tube 3"
    blocks.append(tube3)
    
    #If Tube 2/3 is placed in Tube 1, then that end of Tube 2/3 does not add a tube2_inner plane for that end only
    #I.E. you can't place a nib in the end of Tube 2/3 that is already in Tube 1
    if target_tag == tag_tube1_a_inner:
        temp_list_target_planes = [plane_tube3_a_outer, plane_tube3_a_inner, plane_tube3_b_outer]
        temp_list_target_tags = [tag_tube3_a_outer, tag_tube3_a_inner, tag_tube3_b_outer]
        temp_list_source_tags = ["tube3_a_outer", "tube3_a_inner","tube3_b_outer"]
    elif target_tag == tag_tube1_b_inner:
        temp_list_target_planes = [plane_tube3_a_outer, plane_tube3_b_outer, plane_tube3_b_inner]
        temp_list_target_tags = [tag_tube3_a_outer, tag_tube3_b_outer, tag_tube3_b_inner]
        temp_list_source_tags = ["tube3_a_outer", "tube3_b_outer", "tube3_b_inner"]
    else:
        temp_list_target_planes = [plane_tube3_a_outer, plane_tube3_a_inner, plane_tube3_b_outer, plane_tube3_b_inner]
        temp_list_target_tags = [tag_tube3_a_outer, tag_tube3_a_inner, tag_tube3_b_outer, tag_tube3_b_inner]
        temp_list_source_tags = ["tube3_a_outer", "tube3_a_inner", "tube3_b_outer", "tube3_b_inner"]
    
    for i, tag in enumerate(temp_list_source_tags):
        if tag == source_tag_choice:
            pass
        else:
            target_planes.append(temp_list_target_planes[i])
            target_tags.append(temp_list_target_tags[i])
    
    #Create next block
    count += 1
    next_block(blocks, target_planes, target_tags, count, nib_sequence)



def snap1(blocks, target_planes, target_tags, count, nib_sequence):
    #Inputs
    data = inputs_snap1[0]
    source_planes = inputs_snap1[1]
    source_tags = inputs_snap1[2]
    try:
        selection_index = selection_list[count]
    except:
        selection_index = 0
    
    #Define Geometry
    #Make duplicates or else recomputing will continuously modify planes
    snap = data[0].Duplicate()
    plane_snap_tube2_a = rg.Plane(data[1])
    plane_snap_tube2_b = rg.Plane(data[2])
    
    #Determine source and target planes
    pair_list = generate_selection_pairs(selection_index, source_tags, target_tags)
    source_target_pair = pair_list[selection_index % len(pair_list)]
    source_plane = source_planes[source_target_pair[0]]
    source_tag_choice = source_tags[source_target_pair[0]]
    target_plane = target_planes.pop(source_target_pair[1])
    target_tag = target_tags.pop(source_target_pair[1])
    
    #Transform (geometry must be defined first so that transform happens in place)
    orient = rg.Transform.PlaneToPlane(source_plane, target_plane)
    snap.Transform(orient)
    plane_snap_tube2_a.Transform(orient)
    plane_snap_tube2_b.Transform(orient)
    
    #Modify master lists (blocks, planes, tags)
    print "Adding Snap 1"
    blocks.append(snap)
    temp_list_target_planes = [plane_snap_tube2_a, plane_snap_tube2_b]
    temp_list_target_tags = [tag_snap1_tube2_a, tag_snap1_tube2_b]
    temp_list_source_tags = ["snap1_tube2_a", "snap1_tube2_b"]
    
    for i, tag in enumerate(temp_list_source_tags):
        if tag == source_tag_choice:
            pass
        else:
            target_planes.append(temp_list_target_planes[i])
            target_tags.append(temp_list_target_tags[i])
    
    #Create next block
    count += 1
    next_block(blocks, target_planes, target_tags, count, nib_sequence)



def snap2(blocks, target_planes, target_tags, count, nib_sequence):
    #Inputs
    data = inputs_snap2[0]
    source_planes = inputs_snap2[1]
    source_tags = inputs_snap2[2]
    try:
        selection_index = selection_list[count]
    except:
        selection_index = 0
    
    #Define Geometry
    #Make duplicates or else recomputing will continuously modify planes
    snap = data[0].Duplicate()
    plane_snap_tube2_a = rg.Plane(data[1])
    plane_snap_tube2_b = rg.Plane(data[2])
    
    #Determine source and target planes
    pair_list = generate_selection_pairs(selection_index, source_tags, target_tags)
    source_target_pair = pair_list[selection_index % len(pair_list)]
    source_plane = source_planes[source_target_pair[0]]
    source_tag_choice = source_tags[source_target_pair[0]]
    target_plane = target_planes.pop(source_target_pair[1])
    target_tag = target_tags.pop(source_target_pair[1])
    
    #Transform (geometry must be defined first so that transform happens in place)
    orient = rg.Transform.PlaneToPlane(source_plane, target_plane)
    snap.Transform(orient)
    plane_snap_tube2_a.Transform(orient)
    plane_snap_tube2_b.Transform(orient)
    
    #Modify master lists (blocks, planes, tags)
    print "Adding Snap 2"
    blocks.append(snap)
    temp_list_target_planes = [plane_snap_tube2_a, plane_snap_tube2_b]
    temp_list_target_tags = [tag_snap2_tube2_a, tag_snap2_tube2_b]
    temp_list_source_tags = ["snap2_tube2_a", "snap2_tube2_b"]
    
    for i, tag in enumerate(temp_list_source_tags):
        if tag == source_tag_choice:
            pass
        else:
            target_planes.append(temp_list_target_planes[i])
            target_tags.append(temp_list_target_tags[i])
    
    #Create next block
    count += 1
    next_block(blocks, target_planes, target_tags, count, nib_sequence)



def snap3(blocks, target_planes, target_tags, count, nib_sequence):
    #Inputs
    data = inputs_snap3[0]
    source_planes = inputs_snap3[1]
    source_tags = inputs_snap3[2]
    try:
        selection_index = selection_list[count]
    except:
        selection_index = 0
    
    #Define Geometry
    #Make duplicates or else recomputing will continuously modify planes
    snap = data[0].Duplicate()
    plane_snap_tube1 = rg.Plane(data[1])
    plane_snap_tube2 = rg.Plane(data[2])
    
    #Determine source and target planes
    pair_list = generate_selection_pairs(selection_index, source_tags, target_tags)
    source_target_pair = pair_list[selection_index % len(pair_list)]
    source_plane = source_planes[source_target_pair[0]]
    source_tag_choice = source_tags[source_target_pair[0]]
    target_plane = target_planes.pop(source_target_pair[1])
    target_tag = target_tags.pop(source_target_pair[1])
    
    #Transform (geometry must be defined first so that transform happens in place)
    orient = rg.Transform.PlaneToPlane(source_plane, target_plane)
    snap.Transform(orient)
    plane_snap_tube1.Transform(orient)
    plane_snap_tube2.Transform(orient)
    
    #Modify master lists (blocks, planes, tags)
    print "Adding Snap 3"
    blocks.append(snap)
    temp_list_target_planes = [plane_snap_tube1, plane_snap_tube2]
    temp_list_target_tags = [tag_snap3_tube1, tag_snap3_tube2]
    temp_list_source_tags = ["snap3_tube1", "snap3_tube2"]
    
    for i, tag in enumerate(temp_list_source_tags):
        if tag == source_tag_choice:
            pass
        else:
            target_planes.append(temp_list_target_planes[i])
            target_tags.append(temp_list_target_tags[i])
    
    #Create next block
    count += 1
    next_block(blocks, target_planes, target_tags, count, nib_sequence)



def arc(blocks, target_planes, target_tags, count, nib_sequence):
    #Inputs
    data = inputs_arc[0]
    source_planes = inputs_arc[1]
    source_tags = inputs_arc[2]
    try:
        selection_index = selection_list[count]
    except:
        selection_index = 0
    
    #Define Geometry
    #Make duplicates or else recomputing will continuously modify planes
    arc = data[0].Duplicate()
    plane_arc_plug1_a = rg.Plane(data[1])
    plane_arc_plug1_b = rg.Plane(data[2])
    plane_arc_plug2 = rg.Plane(data[3])
    plane_arc_tube1 = rg.Plane(data[4])
    
    #Determine source and target planes
    pair_list = generate_selection_pairs(selection_index, source_tags, target_tags)
    source_target_pair = pair_list[selection_index % len(pair_list)]
    source_plane = source_planes[source_target_pair[0]]
    source_tag_choice = source_tags[source_target_pair[0]]
    target_plane = target_planes.pop(source_target_pair[1])
    target_tag = target_tags.pop(source_target_pair[1])
    
    #Transform (geometry must be defined first so that transform happens in place)
    orient = rg.Transform.PlaneToPlane(source_plane, target_plane)
    arc.Transform(orient)
    plane_arc_plug1_a.Transform(orient)
    plane_arc_plug1_b.Transform(orient)
    plane_arc_plug2.Transform(orient)
    plane_arc_tube1.Transform(orient)
    
    #Modify master lists (blocks, planes, tags)
    print "Adding Arc"
    blocks.append(arc)
    temp_list_target_planes = [plane_arc_plug1_a, plane_arc_plug1_b, plane_arc_plug2, plane_arc_tube1]
    temp_list_target_tags = [tag_arc_plug1_a, tag_arc_plug1_b, tag_arc_plug2, tag_arc_tube1]
    temp_list_source_tags = ["arc_plug1_a", "arc_plug1_b", "arc_plug2","arc_tube1"]
    
    for i, tag in enumerate(temp_list_source_tags):
        if tag == source_tag_choice:
            pass
        else:
            target_planes.append(temp_list_target_planes[i])
            target_tags.append(temp_list_target_tags[i])
    
    #Create next block
    count += 1
    next_block(blocks, target_planes, target_tags, count, nib_sequence)



def sliver(blocks, target_planes, target_tags, count, nib_sequence):
    #Inputs
    data = inputs_sliver[0]
    source_planes = inputs_sliver[1]
    source_tags = inputs_sliver[2]
    try:
        selection_index = selection_list[count]
    except:
        selection_index = 0
    
    #Define Geometry
    #Make duplicates or else recomputing will continuously modify planes
    sliver = data[0].Duplicate()
    plane_sliver_plug1 = rg.Plane(data[1])
    plane_sliver_plug2 = rg.Plane(data[2])
    plane_sliver_tube1 = rg.Plane(data[3])
    plane_sliver_tube2 = rg.Plane(data[4])
    
    #Determine source and target planes
    pair_list = generate_selection_pairs(selection_index, source_tags, target_tags)
    source_target_pair = pair_list[selection_index % len(pair_list)]
    source_plane = source_planes[source_target_pair[0]]
    source_tag_choice = source_tags[source_target_pair[0]]
    target_plane = target_planes.pop(source_target_pair[1])
    target_tag = target_tags.pop(source_target_pair[1])
    
    #Transform (geometry must be defined first so that transform happens in place)
    orient = rg.Transform.PlaneToPlane(source_plane, target_plane)
    sliver.Transform(orient)
    plane_sliver_plug1.Transform(orient)
    plane_sliver_plug2.Transform(orient)
    plane_sliver_tube1.Transform(orient)
    plane_sliver_tube2.Transform(orient)
    
    #Modify master lists (blocks, planes, tags)
    print "Adding Sliver"
    blocks.append(sliver)
    temp_list_target_planes = [plane_sliver_plug1, plane_sliver_plug2, plane_sliver_tube1, plane_sliver_tube2]
    temp_list_target_tags = [tag_sliver_plug1, tag_sliver_plug2, tag_sliver_tube1, tag_sliver_tube2]
    temp_list_source_tags = ["sliver_plug1", "sliver_plug2", "sliver_tube1", "sliver_tube2"]
    
    for i, tag in enumerate(temp_list_source_tags):
        if tag == source_tag_choice:
            pass
        else:
            target_planes.append(temp_list_target_planes[i])
            target_tags.append(temp_list_target_tags[i])
    
    #Create next block
    count += 1
    next_block(blocks, target_planes, target_tags, count, nib_sequence)



def wedge(blocks, target_planes, target_tags, count, nib_sequence):
    #Inputs
    data = inputs_wedge[0]
    source_planes = inputs_wedge[1]
    source_tags = inputs_wedge[2]
    try:
        selection_index = selection_list[count]
    except:
        selection_index = 0
    
    #Define Geometry
    #Make duplicates or else recomputing will continuously modify planes
    wedge = data[0].Duplicate()
    plane_wedge_plug1 = rg.Plane(data[1])
    plane_wedge_plug2 = rg.Plane(data[2])
    plane_wedge_tube2 = rg.Plane(data[3])
    
    #Determine source and target planes
    pair_list = generate_selection_pairs(selection_index, source_tags, target_tags)
    source_target_pair = pair_list[selection_index % len(pair_list)]
    source_plane = source_planes[source_target_pair[0]]
    source_tag_choice = source_tags[source_target_pair[0]]
    target_plane = target_planes.pop(source_target_pair[1])
    target_tag = target_tags.pop(source_target_pair[1])
    
    #Transform (geometry must be defined first so that transform happens in place)
    orient = rg.Transform.PlaneToPlane(source_plane, target_plane)
    wedge.Transform(orient)
    plane_wedge_plug1.Transform(orient)
    plane_wedge_plug2.Transform(orient)
    plane_wedge_tube2.Transform(orient)
    
    #Modify master lists (blocks, planes, tags)
    print "Adding Wedge"
    blocks.append(wedge)
    temp_list_target_planes = [plane_wedge_plug1, plane_wedge_plug2, plane_wedge_tube2]
    temp_list_target_tags = [tag_wedge_plug1, tag_wedge_plug2, tag_wedge_tube2]
    temp_list_source_tags = ["wedge_plug1", "wedge_plug2", "wedge_tube2"]
    
    for i, tag in enumerate(temp_list_source_tags):
        if tag == source_tag_choice:
            pass
        else:
            target_planes.append(temp_list_target_planes[i])
            target_tags.append(temp_list_target_tags[i])
    
    #Create next block
    count += 1
    next_block(blocks, target_planes, target_tags, count, nib_sequence)



def nib(blocks, target_planes, target_tags, count, nib_sequence):
    #Inputs
    data = inputs_nib[0]
    source_planes = inputs_nib[1]
    source_tags = inputs_nib[2]
    try:
        selection_index = selection_list[count]
    except:
        selection_index = 0
    
    #Define Geometry
    #Make duplicates or else recomputing will continuously modify planes
    nib_brep = data[0].Duplicate()
    nib_pt = rg.Point3d(data[1])
    
    #Determine source and target planes
    pair_list = generate_selection_pairs(selection_index, source_tags, target_tags)
    source_target_pair = pair_list[selection_index % len(pair_list)]
    source_plane = source_planes[source_target_pair[0]]
    source_tag_choice = source_tags[source_target_pair[0]]
    target_plane = target_planes.pop(source_target_pair[1])
    target_tag = target_tags.pop(source_target_pair[1])
    
    #Transform (geometry must be defined first so that transform happens in place)
    orient = rg.Transform.PlaneToPlane(source_plane, target_plane)
    nib_brep.Transform(orient)
    nib_pt.Transform(orient)
    
    #Modify master lists (blocks, planes, tags)
    print "Adding Nib"
    blocks.append(nib_brep)
    
    #If Nib is placed in Tube 2/3, then we have to ammend the corresponding Tube 2/3 outer plane tag so that a Tube 1 can't be placed over it (but a Wedge or Snap still could)
    #Step 1: confirm target is Tube 2/3
    if target_tag == "nib_tube2_a" or target_tag == "nib_tube2_b":
        #Step 2: confirm which outer plane (if any) still available
        if target_tags[source_target_pair[1] - 1] == tag_tube2_a_outer or target_tags[source_target_pair[1] - 1] == tag_tube2_b_outer or target_tags[source_target_pair[1] - 1] == tag_tube3_a_outer or target_tags[source_target_pair[1] - 1] == tag_tube3_b_outer:
            #Step 3: ammend tag
            target_tags[source_target_pair[1] - 1] = "wedge_tube2, sliver_tube2, snap1_tube2_a, snap1_tube2_b, snap2_tube2_a, snap2_tube2_b, snap3_tube2"
    
    #Add nib_pt to traces_points
    if rotation_angle == 0:
        trace_point = [nib_pt]
        traces_points.append(trace_point)
    else:
        traces_points[nib_sequence].append(nib_pt)
    nib_sequence += 1
    
    #Create next block
    count += 1
    next_block(blocks, target_planes, target_tags, count, nib_sequence)


#---------------------------------------------------------------------------------------------------------------------------------------------------------


def get_edges(blocks):
    block_edges = []
    for block in blocks:
        for edge in block.Edges:
            block_edges.append(edge)
    return block_edges

def get_meshes(blocks):
    block_meshes = []
    for block in blocks:
        block_mesh = rg.Mesh.CreateFromBrep(block)
        for mesh in block_mesh:
            block_meshes.append(mesh)
    return block_meshes

if not run:
    #Build machine
    blocks = base()
#    block_edges = get_edges(blocks)
#    block_meshes = get_meshes(blocks)
else:
    #Run machine
    for i in range(91):
        rotation_angle = i * 0.0698132 #Convert to radians (i = 4 degrees)
        blocks = base()
#        block_edges = get_edges(blocks)
#        block_meshes = get_meshes(blocks)
    for point_list in traces_points:
        trace = rg.Curve.CreateControlPointCurve(point_list)
        traces_lines.append(trace)
# ---------- end python_12 ----------
panel_8 = Panel(python_12.out)
crv = Curve(python_12.block_edges)
geo_21 = Geometry(python_12.blocks)
crv_2 = Curve(flatten([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]))
preview = CustomPreview(Geometry=geo_21, Material=ColourSwatch(SwatchColor=RGB(255, 255, 255)))

merge_55 = Merge(
    Data1=ColourSwatch(SwatchColor=RGB(255, 212, 0)),
    Data2=ColourSwatch(SwatchColor=RGB(119, 255, 0)),
    Data3=ColourSwatch(SwatchColor=RGB(0, 217, 255)),
    Data4=ColourSwatch(SwatchColor=RGB(255, 0, 111)),
    Data5=ColourSwatch(SwatchColor=RGB(119, 0, 255)),
    Data6=ColourSwatch(SwatchColor=RGB(255, 110, 0)))

crv_3 = Curve(flatten(python_12.traces_lines))
jitter = Jitter(List=merge_55, Jitter=1, Seed=Slider(5, range=0..10))  # -> Values, Indices

swatch = ColourSwatch(SwatchColor=RGB(119, 255, 0))
swatch_2 = ColourSwatch(SwatchColor=RGB(255, 110, 0))
swatch_3 = ColourSwatch(SwatchColor=RGB(119, 0, 255))
merge_56 = Merge(
    Data1=ColourSwatch(SwatchColor=RGB(255, 212, 0)),
    Data2=ColourSwatch(SwatchColor=RGB(0, 217, 255)),
    Data3=ColourSwatch(SwatchColor=RGB(255, 0, 111)))

lng_2 = ListLength(List=crv_3)
dom_3 = ConstructDomain(DomainStart=Slider(1, range=0..10), DomainEnd=Slider(10, range=0..10))
repeat_2 = RepeatData(Data=jitter.Values, Length=lng_2)
random_4 = Random(Range=dom_3, Number=lng_2, Seed=2, Integers=True)
panel_9 = Panel(random_4)
previewlw = CustomPreviewLineweights(Geometry=crv_3, Shader=merge_56, Thickness=Slider(2, range=0..10), Absolute=False)

# ==== cluster Cluster
pln = ClusterInput()
pln_2 = Plane(pln)
vec = Vector(pln_2)
pt = Point(pln_2)
amp = Amplitude(Vector=vec, Amplitude=Slider(15, range=0..100))
vdis = VectorDisplay(Anchor=pt, Vector=amp)

# ==== cluster TarPlug
pt_group_source = ClusterInput()
pt_group_source_2 = Point(pt_group_source)
merge = Merge(Data1=Slider(3, range=0..3), Data2=Slider(0, range=0..3), Data3=Slider(1, range=0..3))
item = ListItem(List=pt_group_source_2, Index=merge, Wrap=True)

# ---- group: Center Pt
avr = Average(Input=pt_group_source_2)

# ----
item_2 = ListItem(List=item, Index=0, Wrap=True)  # -> Item, Item1, Item2
pl_3pt = Plane3Pt(PointA=item_2.Item, PointB=item_2.Item1, PointC=item_2.Item2)
item_3 = ListItem(List=pl_3pt, Index=0, Wrap=True)
pl_origin = PlaneOrigin(Base=item_3, Origin=avr)
pl = ClusterOutput(pl_origin)

# ==== cluster TarTube
pt_tube_2 = ClusterInput()
pt_tube_2_2 = Point(pt_tube_2)
item = ListItem(List=pt_tube_2_2, Index=0, Wrap=True)  # -> Item, Item1
vec2pt = Vector2Pt(PointA=item.Item, PointB=item.Item1, Unitize=False)  # -> Vector, Length
pl = PlaneNormal(Origin=item.Item, ZAxis=vec2pt.Vector)
P = ClusterOutput(pl)

# ==== cluster SrcTube
P = ClusterInput()
series = Series(Start=0, Step=Slider(90, range=0..100), Count=Slider(4, range=0..10))
prot = RotatePlane(Plane=P, Angle=degrees(series))
item = ListItem(List=prot, Index=0, Wrap=True)  # -> Item, Item1, Item2, Item3
i = ClusterOutput(item.Item)
item_1 = ClusterOutput(item.Item1)
item_2 = ClusterOutput(item.Item2)
item_3 = ClusterOutput(item.Item3)

# ==== cluster SrcPlug
pt_group_1 = ClusterInput()
pt_group_1_2 = Point(pt_group_1)
merge = Merge(Data1=Slider(1, range=0..3), Data2=Slider(2, range=0..3), Data3=Slider(3, range=0..3))
item = ListItem(List=pt_group_1_2, Index=merge, Wrap=True)

# ---- group: Center Pt
avr = Average(Input=pt_group_1_2)

# ----
item_2 = ListItem(List=item, Index=0, Wrap=True)  # -> Item, Item1, Item2
pl_3pt = Plane3Pt(PointA=item_2.Item, PointB=item_2.Item1, PointC=item_2.Item2)
item_3 = ListItem(List=pl_3pt, Index=0, Wrap=True)
pl_origin = PlaneOrigin(Base=item_3, Origin=avr)
pflip = FlipPlane(Plane=pl_origin, ReverseX=False, ReverseY=False, SwapAxes=True)
P = ClusterOutput(pflip)
prot = RotatePlane(Plane=pflip, Angle=degrees(Slider(180, range=0..1000)))
P_2 = ClusterOutput(prot)

# ==== cluster SrcPlug_2
pt_group_1 = ClusterInput()
pt_group_1_2 = Point(pt_group_1)
merge = Merge(Data1=Slider(1, range=0..3), Data2=Slider(2, range=0..3), Data3=Slider(3, range=0..3))
item = ListItem(List=pt_group_1_2, Index=merge, Wrap=True)

# ---- group: Center Pt
avr = Average(Input=pt_group_1_2)

# ----
item_2 = ListItem(List=item, Index=0, Wrap=True)  # -> Item, Item1, Item2
pl_3pt = Plane3Pt(PointA=item_2.Item, PointB=item_2.Item1, PointC=item_2.Item2)
item_3 = ListItem(List=pl_3pt, Index=0, Wrap=True)
pl_origin = PlaneOrigin(Base=item_3, Origin=avr)
pflip = FlipPlane(Plane=pl_origin, ReverseX=False, ReverseY=False, SwapAxes=True)
prot = RotatePlane(Plane=pflip, Angle=degrees(Slider(90, range=0..100)))
prot_2 = RotatePlane(Plane=pflip, Angle=degrees(Slider(270, range=0..360)))
P = ClusterOutput(prot_2)
P_2 = ClusterOutput(prot)

# ==== cluster TarTube_2
pt_tube_2 = ClusterInput()
pt_tube_2_2 = Point(pt_tube_2)
item = ListItem(List=pt_tube_2_2, Index=0, Wrap=True)  # -> Item, Item1, Item2
vec2pt = Vector2Pt(PointA=item.Item, PointB=item.Item1, Unitize=False)  # -> Vector, Length
pl = PlaneNormal(Origin=item.Item, ZAxis=vec2pt.Vector)
pflip = FlipPlane(Plane=pl, ReverseX=False, ReverseY=False, SwapAxes=True)
pl_2 = PlaneNormal(Origin=item.Item1, ZAxis=vec2pt.Vector)
pl_3 = PlaneNormal(Origin=item.Item2, ZAxis=vec2pt.Vector)
pflip_2 = FlipPlane(Plane=pl_3, ReverseX=False, ReverseY=False, SwapAxes=True)
pflip_3 = FlipPlane(Plane=pl_2, ReverseX=False, ReverseY=False, SwapAxes=True)
P = ClusterOutput(pl)
P_2 = ClusterOutput(pflip)
P_3 = ClusterOutput(pl_2)
P_4 = ClusterOutput(pflip_2)
P_5 = ClusterOutput(pflip_3)
P_6 = ClusterOutput(pl_3)
