# Grasshopper definition 200501_Web.gh (Grasshopper 1.0.7)
# plug-ins: Human, horsterCameraControl

python = GhPythonScript()  # -> out, breps, curves, points, meshes, geo; disabled
# ---------- python: Python ----------
__author__ = "jason"
__version__ = "2020.02.27"

import Rhino
import Rhino.Geometry as rg

breps = []
curves = []
points = []
meshes = []
geo = []

for rObj in Rhino.RhinoDoc.ActiveDoc.Objects:
    geo.append(rObj.Geometry)
    if(rObj.ObjectType == Rhino.DocObjects.ObjectType.Brep):
        breps.append(rObj.Geometry)
    elif(rObj.ObjectType == Rhino.DocObjects.ObjectType.Curve):
        curves.append(rObj.Geometry)
    elif(rObj.ObjectType == Rhino.DocObjects.ObjectType.Point):
        points.append(rObj.Geometry)
    elif(rObj.ObjectType == Rhino.DocObjects.ObjectType.Mesh):
        meshes.append(rObj.Geometry)
# ---------- end python ----------
geo = Geometry(python.geo)  # disabled

# ----
# KPFui GH Standards
# Results
data = Data(True)

# ----
# Viz
data_2 = Data(True)

# ----
# Action
button = Button()

# ----
# Inputs
inputs_panel = Panel("")
data_3 = Data(True)

# ----
# SNAP 2
pt = Point(<point referenced from the Rhino model>)
pt_2 = Point(<point referenced from the Rhino model>)
pt_3 = Point(<point referenced from the Rhino model>)
pt_4 = Point(<point referenced from the Rhino model>)
merge = Merge(Data1=pt, Data2=pt_2)
merge_2 = Merge(Data1=pt_3, Data2=pt_4)
brep_brick = Brep(<brep referenced from the Rhino model>)
pt_tube_2_b = Point(merge_2)
pt_tube_2_a = Point(merge)

# ----
# Intermediate
data_4 = Data(True)

# ----
# SNAP 3
pt_5 = Point(<point referenced from the Rhino model>)
pt_6 = Point(<point referenced from the Rhino model>)
pt_7 = Point(<point referenced from the Rhino model>)
pt_8 = Point(<point referenced from the Rhino model>)
merge_3 = Merge(Data1=pt_6, Data2=pt_5)
merge_4 = Merge(Data1=pt_7, Data2=pt_8)
pt_tube_1 = Point(merge_3)
brep = Brep(<brep referenced from the Rhino model>)
pt_tube_2 = Point(merge_4)

# ----
# BASE
brep_tube = Brep(<brep referenced from the Rhino model>)
brep_base = Brep(<brep referenced from the Rhino model>)
pt_1 = Point(<point referenced from the Rhino model>)
crv_axis = Curve(<curve referenced from the Rhino model>)

# ----
# SNAP 1
pt_9 = Point(<point referenced from the Rhino model>)
pt_10 = Point(<point referenced from the Rhino model>)
pt_11 = Point(<point referenced from the Rhino model>)
pt_12 = Point(<point referenced from the Rhino model>)
merge_5 = Merge(Data1=pt_9, Data2=pt_10)
merge_6 = Merge(Data1=pt_11, Data2=pt_12)
brep_brick_2 = Brep(<brep referenced from the Rhino model>)
pt_tube_2_b_2 = Point(merge_6)
pt_tube_2_a_2 = Point(merge_5)

pt_1_2 = Point(<point referenced from the Rhino model>)

# ----
# ARC
pt_13 = Point(<point referenced from the Rhino model>)
pt_14 = Point(<point referenced from the Rhino model>)
pt_15 = Point(<point referenced from the Rhino model>)
pt_16 = Point(<point referenced from the Rhino model>)
pt_17 = Point(<point referenced from the Rhino model>)
pt_18 = Point(<point referenced from the Rhino model>)
pt_19 = Point(<point referenced from the Rhino model>)
pt_20 = Point(<point referenced from the Rhino model>)
pt_21 = Point(<point referenced from the Rhino model>)
pt_22 = Point(<point referenced from the Rhino model>)
pt_23 = Point(<point referenced from the Rhino model>)
pt_24 = Point(<point referenced from the Rhino model>)
pt_25 = Point(<point referenced from the Rhino model>)
pt_26 = Point(<point referenced from the Rhino model>)
merge_7 = Merge(Data1=pt_15, Data2=pt_16, Data3=pt_17, Data4=pt_18)
merge_8 = Merge(Data1=pt_19, Data2=pt_13, Data3=pt_20, Data4=pt_14)
merge_9 = Merge(Data1=pt_21, Data2=pt_22, Data3=pt_23, Data4=pt_24)
merge_10 = Merge(Data1=pt_25, Data2=pt_26)
pt_group_1a = Point(merge_7)
pt_group_1b = Point(merge_8)
pt_tube_1a = Point(merge_10)
pt_group_2 = Point(merge_9)
brep_arc = Brep(<brep referenced from the Rhino model>)

# ----
# TUBE 1
brep_tube_2 = Brep(<brep referenced from the Rhino model>)
pt_1_3 = Point(<point referenced from the Rhino model>)
pt_1_4 = Point(<point referenced from the Rhino model>)
pt_2_2 = Point(<point referenced from the Rhino model>)
pt_2_3 = Point(<point referenced from the Rhino model>)

# ----
# TUBE 2
brep_tube_2_2 = Brep(<brep referenced from the Rhino model>)
pt_4_2 = Point(<point referenced from the Rhino model>)
pt_2_4 = Point(<point referenced from the Rhino model>)
pt_3_2 = Point(<point referenced from the Rhino model>)
pt_1_5 = Point(<point referenced from the Rhino model>)

# ----
# TUBE 3
brep_tube_2_3 = Brep(<brep referenced from the Rhino model>)
pt_2_5 = Point(<point referenced from the Rhino model>)
pt_1_6 = Point(<point referenced from the Rhino model>)
pt_3_3 = Point(<point referenced from the Rhino model>)
pt_4_3 = Point(<point referenced from the Rhino model>)

id = Guid(brep_base)
pt_27 = Point(<point referenced from the Rhino model>)
pt_28 = Point(<point referenced from the Rhino model>)
pt_29 = Point(<point referenced from the Rhino model>)
pt_30 = Point(<point referenced from the Rhino model>)
xy = XYPlane(Origin=pt_1_3)
xy_2 = XYPlane(Origin=pt_2_2)
xy_3 = XYPlane(Origin=pt_2_3)
pt_31 = Point(<point referenced from the Rhino model>)
xy_4 = XYPlane(Origin=pt_1_4)
pt_32 = Point(<point referenced from the Rhino model>)
pt_33 = Point(<point referenced from the Rhino model>)
pt_34 = Point(<point referenced from the Rhino model>)
pt_35 = Point(<point referenced from the Rhino model>)
pt_36 = Point(<point referenced from the Rhino model>)

# ----
# DO NOT TOUCH
sacred_data_panel = Panel("")
data_5 = Data(True)

xy_5 = XYPlane(Origin=pt_1)
xy_6 = XYPlane(Origin=pt_1_2)
vec2pt = Vector2Pt(PointA=pt_2_5, PointB=pt_1_6, Unitize=False)  # -> Vector, Length
vec2pt_2 = Vector2Pt(PointA=pt_4_3, PointB=pt_3_3, Unitize=False)  # -> Vector, Length
vec2pt_3 = Vector2Pt(PointA=pt_4_2, PointB=pt_3_2, Unitize=False)  # -> Vector, Length
vec2pt_4 = Vector2Pt(PointA=pt_2_4, PointB=pt_1_5, Unitize=False)  # -> Vector, Length
merge_11 = Merge(Data1=pt_27, Data2=pt_28, Data3=pt_29, Data4=pt_30)
merge_12 = Merge(Data1=pt_36, Data2=pt_35)
merge_13 = Merge(Data1=pt_31, Data2=pt_33, Data3=pt_32, Data4=pt_34)
panel = Panel(id)
pln_tube1_a = Plane(xy_6)
pln_tube1_a_2 = Plane(xy_5)

# ----
# WEDGE
pt_group_2_2 = Point(merge_13)
pt_group_1 = Point(merge_11)
pt_tube_2_2 = Point(merge_12)
brep_wedge = Brep(<brep referenced from the Rhino model>)

# ----
# Warning
note = Panel("")
data_6 = Data(True)

tar_tube = TarTube(pt_tube_2=pt_tube_2_b)
tar_tube_2 = TarTube(pt_tube_2=pt_tube_2_a)
tar_tube_3 = TarTube(pt_tube_2=pt_tube_1)
tar_tube_4 = TarTube(pt_tube_2=pt_tube_2)
pl = PlaneNormal(Origin=pt_3_3, ZAxis=vec2pt_2.Vector)
pl_2 = PlaneNormal(Origin=pt_4_3, ZAxis=vec2pt_2.Vector)
pl_3 = PlaneNormal(Origin=pt_1_6, ZAxis=vec2pt.Vector)
tar_tube_5 = TarTube(pt_tube_2=pt_tube_2_b_2)
pl_4 = PlaneNormal(Origin=pt_2_4, ZAxis=vec2pt_4.Vector)
pl_5 = PlaneNormal(Origin=pt_2_5, ZAxis=vec2pt.Vector)
tar_tube_6 = TarTube(pt_tube_2=pt_tube_2_a_2)
pl_6 = PlaneNormal(Origin=pt_1_5, ZAxis=vec2pt_4.Vector)
pl_7 = PlaneNormal(Origin=pt_3_2, ZAxis=vec2pt_3.Vector)
pl_8 = PlaneNormal(Origin=pt_4_2, ZAxis=vec2pt_3.Vector)
merge_14 = Merge(
    Data1=flatten(brep_base),
    Data2=flatten(brep_tube),
    Data3=flatten(crv_axis),
    Data4=flatten(pln_tube1_a_2),
    Data5=flatten(pln_tube1_a))

# ---- group: Visualize Plane and Vector
cluster = Cluster()

# ----
# Note
note_2 = Panel("")

brep_tube_3 = Brep(brep_tube_2)
pln_1 = Plane(xy)
pln_1_2 = Plane(xy_4)
pln_3 = Plane(xy_2)
pln_1_3 = Plane(pl_4)
pln_1_4 = Plane(pl_6)
pln_1_5 = Plane(pl_3)
pln_3_2 = Plane(xy_3)

# ---- group: Visualize Plane and Vector
cluster_2 = Cluster(pln=pln_3_2)

# ----
pln_1_6 = Plane(pl_5)
pln_2 = Plane(pl)

# ---- group: Visualize Plane and Vector
cluster_3 = Cluster(pln=pln_1_4)

# ----
pln_2_2 = Plane(pl_2)

# ---- group: Visualize Plane and Vector
cluster_4 = Cluster()

# ----
pln_2_3 = Plane(pl_7)
pln_2_4 = Plane(pl_8)
data_inputs = Data(merge_14)
brep_tube_2_4 = Brep(brep_tube_2_2)
brep_tube_2_5 = Brep(brep_tube_2_3)
panel_2 = Panel("""tube1_a_outer
tube1_a_inner
tube1_b_outer
tube1_b_inner""")
merge_15 = Merge(Data1=flatten(brep_tube_3), Data2=flatten(pln_1_2), Data3=flatten(pln_1), Data4=flatten(pln_3), Data5=flatten(pln_3_2))
merge_16 = Merge(Data1=flatten(pln_1_2), Data2=flatten(pln_1), Data3=flatten(pln_3), Data4=flatten(pln_3_2))
src_tube = SrcTube(P=tar_tube)  # -> i, item_1, item_2, item_3
src_tube_2 = SrcTube(P=tar_tube_2)  # -> i, item_1, item_2, item_3
panel_3 = Panel("""tube3_a_outer
tube3_b_outer""")
panel_4 = Panel("""tube2_a_outer
tube2_b_outer""")
src_tube_3 = SrcTube(P=tar_tube_4)  # -> i, item_1, item_2, item_3
src_tube_4 = SrcTube(P=tar_tube_3)  # -> i, item_1, item_2, item_3
merge_17 = Merge(Data1=flatten(pln_1_6), Data2=flatten(pln_2))
src_tube_5 = SrcTube(P=tar_tube_5)  # -> i, item_1, item_2, item_3
src_tube_6 = SrcTube(P=tar_tube_6)  # -> i, item_1, item_2, item_3
merge_18 = Merge(
    Data1=flatten(brep_tube_2_5),
    Data2=flatten(pt_1_6),
    Data3=flatten(pt_2_5),
    Data4=flatten(pt_3_3),
    Data5=flatten(pt_4_3),
    Data6=flatten(pln_1_6),
    Data7=flatten(pln_1_5),
    Data8=flatten(pln_2),
    Data9=flatten(pln_2_2))
merge_19 = Merge(
    Data1=flatten(brep_tube_2_4),
    Data2=flatten(pt_1_5),
    Data3=flatten(pt_2_4),
    Data4=flatten(pt_3_2),
    Data5=flatten(pt_4_2),
    Data6=flatten(pln_1_3),
    Data7=flatten(pln_1_4),
    Data8=flatten(pln_2_3),
    Data9=flatten(pln_2_4))
merge_20 = Merge(Data1=flatten(pln_1_3), Data2=flatten(pln_2_3))
tar_plug = TarPlug(pt_group_source=pt_group_2_2)
tar_plug_2 = TarPlug(pt_group_source=pt_group_1)
tar_tube_7 = TarTube(pt_tube_2=pt_tube_2_2)
src_plug = SrcPlug(pt_group_1=pt_group_1)  # -> P, P_2
brep_brick_3 = Brep(brep_brick)
brep_brick_4 = Brep(brep)
brep_brick_5 = Brep(brep_brick_2)
python_2 = GhPythonScript()  # -> out, breps, curves, points
# ---------- python_2: Python ----------
__author__ = "jason"
__version__ = "2020.02.27"

import Rhino
import Rhino.Geometry as rg

breps = []
curves = []
points = []

for rObj in Rhino.RhinoDoc.ActiveDoc.Objects:
    if(rObj.ObjectType == Rhino.DocObjects.ObjectType.Brep):
        breps.append(rObj.Geometry)
    elif(rObj.ObjectType == Rhino.DocObjects.ObjectType.Curve):
        curves.append(rObj.Geometry)
    elif(rObj.ObjectType == Rhino.DocObjects.ObjectType.Point):
        points.append(rObj.Geometry)
# ---------- end python_2 ----------
merge_21 = Merge(Data1=flatten(brep_brick_3), Data2=flatten(tar_tube_2), Data3=flatten(tar_tube))
merge_22 = Merge(
    Data1=flatten(src_tube_2.i),
    Data2=flatten(src_tube_2.item_1),
    Data3=flatten(src_tube_2.item_2),
    Data4=flatten(src_tube_2.item_3),
    Data5=flatten(src_tube.i),
    Data6=flatten(src_tube.item_1),
    Data7=flatten(src_tube.item_2),
    Data8=flatten(src_tube.item_3))
merge_23 = Merge(
    Data1=flatten("snap2_tube2_a"),
    Data2=flatten("snap2_tube2_a"),
    Data3=flatten("snap2_tube2_a"),
    Data4=flatten("snap2_tube2_a"),
    Data5=flatten("snap2_tube2_b"),
    Data6=flatten("snap2_tube2_b"),
    Data7=flatten("snap2_tube2_b"),
    Data8=flatten("snap2_tube2_b"))
merge_24 = Merge(Data1=flatten(brep_brick_4), Data2=flatten(tar_tube_3), Data3=flatten(tar_tube_4))
merge_25 = Merge(
    Data1=flatten(src_tube_4.i),
    Data2=flatten(src_tube_4.item_1),
    Data3=flatten(src_tube_4.item_2),
    Data4=flatten(src_tube_4.item_3),
    Data5=flatten(src_tube_3.i),
    Data6=flatten(src_tube_3.item_1),
    Data7=flatten(src_tube_3.item_2),
    Data8=flatten(src_tube_3.item_3))
merge_26 = Merge(
    Data1=flatten("snap3_tube1"),
    Data2=flatten("snap3_tube1"),
    Data3=flatten("snap3_tube1"),
    Data4=flatten("snap3_tube1"),
    Data5=flatten("snap3_tube2"),
    Data6=flatten("snap3_tube2"),
    Data7=flatten("snap3_tube2"),
    Data8=flatten("snap3_tube2"))
merge_27 = Merge(Data1=flatten(brep_brick_5), Data2=flatten(tar_tube_6), Data3=flatten(tar_tube_5))
merge_28 = Merge(
    Data1=flatten(src_tube_6.i),
    Data2=flatten(src_tube_6.item_1),
    Data3=flatten(src_tube_6.item_2),
    Data4=flatten(src_tube_6.item_3),
    Data5=flatten(src_tube_5.i),
    Data6=flatten(src_tube_5.item_1),
    Data7=flatten(src_tube_5.item_2),
    Data8=flatten(src_tube_5.item_3))
merge_29 = Merge(
    Data1=flatten("snap1_tube2_a"),
    Data2=flatten("snap1_tube2_a"),
    Data3=flatten("snap1_tube2_a"),
    Data4=flatten("snap1_tube2_a"),
    Data5=flatten("snap1_tube2_b"),
    Data6=flatten("snap1_tube2_b"),
    Data7=flatten("snap1_tube2_b"),
    Data8=flatten("snap1_tube2_b"))
src_tube_7 = SrcTube(P=tar_tube_7)  # -> i, item_1, item_2, item_3
python_3 = GhPythonScript(target_inputs=merge_15, source_planes=merge_16, source_tags=panel_2)  # -> out, a; inputs target_inputs: list, source_planes: list, source_tags: list
# ---------- python_3: Python ----------
__author__ = "jason"
__version__ = "2020.02.05"

import rhinoscriptsyntax as rs

inputs = [target_inputs, source_planes, source_tags]

a = inputs
# ---------- end python_3 ----------
python_4 = GhPythonScript(target_inputs=merge_18, source_planes=merge_17, source_tags=panel_3)  # -> out, a; inputs target_inputs: list, source_planes: list, source_tags: list; same code as python_3
python_5 = GhPythonScript(target_inputs=merge_19, source_planes=merge_20, source_tags=panel_4)  # -> out, a; inputs target_inputs: list, source_planes: list, source_tags: list; same code as python_3
tar_plug_3 = TarPlug(pt_group_source=pt_group_1a)
tar_plug_4 = TarPlug(pt_group_source=pt_group_1b)
tar_plug_5 = TarPlug(pt_group_source=pt_group_2)
tar_tube_8 = TarTube(pt_tube_2=pt_tube_1a)

# ----
# NIB
pt_37 = Point(<point referenced from the Rhino model>)
pt_38 = Point(<point referenced from the Rhino model>)
pt_39 = Point(<point referenced from the Rhino model>)
pt_40 = Point(<point referenced from the Rhino model>)
pt_41 = Point(<point referenced from the Rhino model>)
pt_42 = Point(<point referenced from the Rhino model>)
pt_43 = Point(<point referenced from the Rhino model>)
brep_nib_connector = Brep(<brep referenced from the Rhino model>)
merge_30 = Merge(Data1=pt_42, Data2=pt_43, Data3=pt_38)
merge_31 = Merge(Data1=pt_39, Data2=pt_40, Data3=pt_41, Data4=pt_37)
pt_nib = Point(<point referenced from the Rhino model>)

pln_source_tube_2_180_deg = Plane(src_tube_7.item_2)
pln_source_tube_2_270_deg = Plane(src_tube_7.item_3)
pln_source_plug_1_180_deg = Plane(src_plug.P_2)
pln_source_tube_2_90_deg = Plane(src_tube_7.item_1)
pln_source_tube_2_0_deg = Plane(src_tube_7.i)
pln_source_plug_1_0_deg = Plane(src_plug.P)
src_plug_2 = SrcPlug(pt_group_1=pt_group_1a)  # -> P, P_2
pln_target_tube_2 = Plane(tar_tube_7)
pln_target_plug_1 = Plane(tar_plug_2)
pln_target_plug_2 = Plane(tar_plug)
src_plug_3 = SrcPlug(pt_group_1=pt_group_1b)  # -> P, P_2
src_plug_4 = SrcPlug(pt_group_1=pt_group_2)  # -> P, P_2
brep_wedge_2 = Brep(brep_wedge)
data_inputs_2 = Data(python_3.a)
data_inputs_3 = Data(python_5.a)
data_inputs_4 = Data(python_4.a)
python_6 = GhPythonScript(target_inputs=merge_21, source_planes=merge_22, source_tags=merge_23)  # -> out, a; inputs target_inputs: list, source_planes: list, source_tags: list; same code as python_3
src_tube_8 = SrcTube(P=tar_tube_8)  # -> i, item_1, item_2, item_3
python_7 = GhPythonScript(target_inputs=merge_24, source_planes=merge_25, source_tags=merge_26)  # -> out, a; inputs target_inputs: list, source_planes: list, source_tags: list; same code as python_3
python_8 = GhPythonScript(target_inputs=merge_27, source_planes=merge_28, source_tags=merge_29)  # -> out, a; inputs target_inputs: list, source_planes: list, source_tags: list; same code as python_3

# ---- group: Nib only
src_plug_5 = SrcPlug_2(pt_group_1=merge_31)  # -> P, P_2

# ---- group: Nib Only
tar_tube_9 = TarTube_2(pt_tube_2=merge_30)  # -> P, P_2, P_3, P_5, P_6, P_4

# ----
pln_source_tube_1_180 = Plane(src_tube_8.item_2)
pln_source_tube_1_270 = Plane(src_tube_8.item_3)
pln_source_tube_1_90 = Plane(src_tube_8.item_1)
pln_source_plug_1a_180 = Plane(src_plug_2.P_2)
pln_source_plug_1b_180 = Plane(src_plug_3.P_2)
pln_source_tube_1_0 = Plane(src_tube_8.i)
pln_source_plug_2_180 = Plane(src_plug_4.P_2)
pln_source_plug_1a_0 = Plane(src_plug_2.P)
pln_source_plug_1b_0 = Plane(src_plug_3.P)
pln_target_plug_1a = Plane(tar_plug_3)
pln_target_plug_1b = Plane(tar_plug_4)
pln_source_plug_2_0 = Plane(src_plug_4.P)
pln_target_tube_1 = Plane(tar_tube_8)
pln_target_plug_2_2 = Plane(tar_plug_5)
brep_arc_2 = Brep(brep_arc)

# ---- group: Visualize Plane and Vector
cluster_5 = Cluster(pln=pln_target_plug_2)

cluster_6 = Cluster(pln=pln_target_plug_1)

# ----
data_inputs_5 = Data(python_6.a)
data_inputs_6 = Data(python_7.a)
data_inputs_7 = Data(python_8.a)

# ---- group: Visualize Plane and Vector
cluster_7 = Cluster(pln=pln_target_plug_2_2)

# ----
brep_nib_connector_2 = Brep(brep_nib_connector)
pln_source_plug_2 = Plane(tar_tube_9.P_5)
pln_source_plug_2_2 = Plane(tar_tube_9.P_6)
pln_source_plug_1 = Plane(src_plug_5.P_2)
pln_source_plug_2_3 = Plane(tar_tube_9.P_2)
pln_source_plug_1_2 = Plane(src_plug_5.P)
pln_source_plug_2_4 = Plane(tar_tube_9.P_3)
pln_source_plug_2_5 = Plane(tar_tube_9.P_4)
pln_source_plug_2_6 = Plane(tar_tube_9.P)
pt_nib_2 = Point(pt_nib)
merge_32 = Merge(
    Data1=flatten(pln_source_tube_2_0_deg),
    Data2=flatten(pln_source_tube_2_90_deg),
    Data3=flatten(pln_source_tube_2_180_deg),
    Data4=flatten(pln_source_tube_2_270_deg),
    Data5=flatten(pln_source_plug_1_0_deg),
    Data6=flatten(pln_source_plug_1_180_deg))  # -> flatten(Result)
merge_33 = Merge(
    Data1=flatten("wedge_tube2"),
    Data2=flatten("wedge_tube2"),
    Data3=flatten("wedge_tube2"),
    Data4=flatten("wedge_tube2"),
    Data5=flatten("wedge_plug1"),
    Data6=flatten("wedge_plug1"))  # -> flatten(Result)
merge_34 = Merge(
    Data1=flatten(brep_wedge_2),
    Data2=flatten(pln_target_plug_1),
    Data3=flatten(pln_target_plug_2),
    Data4=flatten(pln_target_tube_2))  # -> flatten(Result)
merge_35 = Merge(
    Data1=flatten("arc_tube1"),
    Data2=flatten("arc_tube1"),
    Data3=flatten("arc_tube1"),
    Data4=flatten("arc_tube1"),
    Data5=flatten("arc_plug1_a"),
    Data6=flatten("arc_plug1_a"),
    Data7=flatten("arc_plug1_b"),
    Data8=flatten("arc_plug1_b"),
    Data9=flatten("arc_plug2"),
    Data10=flatten("arc_plug2"))
merge_36 = Merge(Data1=flatten(brep_nib_connector_2), Data2=flatten(pt_nib_2))
merge_37 = Merge(
    Data1=flatten("nib_plug2_a"),
    Data2=flatten("nib_plug2_b"),
    Data3=flatten("nib_tube1_a"),
    Data4=flatten("nib_tube1_b"),
    Data5=flatten("nib_tube2_a"),
    Data6=flatten("nib_tube2_b"),
    Data7=flatten("nib_snap_a"),
    Data8=flatten("nib_snap_b"))
merge_38 = Merge(
    Data1=flatten(pln_source_plug_1_2),
    Data2=flatten(pln_source_plug_1),
    Data3=flatten(pln_source_plug_2_3),
    Data4=flatten(pln_source_plug_2_6),
    Data5=flatten(pln_source_plug_2),
    Data6=flatten(pln_source_plug_2_4),
    Data7=flatten(pln_source_plug_2_2),
    Data8=flatten(pln_source_plug_2_5))
merge_39 = Merge(
    Data1=flatten(pln_source_tube_1_0),
    Data2=flatten(pln_source_tube_1_90),
    Data3=flatten(pln_source_tube_1_180),
    Data4=flatten(pln_source_tube_1_270),
    Data5=flatten(pln_source_plug_1a_0),
    Data6=flatten(pln_source_plug_1a_180),
    Data7=flatten(pln_source_plug_1b_0),
    Data8=flatten(pln_source_plug_1b_180),
    Data9=flatten(pln_source_plug_2_0),
    Data10=flatten(pln_source_plug_2_180))
merge_40 = Merge(
    Data1=flatten(brep_arc_2),
    Data2=flatten(pln_target_plug_1a),
    Data3=flatten(pln_target_plug_1b),
    Data4=flatten(pln_target_plug_2_2),
    Data5=flatten(pln_target_tube_1))

# ---- group: Visualize Plane and Vector
cluster_8 = Cluster()

# ----
python_9 = GhPythonScript(target_inputs=merge_34, source_planes=merge_32, source_tags=merge_33)  # -> out, a; inputs target_inputs: list, source_planes: list, source_tags: list; same code as python_3
python_10 = GhPythonScript(target_inputs=merge_36, source_planes=merge_38, source_tags=merge_37)  # -> out, a; inputs target_inputs: list, source_planes: list, source_tags: list; same code as python_3
python_11 = GhPythonScript(target_inputs=merge_40, source_planes=merge_39, source_tags=merge_35)  # -> out, a; inputs target_inputs: list, source_planes: list, source_tags: list; same code as python_3
data_inputs_8 = Data(python_9.a)
data_inputs_9 = Data(python_10.a)
data_inputs_10 = Data(python_11.a)
panel_5 = Panel(data_inputs_8)
block_list = Panel("""Tube 1
Tube 2
Tube 3
Snap 1
Snap 2
Snap 3
Arc
Sliver
Wedge
Nib""")
number_slider = Slider(0, range=0..20)
list = ItemSelector(
    block_list,
    {"Tube 1", "Tube 2", "Tube 3", "Snap 1", "Snap 2", "Snap 3", "Arc", "Sliver", "Wedge", "Nib"}, selected="Tube 3")
list_2 = ItemSelector(
    block_list,
    {"Tube 1", "Tube 2", "Tube 3", "Snap 1", "Snap 2", "Snap 3", "Arc", "Sliver", "Wedge", "Nib"}, selected="Wedge")
list_3 = ItemSelector(
    block_list,
    {"Tube 1", "Tube 2", "Tube 3", "Snap 1", "Snap 2", "Snap 3", "Arc", "Sliver", "Wedge", "Nib"}, selected="Snap 1")
list_4 = ItemSelector(
    block_list,
    {"Tube 1", "Tube 2", "Tube 3", "Snap 1", "Snap 2", "Snap 3", "Arc", "Sliver", "Wedge", "Nib"}, selected="Nib")
list_5 = ItemSelector(
    block_list,
    {"Tube 1", "Tube 2", "Tube 3", "Snap 1", "Snap 2", "Snap 3", "Arc", "Sliver", "Wedge", "Nib"}, selected="Arc")
list_6 = ItemSelector(
    block_list,
    {"Tube 1", "Tube 2", "Tube 3", "Snap 1", "Snap 2", "Snap 3", "Arc", "Sliver", "Wedge", "Nib"}, selected="Tube 2")
list_7 = ItemSelector(
    block_list,
    {"Tube 1", "Tube 2", "Tube 3", "Snap 1", "Snap 2", "Snap 3", "Arc", "Sliver", "Wedge", "Nib"}, selected="Tube 3")
list_8 = ItemSelector(
    block_list,
    {"Tube 1", "Tube 2", "Tube 3", "Snap 1", "Snap 2", "Snap 3", "Arc", "Sliver", "Wedge", "Nib"}, selected="Tube 2")
list_9 = ItemSelector(
    block_list,
    {"Tube 1", "Tube 2", "Tube 3", "Snap 1", "Snap 2", "Snap 3", "Arc", "Sliver", "Wedge", "Nib"}, selected="Nib")
list_10 = ItemSelector(
    block_list,
    {"Tube 1", "Tube 2", "Tube 3", "Snap 1", "Snap 2", "Snap 3", "Arc", "Sliver", "Wedge", "Nib"}, selected="Wedge")
list_11 = ItemSelector(
    block_list,
    {"Tube 1", "Tube 2", "Tube 3", "Snap 1", "Snap 2", "Snap 3", "Arc", "Sliver", "Wedge", "Nib"}, selected="Tube 1")
list_12 = ItemSelector(
    block_list,
    {"Tube 1", "Tube 2", "Tube 3", "Snap 1", "Snap 2", "Snap 3", "Arc", "Sliver", "Wedge", "Nib"}, selected="Snap 3")
list_13 = ItemSelector(
    block_list,
    {"Tube 1", "Tube 2", "Tube 3", "Snap 1", "Snap 2", "Snap 3", "Arc", "Sliver", "Wedge", "Nib"}, selected="Nib")
list_14 = ItemSelector(
    block_list,
    {"Tube 1", "Tube 2", "Tube 3", "Snap 1", "Snap 2", "Snap 3", "Arc", "Sliver", "Wedge", "Nib"}, selected="Tube 2")
list_15 = ItemSelector(
    block_list,
    {"Tube 1", "Tube 2", "Tube 3", "Snap 1", "Snap 2", "Snap 3", "Arc", "Sliver", "Wedge", "Nib"}, selected="Wedge")
list_16 = ItemSelector(
    block_list,
    {"Tube 1", "Tube 2", "Tube 3", "Snap 1", "Snap 2", "Snap 3", "Arc", "Sliver", "Wedge", "Nib"}, selected="Tube 2")
list_17 = ItemSelector(
    block_list,
    {"Tube 1", "Tube 2", "Tube 3", "Snap 1", "Snap 2", "Snap 3", "Arc", "Sliver", "Wedge", "Nib"}, selected="Arc")
list_18 = ItemSelector(
    block_list,
    {"Tube 1", "Tube 2", "Tube 3", "Snap 1", "Snap 2", "Snap 3", "Arc", "Sliver", "Wedge", "Nib"}, selected="Tube 1")
merge_41 = Merge(
    Data1=list,
    Data2=list_2,
    Data3=list_5,
    Data4=list_11,
    Data5=list_14,
    Data6=list_12,
    Data7=list_6,
    Data8=list_10,
    Data9=list_7,
    Data10=list_3,
    Data11=list_16,
    Data12=list_15,
    Data13=list_17,
    Data14=list_18,
    Data15=list_8,
    Data16=list_9,
    Data17=list_13,
    Data18=list_4)
merge_42 = Merge(
    Data1=Slider(0, range=0..20),
    Data2=Slider(0, range=0..20),
    Data3=Slider(4, range=0..20),
    Data4=Slider(0, range=0..20),
    Data5=Slider(0, range=0..20),
    Data6=Slider(7, range=0..20),
    Data7=Slider(1, range=0..20),
    Data8=Slider(8, range=0..20),
    Data9=Slider(0, range=0..20),
    Data10=Slider(9, range=0..20),
    Data11=Slider(0, range=0..20),
    Data12=Slider(9, range=0..20),
    Data13=Slider(14, range=0..20),
    Data14=Slider(1, range=0..20),
    Data15=Slider(1, range=0..20),
    Data16=Slider(5, range=0..20),
    Data17=Slider(7, range=0..20),
    Data18=Slider(15, range=0..20))

list_19 = ValueList({"Tube 1", "Tube 2", "Tube 3", "Snap 1", "Snap 2", "Snap 3", "Arc", "Sliver", "Wedge", "Nib"}, selected="Arc")
list_20 = ValueList({"Tube 1", "Tube 2", "Tube 3", "Snap 1", "Snap 2", "Snap 3", "Arc", "Sliver", "Wedge", "Nib"}, selected="Arc")
list_21 = ValueList({"Tube 1", "Tube 2", "Tube 3", "Snap 1", "Snap 2", "Snap 3", "Arc", "Sliver", "Wedge", "Nib"}, selected="Tube 1")
list_22 = ValueList({"Tube 1", "Tube 2", "Tube 3", "Snap 1", "Snap 2", "Snap 3", "Arc", "Sliver", "Wedge", "Nib"}, selected="Snap 3")
list_23 = ValueList({"Tube 1", "Tube 2", "Tube 3", "Snap 1", "Snap 2", "Snap 3", "Arc", "Sliver", "Wedge", "Nib"}, selected="Tube 2")
list_24 = ValueList({"Tube 1", "Tube 2", "Tube 3", "Snap 1", "Snap 2", "Snap 3", "Arc", "Sliver", "Wedge", "Nib"}, selected="Nib")
list_25 = ValueList({"Tube 1", "Tube 2", "Tube 3", "Snap 1", "Snap 2", "Snap 3", "Arc", "Sliver", "Wedge", "Nib"}, selected="Arc")
list_26 = ValueList({"Tube 1", "Tube 2", "Tube 3", "Snap 1", "Snap 2", "Snap 3", "Arc", "Sliver", "Wedge", "Nib"}, selected="Tube 1")
list_27 = ValueList({"Tube 1", "Tube 2", "Tube 3", "Snap 1", "Snap 2", "Snap 3", "Arc", "Sliver", "Wedge", "Nib"}, selected="Snap 3")
list_28 = ValueList({"Tube 1", "Tube 2", "Tube 3", "Snap 1", "Snap 2", "Snap 3", "Arc", "Sliver", "Wedge", "Nib"}, selected="Tube 2")
list_29 = ValueList({"Tube 1", "Tube 2", "Tube 3", "Snap 1", "Snap 2", "Snap 3", "Arc", "Sliver", "Wedge", "Nib"}, selected="Nib")
merge_43 = Merge(
    Data1=list_19,
    Data2=list_20,
    Data3=list_21,
    Data4=list_22,
    Data5=list_23,
    Data6=list_24,
    Data7=list_25,
    Data8=list_26,
    Data9=list_27,
    Data10=list_28,
    Data11=list_29)
merge_44 = Merge(
    Data1=Slider(0, range=0..20),
    Data2=Slider(0, range=0..20),
    Data3=Slider(0, range=0..20),
    Data4=Slider(0, range=0..20),
    Data5=Slider(3, range=0..20),
    Data6=Slider(8, range=0..20),
    Data7=Slider(0, range=0..20),
    Data8=Slider(1, range=0..20),
    Data9=Slider(4, range=0..20),
    Data10=Slider(6, range=0..20),
    Data11=Slider(12, range=0..20))
selection_list = Data(merge_44)
crv = Curve(flatten([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]))
block_list_2 = Data(merge_43)

list_30 = ValueList({"Tube 1", "Tube 2", "Tube 3", "Snap 1", "Snap 2", "Snap 3", "Arc", "Sliver", "Wedge", "Nib"}, selected="Tube 2")
list_31 = ValueList({"Tube 1", "Tube 2", "Tube 3", "Snap 1", "Snap 2", "Snap 3", "Arc", "Sliver", "Wedge", "Nib"}, selected="Wedge")
list_32 = ValueList({"Tube 1", "Tube 2", "Tube 3", "Snap 1", "Snap 2", "Snap 3", "Arc", "Sliver", "Wedge", "Nib"}, selected="Arc")
list_33 = ValueList({"Tube 1", "Tube 2", "Tube 3", "Snap 1", "Snap 2", "Snap 3", "Arc", "Sliver", "Wedge", "Nib"}, selected="Tube 1")
list_34 = ValueList({"Tube 1", "Tube 2", "Tube 3", "Snap 1", "Snap 2", "Snap 3", "Arc", "Sliver", "Wedge", "Nib"}, selected="Tube 3")
list_35 = ValueList({"Tube 1", "Tube 2", "Tube 3", "Snap 1", "Snap 2", "Snap 3", "Arc", "Sliver", "Wedge", "Nib"}, selected="Snap 2")
list_36 = ValueList({"Tube 1", "Tube 2", "Tube 3", "Snap 1", "Snap 2", "Snap 3", "Arc", "Sliver", "Wedge", "Nib"}, selected="Tube 3")
list_37 = ValueList({"Tube 1", "Tube 2", "Tube 3", "Snap 1", "Snap 2", "Snap 3", "Arc", "Sliver", "Wedge", "Nib"}, selected="Tube 2")
list_38 = ValueList({"Tube 1", "Tube 2", "Tube 3", "Snap 1", "Snap 2", "Snap 3", "Arc", "Sliver", "Wedge", "Nib"}, selected="Snap 2")
list_39 = ValueList({"Tube 1", "Tube 2", "Tube 3", "Snap 1", "Snap 2", "Snap 3", "Arc", "Sliver", "Wedge", "Nib"}, selected="Tube 2")
list_40 = ValueList({"Tube 1", "Tube 2", "Tube 3", "Snap 1", "Snap 2", "Snap 3", "Arc", "Sliver", "Wedge", "Nib"}, selected="Nib")
list_41 = ValueList({"Tube 1", "Tube 2", "Tube 3", "Snap 1", "Snap 2", "Snap 3", "Arc", "Sliver", "Wedge", "Nib"}, selected="Nib")
merge_45 = Merge(
    Data1=list_30,
    Data2=list_31,
    Data3=list_32,
    Data4=list_33,
    Data5=list_34,
    Data6=list_35,
    Data7=list_36,
    Data8=list_37,
    Data9=list_38,
    Data10=list_39,
    Data11=list_40,
    Data12=list_41)
merge_46 = Merge(
    Data1=Slider(0, range=0..20),
    Data2=Slider(0, range=0..20),
    Data3=Slider(4, range=0..20),
    Data4=Slider(0, range=0..20),
    Data5=Slider(0, range=0..20),
    Data6=Slider(0, range=0..20),
    Data7=Slider(0, range=0..20),
    Data8=Slider(1, range=0..20),
    Data9=Slider(0, range=0..20),
    Data10=Slider(0, range=0..20),
    Data11=Slider(7, range=0..20),
    Data12=Slider(9, range=0..20),
    Data13=Slider(0, range=0..20),
    Data14=Slider(0, range=0..20),
    Data15=Slider(0, range=0..20))
crv_2 = Curve(flatten([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]))
selection_list_2 = Data(merge_46)
block_list_3 = Data(merge_45)

number_slider_2 = Slider(0, range=0..20)
number_slider_3 = Slider(0, range=0..20)
list_42 = ValueList({"Tube 1", "Tube 2", "Tube 3", "Snap 1", "Snap 2", "Snap 3", "Arc", "Sliver", "Wedge", "Nib"}, selected="Wedge")
list_43 = ValueList({"Tube 1", "Tube 2", "Tube 3", "Snap 1", "Snap 2", "Snap 3", "Arc", "Sliver", "Wedge", "Nib"}, selected="Tube 1")
list_44 = ValueList({"Tube 1", "Tube 2", "Tube 3", "Snap 1", "Snap 2", "Snap 3", "Arc", "Sliver", "Wedge", "Nib"}, selected="Tube 2")
list_45 = ValueList({"Tube 1", "Tube 2", "Tube 3", "Snap 1", "Snap 2", "Snap 3", "Arc", "Sliver", "Wedge", "Nib"}, selected="Snap 3")
list_46 = ValueList({"Tube 1", "Tube 2", "Tube 3", "Snap 1", "Snap 2", "Snap 3", "Arc", "Sliver", "Wedge", "Nib"}, selected="Tube 2")
list_47 = ValueList({"Tube 1", "Tube 2", "Tube 3", "Snap 1", "Snap 2", "Snap 3", "Arc", "Sliver", "Wedge", "Nib"}, selected="Tube 2")
list_48 = ValueList({"Tube 1", "Tube 2", "Tube 3", "Snap 1", "Snap 2", "Snap 3", "Arc", "Sliver", "Wedge", "Nib"}, selected="Snap 2")
list_49 = ValueList({"Tube 1", "Tube 2", "Tube 3", "Snap 1", "Snap 2", "Snap 3", "Arc", "Sliver", "Wedge", "Nib"}, selected="Tube 2")
list_50 = ValueList({"Tube 1", "Tube 2", "Tube 3", "Snap 1", "Snap 2", "Snap 3", "Arc", "Sliver", "Wedge", "Nib"}, selected="Nib")
list_51 = ValueList({"Tube 1", "Tube 2", "Tube 3", "Snap 1", "Snap 2", "Snap 3", "Arc", "Sliver", "Wedge", "Nib"}, selected="Nib")
list_52 = ValueList({"Tube 1", "Tube 2", "Tube 3", "Snap 1", "Snap 2", "Snap 3", "Arc", "Sliver", "Wedge", "Nib"}, selected="Tube 2")
list_53 = ValueList({"Tube 1", "Tube 2", "Tube 3", "Snap 1", "Snap 2", "Snap 3", "Arc", "Sliver", "Wedge", "Nib"}, selected="Tube 2")
list_54 = ValueList({"Tube 1", "Tube 2", "Tube 3", "Snap 1", "Snap 2", "Snap 3", "Arc", "Sliver", "Wedge", "Nib"}, selected="Nib")
list_55 = ValueList({"Tube 1", "Tube 2", "Tube 3", "Snap 1", "Snap 2", "Snap 3", "Arc", "Sliver", "Wedge", "Nib"}, selected="Arc")
list_56 = ValueList({"Tube 1", "Tube 2", "Tube 3", "Snap 1", "Snap 2", "Snap 3", "Arc", "Sliver", "Wedge", "Nib"}, selected="Snap 2")
merge_47 = Merge(
    Data1=list_44,
    Data2=list_42,
    Data3=list_55,
    Data4=list_43,
    Data5=list_45,
    Data6=list_47,
    Data7=list_46,
    Data8=list_48,
    Data9=list_49,
    Data10=list_50,
    Data11=list_51,
    Data12=list_52,
    Data13=list_56,
    Data14=list_53,
    Data15=list_54)
merge_48 = Merge(
    Data1=Slider(0, range=0..20),
    Data2=Slider(0, range=0..20),
    Data3=Slider(4, range=0..20),
    Data4=Slider(0, range=0..20),
    Data5=Slider(5, range=0..20),
    Data6=Slider(2, range=0..20),
    Data7=Slider(0, range=0..20),
    Data8=Slider(11, range=0..20),
    Data9=Slider(2, range=0..20),
    Data10=Slider(7, range=0..20),
    Data11=Slider(8, range=0..20),
    Data12=Slider(0, range=0..20),
    Data13=Slider(18, range=0..20),
    Data14=Slider(0, range=0..20),
    Data15=Slider(10, range=0..20))
selection_list_3 = Data(merge_48)
crv_3 = Curve(flatten([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]))
block_list_4 = Data(merge_47)

list_57 = ValueList({"Tube 1", "Tube 2", "Tube 3", "Snap 1", "Snap 2", "Snap 3", "Arc", "Sliver", "Wedge", "Nib"}, selected="Tube 1")
list_58 = ValueList({"Tube 1", "Tube 2", "Tube 3", "Snap 1", "Snap 2", "Snap 3", "Arc", "Sliver", "Wedge", "Nib"}, selected="Snap 2")
list_59 = ValueList({"Tube 1", "Tube 2", "Tube 3", "Snap 1", "Snap 2", "Snap 3", "Arc", "Sliver", "Wedge", "Nib"}, selected="Tube 1")
list_60 = ValueList({"Tube 1", "Tube 2", "Tube 3", "Snap 1", "Snap 2", "Snap 3", "Arc", "Sliver", "Wedge", "Nib"}, selected="Tube 2")
list_61 = ValueList({"Tube 1", "Tube 2", "Tube 3", "Snap 1", "Snap 2", "Snap 3", "Arc", "Sliver", "Wedge", "Nib"}, selected="Tube 3")
list_62 = ValueList({"Tube 1", "Tube 2", "Tube 3", "Snap 1", "Snap 2", "Snap 3", "Arc", "Sliver", "Wedge", "Nib"}, selected="Tube 3")
list_63 = ValueList({"Tube 1", "Tube 2", "Tube 3", "Snap 1", "Snap 2", "Snap 3", "Arc", "Sliver", "Wedge", "Nib"}, selected="Tube 2")
list_64 = ValueList({"Tube 1", "Tube 2", "Tube 3", "Snap 1", "Snap 2", "Snap 3", "Arc", "Sliver", "Wedge", "Nib"}, selected="Nib")
merge_49 = Merge(Data1=list_61, Data2=list_58, Data3=list_63, Data4=list_57, Data5=list_62, Data6=list_59, Data7=list_60, Data8=list_64)
merge_50 = Merge(
    Data1=Slider(0, range=0..20),
    Data2=Slider(0, range=0..20),
    Data3=Slider(1, range=0..20),
    Data4=Slider(0, range=0..20),
    Data5=Slider(0, range=0..20),
    Data6=Slider(0, range=0..20),
    Data7=Slider(0, range=0..20),
    Data8=Slider(2, range=0..20))
selection_list_4 = Data(merge_50)
crv_4 = Curve(flatten(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))
block_list_5 = Data(merge_49)

list_65 = ValueList({"Tube 1", "Tube 2", "Tube 3", "Snap 1", "Snap 2", "Snap 3", "Arc", "Sliver", "Wedge", "Nib"}, selected="Tube 3")
list_66 = ValueList({"Tube 1", "Tube 2", "Tube 3", "Snap 1", "Snap 2", "Snap 3", "Arc", "Sliver", "Wedge", "Nib"}, selected="Tube 1")
list_67 = ValueList({"Tube 1", "Tube 2", "Tube 3", "Snap 1", "Snap 2", "Snap 3", "Arc", "Sliver", "Wedge", "Nib"}, selected="Tube 3")
list_68 = ValueList({"Tube 1", "Tube 2", "Tube 3", "Snap 1", "Snap 2", "Snap 3", "Arc", "Sliver", "Wedge", "Nib"}, selected="Tube 1")
list_69 = ValueList({"Tube 1", "Tube 2", "Tube 3", "Snap 1", "Snap 2", "Snap 3", "Arc", "Sliver", "Wedge", "Nib"}, selected="Tube 3")
list_70 = ValueList({"Tube 1", "Tube 2", "Tube 3", "Snap 1", "Snap 2", "Snap 3", "Arc", "Sliver", "Wedge", "Nib"}, selected="Nib")
merge_51 = Merge(Data1=list_65, Data2=list_66, Data3=list_67, Data4=list_68, Data5=list_69, Data6=list_70)
merge_52 = Merge(
    Data1=Slider(0, range=0..20),
    Data2=Slider(0, range=0..20),
    Data3=Slider(0, range=0..20),
    Data4=Slider(0, range=0..20),
    Data5=Slider(0, range=0..20),
    Data6=Slider(0, range=0..20),
    Data7=Slider(0, range=0..20))
selection_list_5 = Data(merge_52)
crv_5 = Curve(flatten(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))
block_list_6 = Data(merge_51)

list_71 = ValueList({"Tube 1", "Tube 2", "Tube 3", "Snap 1", "Snap 2", "Snap 3", "Arc", "Sliver", "Wedge", "Nib"}, selected="Tube 3")
list_72 = ValueList({"Tube 1", "Tube 2", "Tube 3", "Snap 1", "Snap 2", "Snap 3", "Arc", "Sliver", "Wedge", "Nib"}, selected="Wedge")
list_73 = ValueList({"Tube 1", "Tube 2", "Tube 3", "Snap 1", "Snap 2", "Snap 3", "Arc", "Sliver", "Wedge", "Nib"}, selected="Wedge")
list_74 = ValueList({"Tube 1", "Tube 2", "Tube 3", "Snap 1", "Snap 2", "Snap 3", "Arc", "Sliver", "Wedge", "Nib"}, selected="Tube 2")
list_75 = ValueList({"Tube 1", "Tube 2", "Tube 3", "Snap 1", "Snap 2", "Snap 3", "Arc", "Sliver", "Wedge", "Nib"}, selected="Snap 2")
list_76 = ValueList({"Tube 1", "Tube 2", "Tube 3", "Snap 1", "Snap 2", "Snap 3", "Arc", "Sliver", "Wedge", "Nib"}, selected="Tube 2")
list_77 = ValueList({"Tube 1", "Tube 2", "Tube 3", "Snap 1", "Snap 2", "Snap 3", "Arc", "Sliver", "Wedge", "Nib"}, selected="Nib")
merge_53 = Merge(Data1=list_71, Data2=list_72, Data3=list_73, Data4=list_74, Data5=list_75, Data6=list_76, Data7=list_77)
merge_54 = Merge(
    Data1=Slider(0, range=0..20),
    Data2=Slider(0, range=0..20),
    Data3=Slider(0, range=0..20),
    Data4=Slider(1, range=0..20),
    Data5=Slider(0, range=0..20),
    Data6=Slider(0, range=0..20),
    Data7=Slider(8, range=0..20))
selection_list_6 = Data(merge_54)
crv_6 = Curve(flatten(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))
block_list_7 = Data(merge_53)

list_78 = ValueList({"Tube 1", "Tube 2", "Tube 3", "Snap 1", "Snap 2", "Snap 3", "Arc", "Sliver", "Wedge", "Nib"}, selected="Arc")
list_79 = ValueList({"Tube 1", "Tube 2", "Tube 3", "Snap 1", "Snap 2", "Snap 3", "Arc", "Sliver", "Wedge", "Nib"}, selected="Wedge")
list_80 = ValueList({"Tube 1", "Tube 2", "Tube 3", "Snap 1", "Snap 2", "Snap 3", "Arc", "Sliver", "Wedge", "Nib"}, selected="Wedge")
list_81 = ValueList({"Tube 1", "Tube 2", "Tube 3", "Snap 1", "Snap 2", "Snap 3", "Arc", "Sliver", "Wedge", "Nib"}, selected="Tube 2")
list_82 = ValueList({"Tube 1", "Tube 2", "Tube 3", "Snap 1", "Snap 2", "Snap 3", "Arc", "Sliver", "Wedge", "Nib"}, selected="Tube 3")
list_83 = ValueList({"Tube 1", "Tube 2", "Tube 3", "Snap 1", "Snap 2", "Snap 3", "Arc", "Sliver", "Wedge", "Nib"}, selected="Tube 1")
list_84 = ValueList({"Tube 1", "Tube 2", "Tube 3", "Snap 1", "Snap 2", "Snap 3", "Arc", "Sliver", "Wedge", "Nib"}, selected="Snap 2")
list_85 = ValueList({"Tube 1", "Tube 2", "Tube 3", "Snap 1", "Snap 2", "Snap 3", "Arc", "Sliver", "Wedge", "Nib"}, selected="Tube 2")
list_86 = ValueList({"Tube 1", "Tube 2", "Tube 3", "Snap 1", "Snap 2", "Snap 3", "Arc", "Sliver", "Wedge", "Nib"}, selected="Tube 2")
list_87 = ValueList({"Tube 1", "Tube 2", "Tube 3", "Snap 1", "Snap 2", "Snap 3", "Arc", "Sliver", "Wedge", "Nib"}, selected="Tube 1")
list_88 = ValueList({"Tube 1", "Tube 2", "Tube 3", "Snap 1", "Snap 2", "Snap 3", "Arc", "Sliver", "Wedge", "Nib"}, selected="Nib")
list_89 = ValueList({"Tube 1", "Tube 2", "Tube 3", "Snap 1", "Snap 2", "Snap 3", "Arc", "Sliver", "Wedge", "Nib"}, selected="Nib")
merge_55 = Merge(
    Data1=list_78,
    Data2=list_79,
    Data3=list_80,
    Data4=list_81,
    Data5=list_82,
    Data6=list_83,
    Data7=list_84,
    Data8=list_85,
    Data9=list_86,
    Data10=list_87,
    Data11=list_88,
    Data12=list_89)
merge_56 = Merge(
    Data1=Slider(0, range=0..20),
    Data2=Slider(0, range=0..20),
    Data3=Slider(0, range=0..20),
    Data4=Slider(2, range=0..20),
    Data5=Slider(2, range=0..20),
    Data6=Slider(1, range=0..20),
    Data7=Slider(0, range=0..20),
    Data8=Slider(0, range=0..20),
    Data9=Slider(2, range=0..20),
    Data10=Slider(1, range=0..20),
    Data11=Slider(9, range=0..20),
    Data12=Slider(11, range=0..20))
selection_list_7 = Data(merge_56)
crv_7 = Curve(flatten([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]))
block_list_8 = Data(merge_55)

item = ListItem(List=crv, Index=0, Wrap=True)
item_2 = ListItem(List=crv_3, Index=Slider(0, range=0..2), Wrap=True)
item_3 = ListItem(List=crv_3, Index=Slider(2, range=0..2), Wrap=True)

# ---- group: 1 arm, 2 hands (200502 promo video)
list_90 = ValueList({"Tube 1", "Tube 2", "Tube 3", "Snap 1", "Snap 2", "Snap 3", "Arc", "Sliver", "Wedge", "Nib"}, selected="Wedge")
list_91 = ValueList({"Tube 1", "Tube 2", "Tube 3", "Snap 1", "Snap 2", "Snap 3", "Arc", "Sliver", "Wedge", "Nib"}, selected="Tube 1")
list_92 = ValueList({"Tube 1", "Tube 2", "Tube 3", "Snap 1", "Snap 2", "Snap 3", "Arc", "Sliver", "Wedge", "Nib"}, selected="Tube 2")
list_93 = ValueList({"Tube 1", "Tube 2", "Tube 3", "Snap 1", "Snap 2", "Snap 3", "Arc", "Sliver", "Wedge", "Nib"}, selected="Snap 3")
list_94 = ValueList({"Tube 1", "Tube 2", "Tube 3", "Snap 1", "Snap 2", "Snap 3", "Arc", "Sliver", "Wedge", "Nib"}, selected="Tube 2")
list_95 = ValueList({"Tube 1", "Tube 2", "Tube 3", "Snap 1", "Snap 2", "Snap 3", "Arc", "Sliver", "Wedge", "Nib"}, selected="Tube 2")
list_96 = ValueList({"Tube 1", "Tube 2", "Tube 3", "Snap 1", "Snap 2", "Snap 3", "Arc", "Sliver", "Wedge", "Nib"}, selected="Snap 2")
list_97 = ValueList({"Tube 1", "Tube 2", "Tube 3", "Snap 1", "Snap 2", "Snap 3", "Arc", "Sliver", "Wedge", "Nib"}, selected="Tube 2")
list_98 = ValueList({"Tube 1", "Tube 2", "Tube 3", "Snap 1", "Snap 2", "Snap 3", "Arc", "Sliver", "Wedge", "Nib"}, selected="Nib")
list_99 = ValueList({"Tube 1", "Tube 2", "Tube 3", "Snap 1", "Snap 2", "Snap 3", "Arc", "Sliver", "Wedge", "Nib"}, selected="Nib")
list_100 = ValueList({"Tube 1", "Tube 2", "Tube 3", "Snap 1", "Snap 2", "Snap 3", "Arc", "Sliver", "Wedge", "Nib"}, selected="Arc")
merge_57 = Merge(
    Data1=Slider(0, range=0..20),
    Data2=Slider(0, range=0..20),
    Data3=Slider(4, range=0..20),
    Data4=Slider(0, range=0..20),
    Data5=Slider(5, range=0..20),
    Data6=Slider(2, range=0..20),
    Data7=Slider(1, range=0..20),
    Data8=Slider(11, range=0..20),
    Data9=Slider(2, range=0..20),
    Data10=Slider(7, range=0..20),
    Data11=Slider(8, range=0..20))
merge_58 = Merge(
    Data1=list_92,
    Data2=list_90,
    Data3=list_100,
    Data4=list_91,
    Data5=list_93,
    Data6=list_95,
    Data7=list_94,
    Data8=list_96,
    Data9=list_97,
    Data10=list_98,
    Data11=list_99)
selection_list_8 = Data(merge_57)
crv_8 = Curve(flatten([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]))
block_list_9 = Data(merge_58)

# ----
item_4 = ListItem(List=crv_8, Index=Slider(0, range=0..2), Wrap=True)
item_5 = ListItem(List=crv_8, Index=Slider(2, range=0..2), Wrap=True)
series = Series(Start=0, Step=1, Count=Slider(60, range=0..100))
number_slider_4 = Slider(5, range=0..20)  # disabled
number_slider_5 = Slider(7, range=0..20)  # disabled
number_slider_6 = Slider(7, range=0..20)  # disabled
number_slider_7 = Slider(7, range=0..20)  # disabled
number_slider_8 = Slider(11, range=0..20)  # disabled
number_slider_9 = Slider(5, range=0..20)  # disabled
number_slider_10 = Slider(6, range=0..20)  # disabled
list_101 = ValueList({"Tube 1", "Tube 2", "Tube 3", "Snap 1", "Snap 2", "Snap 3", "Arc", "Wedge", "Nib"}, selected="Arc")  # disabled
bnd = Bounds(Numbers=series)
panel_6 = Panel(series)
remap = RemapNumbers(Value=series, Source=bnd, Target=Domain(0, 1))  # -> Mapped, Clipped
merge_59 = Merge(Data1=list_101, Data2=list_101, Data3=list_101, Data4=list_101, Data5=list_101, Data6=list_101, Data7=list_101)  # disabled
merge_60 = Merge(
    Data1=number_slider_4,
    Data2=number_slider_5,
    Data3=number_slider_6,
    Data4=number_slider_7,
    Data5=number_slider_8,
    Data6=number_slider_9,
    Data7=number_slider_10)  # disabled
graph = GraphMapper(remap.Mapped, x0=0, x1=1, y0=0, y1=1, Cx=0.6546242237, Cy=0.3309714794, container_name="Conic")

number_slider_11 = Slider(357, range=0..720)  # disabled
toggle = BooleanToggle(False)  # disabled
num_rotation = Number(number_slider_11)  # disabled

repeat = RepeatData(Data=1, Length=Slider(3568, range=3550..3600))
rev = ReverseList(List=graph)
number_slider_12 = Slider(359, range=0..720)  # disabled
number_slider_13 = Slider(5, range=0..20)  # disabled
number_slider_14 = Slider(13, range=0..20)  # disabled
number_slider_15 = Slider(6, range=0..20)  # disabled
number_slider_16 = Slider(1, range=0..20)  # disabled
number_slider_17 = Slider(11, range=0..20)  # disabled
number_slider_18 = Slider(5, range=0..20)  # disabled
number_slider_19 = Slider(10, range=0..20)  # disabled
list_102 = ValueList({"Tube 1", "Tube 2", "Tube 3", "Snap 1", "Snap 2", "Snap 3", "Arc", "Wedge", "Nib"}, selected="Arc")  # disabled
list_103 = ValueList({"Tube 1", "Tube 2", "Tube 3", "Snap 1", "Snap 2", "Snap 3", "Arc", "Wedge", "Nib"}, selected="Arc")  # disabled
pt_44 = Point(<point referenced from the Rhino model>)  # disabled
merge_61 = Merge(Data1=flatten(graph), Data2=flatten(repeat), Data3=flatten(rev))
crv_9 = Curve(<curve referenced from the Rhino model>)  # disabled
crv_10 = Curve(<curve referenced from the Rhino model>)  # disabled
crv_11 = Curve(<curve referenced from the Rhino model>)  # disabled
crv_12 = Curve(<curve referenced from the Rhino model>)  # disabled
crv_guide = Curve(<curve referenced from the Rhino model>)  # disabled
merge_62 = Merge(Data1=list_102, Data2=list_102, Data3=list_102, Data4=list_102, Data5=list_102, Data6=list_102, Data7=list_102)  # disabled
merge_63 = Merge(
    Data1=number_slider_13,
    Data2=number_slider_14,
    Data3=number_slider_15,
    Data4=number_slider_16,
    Data5=number_slider_17,
    Data6=number_slider_18,
    Data7=number_slider_19)  # disabled
crv_axis_2 = Curve(<curve referenced from the Rhino model>)  # disabled
brep_2 = Brep(<brep referenced from the Rhino model>)  # disabled
ma = MassAddition(Input=merge_61)  # -> Result, PartialResults
panel_7 = Panel(ma.PartialResults)
crv_guide_2 = Curve(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)  # disabled
pt_45 = Point(Point(845.9106769, 289.2226204, 0))  # disabled
rotate = Rotate(Geometry=crv_guide, Angle=degrees(number_slider_12), Plane=pt_44)  # -> Geometry, Transform; disabled
rotate_2 = Rotate(Geometry=brep_2, Angle=degrees(number_slider_12), Plane=pt_44)  # -> Geometry, Transform; disabled
rotate_3 = Rotate(Geometry=crv_axis_2, Angle=degrees(number_slider_12), Plane=pt_44)  # -> Geometry, Transform; disabled
crv_13 = Curve(<curve referenced from the Rhino model>)  # disabled
crv_14 = Curve(<curve referenced from the Rhino model>)  # disabled
number_slider_20 = Slider(10, range=0..10)  # disabled
number_slider_21 = Slider(4, range=0..20)
list_104 = ValueList({"Tube 1", "Tube 2", "Tube 3", "Snap 1", "Snap 2", "Snap 3", "Arc", "Sliver", "Wedge", "Nib"}, selected="Snap 3")
list_105 = ValueList({"Tube 1", "Tube 2", "Tube 3", "Snap 1", "Snap 2", "Snap 3", "Arc", "Sliver", "Wedge", "Nib"}, selected="Tube 1")
list_106 = ValueList({"Tube 1", "Tube 2", "Tube 3", "Snap 1", "Snap 2", "Snap 3", "Arc", "Sliver", "Wedge", "Nib"}, selected="Tube 2")
list_107 = ValueList({"Tube 1", "Tube 2", "Tube 3", "Snap 1", "Snap 2", "Snap 3", "Arc", "Sliver", "Wedge", "Nib"}, selected="Snap 3")
list_108 = ValueList({"Tube 1", "Tube 2", "Tube 3", "Snap 1", "Snap 2", "Snap 3", "Arc", "Sliver", "Wedge", "Nib"}, selected="Tube 2")
list_109 = ValueList({"Tube 1", "Tube 2", "Tube 3", "Snap 1", "Snap 2", "Snap 3", "Arc", "Sliver", "Wedge", "Nib"}, selected="Tube 2")
list_110 = ValueList({"Tube 1", "Tube 2", "Tube 3", "Snap 1", "Snap 2", "Snap 3", "Arc", "Sliver", "Wedge", "Nib"}, selected="Snap 2")
list_111 = ValueList({"Tube 1", "Tube 2", "Tube 3", "Snap 1", "Snap 2", "Snap 3", "Arc", "Sliver", "Wedge", "Nib"}, selected="Tube 2")
list_112 = ValueList({"Tube 1", "Tube 2", "Tube 3", "Snap 1", "Snap 2", "Snap 3", "Arc", "Sliver", "Wedge", "Nib"}, selected="Nib")
list_113 = ValueList({"Tube 1", "Tube 2", "Tube 3", "Snap 1", "Snap 2", "Snap 3", "Arc", "Sliver", "Wedge", "Nib"}, selected="Nib")
selection_list_9 = Data(merge_63)  # disabled
block_list_10 = Data(merge_62)  # disabled
crv_15 = Curve([<curve referenced from the Rhino model> x3])  # disabled
crv_16 = Curve([<curve referenced from the Rhino model> x9])  # disabled
mesh = Mesh(<mesh referenced from the Rhino model>)  # disabled

# ---- group: Tweak list to adjust frequency
block_list_11 = Panel("""Tube 1
Tube 1
Tube 2
Tube 2
Tube 3
Snap 1
Snap 2
Snap 3
Arc
Arc
Wedge
Wedge""")

# ----
number_slider_22 = Slider(15, range=0..50)
number_slider_23 = Slider(3, range=0..10)
geo_2 = Geometry(<mesh referenced from the Rhino model>)  # disabled
python_12 = GhPythonScript(
    source_geo=mesh,
    source_axis=crv_13,
    source_source_guide=crv_12,
    source_axes_remaining=crv_15,
    source_guides_remaining=crv_16,
    target_axis=rotate_3.Geometry,
    target_guide=rotate.Geometry)  # -> out, a, b; inputs source_geo: Mesh, source_axis: Curve, source_source_guide: Curve, source_axes_remaining: list of Curve, source_guides_remaining: list of Curve, target_axis: Curve, target_guide: Curve; disabled
# ---------- python_12: Python ----------
__author__ = "jason"
__version__ = "2020.03.06"

import Rhino.Geometry as rg
import math


#def round_vector(vector):
#    #Avoice cross product errors from ALMOST parallel vectors
#    vec_x = round(vector[0], 4)
#    vec_y = round(vector[1], 4)
#    vec_z = round(vector[2], 4)
#    return [vec_x, vec_y, vec_z]



def angle_cross_product(target, source):
    #Expects target and source curves, drawn to represent vectors) 
    
    #Calculate target_normal
    target_pt_start = target.PointAt(0)
    target_pt_end = target.PointAt(1)
    target_normal = target_pt_end - target_pt_start
    
    #Calculate source_normal
    source_pt_start = source.PointAt(0)
    source_pt_end = source.PointAt(1)
    source_normal = source_pt_end - source_pt_start
    
    #Cross Product [cx, cy, cz] is the normal vector or axis of rotation
    #Note that Dot Product will only give angle between 0 and 180, so the sign of Cross Product will tell counter-clockwise (positive) vs. clockwise (negative)
    cx = (source_normal[1] * target_normal[2]) - (source_normal[2] * target_normal[1])
    cy = (source_normal[2] * target_normal[0]) - (source_normal[0] * target_normal[2])
    cz = (source_normal[0] * target_normal[1]) - (source_normal[1] * target_normal[0])
    cross_product = rg.Vector3d(cx, cy, cz)
    
    #Dot Product is used to find the angle between the two vectors (calculation is simplified for unit vectors)
    dot_product = (target_normal[0] * source_normal[0]) + (target_normal[1] * source_normal[1]) + (target_normal[2] * source_normal[2])
    dot_product = round(dot_product, 5)
    
    
    
    print 'Dot Product', dot_product
    
    
    
    try: angle = math.acos(dot_product)
    except: angle = 0
    
    #Use dot product to avoid confusion of parallel vectors in same direction vs. opposite direction
    if dot_product == 1: angle = 0
    elif dot_product == -1.0: angle = math.pi
    else: pass
    
    return [angle, cross_product]



def orient3d(source_geo, source_axis, source_source_guide, source_axes_remaining, source_guides_remaining, target_axis, target_guide):
    
    #Note on guides
    #Target_geo has a target_guide to use for alignment bc axes vectors don't track rotation around themselves
    #Source_geo also has target_guides (called source_target_guides) that will be used once the geo is placed and becomes a target, but you don't need the target guide for the chosen plug b/c it's already taken
    #Source_geo has multiple source_guides which represent the possible orientations, from which one must be chosen
    
    #Step 1 is to align the two axes in 3d space
    #Step 2 is to align the guide axes, rotating the source geometry into the correct orientation
    #Step 3 is just moving the source geometry to the target geometry
    
    
    #Step 1
    
    #Flip source axis to plug souce into target
    flipped_source = source_axis.Duplicate()
    flipped_source.Reverse()
    
    
    
    print 'Step 1'
    
    
    
    angle, cross_product = angle_cross_product(target_axis, flipped_source)
    
    rotation = rg.Transform.Rotation(math.sin(angle), math.cos(angle), cross_product, source_axis.PointAt(0))
    
    #Transform (must be incremental b/c rotation center pt must be redefined at each step)
    source_geo.Transform(rotation)
    source_axis.Transform(rotation)
    source_source_guide.Transform(rotation)
    for i, axis in enumerate(source_axes_remaining):
        source_axes_remaining[i].Transform(rotation) 
    for i, guide in enumerate(source_guides_remaining):
        source_guides_remaining[i].Transform(rotation)
    
    
    
    #Step 2
    #Move source to target
    movement = rg.Transform.Translation(rg.Vector3d(target_axis.PointAt(0) - source_axis.PointAt(0)))
    source_geo.Transform(movement)
    source_axis.Transform(movement)
    source_source_guide.Transform(movement)
    for i, axis in enumerate(source_axes_remaining):
        source_axes_remaining[i].Transform(movement) 
    for i, guide in enumerate(source_guides_remaining):
        source_guides_remaining[i].Transform(movement)
    
    
    
    #Step 3
    
    
    
    print ' '
    print 'Step 3'
    
    
    print ' '
    print 'Initial angle'
    
    
    angle, cross_product = angle_cross_product(target_guide, source_source_guide)
    new_cross_product = rg.Vector3d(source_axis.PointAt(0) - source_axis.PointAt(1)) #Cross product is unreliable when when original vectors are 180 degrees apart
    
    #Test rotation, if guides don't align, rotate at negative angle instead 
    
    
    print ' '
    print 'Test angle'
    
    
    test_source_guide = source_source_guide.Duplicate()
    test_rotation = rg.Transform.Rotation(math.sin(angle), math.cos(angle), new_cross_product, source_axis.PointAt(0))
    test_source_guide.Transform(test_rotation)
    test_angle, test_cross_product = angle_cross_product(target_guide, test_source_guide)
    
    if test_angle > 0.05 or test_angle < -0.05: #Reverse angle if larger than 3 degrees
        angle = angle * -1
        rotation = rg.Transform.Rotation(math.sin(angle), math.cos(angle), new_cross_product, source_axis.PointAt(0))
        source_geo.Transform(rotation)
        source_axis.Transform(rotation)
        source_source_guide.Transform(rotation)
        for i, axis in enumerate(source_axes_remaining):
            source_axes_remaining[i].Transform(rotation) 
        for i, guide in enumerate(source_guides_remaining):
            source_guides_remaining[i].Transform(rotation)
    else:
        source_geo.Transform(test_rotation)
        source_axis.Transform(test_rotation)
        source_source_guide.Transform(test_rotation)
        for i, axis in enumerate(source_axes_remaining):
            source_axes_remaining[i].Transform(test_rotation) 
        for i, guide in enumerate(source_guides_remaining):
            source_guides_remaining[i].Transform(test_rotation)
    
    
    #Don't return source_axis and source_source_guide b/c they aren't needed anymore
    return_objects = [source_geo, source_axes_remaining, source_guides_remaining, source_source_guide]
    return return_objects




objects = orient3d(source_geo, source_axis, source_source_guide, source_axes_remaining, source_guides_remaining, target_axis, target_guide)

a = objects[0]
b = objects[3]
# ---------- end python_12 ----------
python_13 = GhPythonScript(run=toggle, rotation_angle=num_rotation, block_list=block_list_10, selection_list=selection_list_9)  # -> out, blocks, block_meshes, block_edges, traces_lines; inputs run: Boolean, block_list: list, selection_list: list of Int32; disabled
# ---------- python_13: Python ----------
__author__ = "jason"
__version__ = "2020.02.05"

import Rhino
import System
import math
import Rhino.Geometry as rg

#Inputs
global rotation_sin
global rotation_cos
global block_list
global selection_list
global nib_sequence
global traces_points
global traces_lines

traces_points = []
traces_lines = []

rotation_angle = rotation_angle * 0.0175
rotation_sin = math.sin(rotation_angle)
rotation_cos = math.cos(rotation_angle)

#----------Geometry Inputs----------------------------------------------------------------------------------------------------------

global base_sphere
global base_tube
global base_axis
global base_guide

global arc_geo
global arc_plug1_a_axis
global arc_plug1_a_guide_target
global arc_plug1_a_guide_source1
global arc_plug1_a_guide_source2
global arc_plug1_b_axis
global arc_plug1_b_guide_target
global arc_plug1_b_guide_source1
global arc_plug1_b_guide_source2
global arc_plug2_axis
global arc_plug2_guide_target
global arc_plug2_guide_source1
global arc_plug2_guide_source2
global arc_tube1_axis
global arc_tube1_guide_target
global arc_tube1_guide_source1
global arc_tube1_guide_source2
global arc_tube1_guide_source3
global arc_tube1_guide_source4

def ref_geometry():
    #Explicitly reference globals inside fundtion
    global base_sphere
    global base_tube
    global base_axis
    global base_guide
    
    global arc_geo
    global arc_plug1_a_axis
    global arc_plug1_a_guide_target
    global arc_plug1_a_guide_source1
    global arc_plug1_a_guide_source2
    global arc_plug1_b_axis
    global arc_plug1_b_guide_target
    global arc_plug1_b_guide_source1
    global arc_plug1_b_guide_source2
    global arc_plug2_axis
    global arc_plug2_guide_target
    global arc_plug2_guide_source1
    global arc_plug2_guide_source2
    global arc_tube1_axis
    global arc_tube1_guide_target
    global arc_tube1_guide_source1
    global arc_tube1_guide_source2
    global arc_tube1_guide_source3
    global arc_tube1_guide_source4
    
    guid_base_sphere = System.Guid.Parse('832d5517-7b1e-484c-b89a-8e868d5de03c')
    guid_base_tube = System.Guid.Parse('9b9e5ed1-5d84-4a02-a49a-a9cbc41323fd')
    guid_base_axis = System.Guid.Parse('cc4d087d-b190-492d-a1dd-30fcea4b304c')
    guid_base_guide = System.Guid.Parse('d12c3e0e-d53b-4787-a606-59ebcb415449')
    
    guid_arc_geo = System.Guid.Parse('a3d5f48b-ae80-45ee-b542-da50bdedb984')
    guid_arc_plug1_a_axis = System.Guid.Parse('e07eca14-6087-4007-bd34-ba06bce6b3f8')
    guid_arc_plug1_a_guide_target = System.Guid.Parse('cc11a1ad-d766-47f5-ada5-cb082205c9c1')
    guid_arc_plug1_a_guide_source1 = System.Guid.Parse('c3eadf2f-d5bc-489e-905c-f7914f95b606')
    guid_arc_plug1_a_guide_source2 = System.Guid.Parse('9f430d65-e419-40a4-9933-3182c5e43100')
    guid_arc_plug1_b_axis = System.Guid.Parse('6e153743-07c3-4268-8fce-e32383630351')
    guid_arc_plug1_b_guide_target = System.Guid.Parse('251a78ba-8a94-47fc-9dfb-f747e674ac20')
    guid_arc_plug1_b_guide_source1 = System.Guid.Parse('ea18acf9-ccd0-49f2-a448-8c00869ed95b')
    guid_arc_plug1_b_guide_source2 = System.Guid.Parse('0c546922-823d-4321-af17-bad658dd6fff')
    guid_arc_plug2_axis = System.Guid.Parse('13f5f9e9-cdb4-4d14-a332-ae8f849e36ec')
    guid_arc_plug2_guide_target = System.Guid.Parse('a15c170a-8c45-4278-9d6f-a29498c8266d')
    guid_arc_plug2_guide_source1 = System.Guid.Parse('56b74c32-6821-40df-b131-26928d69bc7a')
    guid_arc_plug2_guide_source2 = System.Guid.Parse('da819629-81fc-4147-80b3-be45d6b1e5cc')
    guid_arc_tube1_axis = System.Guid.Parse('25a118d9-2587-4a5e-99b5-e7ecbef4cec4')
    guid_arc_tube1_guide_target = System.Guid.Parse('253fb965-901e-4b73-8970-8007d45df99a')
    guid_arc_tube1_guide_source1 = System.Guid.Parse('0c880e2c-df6a-431a-8f39-b755db4b6292')
    guid_arc_tube1_guide_source2 = System.Guid.Parse('253fb965-901e-4b73-8970-8007d45df99a')
    guid_arc_tube1_guide_source3 = System.Guid.Parse('246bee08-9dfc-46b4-854a-778169e3da54')
    guid_arc_tube1_guide_source4 = System.Guid.Parse('8cc9adb4-98b8-4ece-8054-ba3a65f3ccfc')
    
    for obj in Rhino.RhinoDoc.ActiveDoc.Objects:
        if obj.Id == guid_base_sphere: base_sphere = obj.Geometry
        elif obj.Id == guid_base_tube: base_tube = obj.Geometry
        elif obj.Id == guid_base_axis: base_axis = obj.Geometry
        elif obj.Id == guid_base_guide: base_guide = obj.Geometry
        
        elif obj.Id == guid_arc_geo: arc_geo = obj.Geometry
        elif obj.Id == guid_arc_plug1_a_axis: arc_plug1_a_axis = obj.Geometry
        elif obj.Id == guid_arc_plug1_a_guide_target: arc_plug1_a_guide_target = obj.Geometry
        elif obj.Id == guid_arc_plug1_a_guide_source1: arc_plug1_a_guide_source1 = obj.Geometry
        elif obj.Id == guid_arc_plug1_a_guide_source2: arc_plug1_a_guide_source2 = obj.Geometry
        elif obj.Id == guid_arc_plug1_b_axis: arc_plug1_b_axis = obj.Geometry
        elif obj.Id == guid_arc_plug1_b_guide_target: arc_plug1_b_guide_target = obj.Geometry
        elif obj.Id == guid_arc_plug1_b_guide_source1: arc_plug1_b_guide_source1 = obj.Geometry
        elif obj.Id == guid_arc_plug1_b_guide_source2: arc_plug1_b_guide_source2 = obj.Geometry
        elif obj.Id == guid_arc_plug2_axis: arc_plug2_axis = obj.Geometry
        elif obj.Id == guid_arc_plug2_guide_target: arc_plug2_guide_target = obj.Geometry
        elif obj.Id == guid_arc_plug2_guide_source1: arc_plug2_guide_source1 = obj.Geometry
        elif obj.Id == guid_arc_plug2_guide_source2: arc_plug2_guide_source2 = obj.Geometry
        elif obj.Id == guid_arc_tube1_axis: arc_tube1_axis = obj.Geometry
        elif obj.Id == guid_arc_tube1_guide_target:
            arc_tube1_guide_target = obj.Geometry
            arc_tube1_guide_source2 = arc_tube1_guide_target.Duplicate()
        elif obj.Id == guid_arc_tube1_guide_source1: arc_tube1_guide_source1 = obj.Geometry
        elif obj.Id == guid_arc_tube1_guide_source3: arc_tube1_guide_source3 = obj.Geometry
        elif obj.Id == guid_arc_tube1_guide_source4: arc_tube1_guide_source4 = obj.Geometry

ref_geometry()

#----------Tags----------------------------------------------------------------------------------------------------------

global tag_tube1_a_outer
global tag_tube1_a_inner
global tag_tube1_b_outer
global tag_tube1_b_inner
global tag_tube2_a_outer
global tag_tube2_a_inner
global tag_tube2_b_outer
global tag_tube2_b_inner
global tag_tube3_a_outer
global tag_tube3_a_inner
global tag_tube3_b_outer
global tag_tube3_b_inner
global tag_snap1_tube2_a
global tag_snap1_tube2_b
global tag_snap2_tube2_a
global tag_snap2_tube2_b
global tag_snap3_tube1
global tag_snap3_tube2
global tag_arc_plug1_a
global tag_arc_plug1_b
global tag_arc_plug2
global tag_arc_tube1
global tag_wedge_plug1
global tag_wedge_plug2
global tag_wedge_tube2
global tag_nib_plug
global tag_nib_tube1_a
global tag_nib_tube1_b
global tag_nib_tube2_a
global tag_nib_tube2_b
global tag_nib_snap

#Each slot/plug/connector on a block has a tag
#Each tag has a name describing what it it (i.e. 'arc_tube1' is the opening in the arc block that accepts a tube1 block)
#But the content of each tag is a string representing a list of the other connectors that it accepts (i.e. 'arc_plug1_a' accepts other arcs, as well as wedges and slivers)

tag_tube1_a_outer = "arc_tube1, sliver_tube1, snap3_tube1" 
tag_tube1_a_inner = "tube2_b_outer, tube3_b_outer, nib_tube1_a"
tag_tube1_b_outer = "arc_tube1, sliver_tube1, snap3_tube1"
tag_tube1_b_inner = "tube2_a_outer, tube3_a_outer, nib_tube1_b"
tag_tube2_a_outer = "wedge_tube2, sliver_tube2, tube1_b_inner, snap1_tube2_a, snap1_tube2_b, snap2_tube2_a, snap2_tube2_b, snap3_tube2"
tag_tube2_a_inner = "nib_tube2_a"
tag_tube2_b_outer = "wedge_tube2, sliver_tube2, tube1_a_inner, snap1_tube2_a, snap1_tube2_b, snap2_tube2_a, snap2_tube2_b, snap3_tube2"
tag_tube2_b_inner = "nib_tube2_b"
#This is a little wonky, but tube3 accepts tube 2 tags (b/c those targets share the same locations)
tag_tube3_a_outer = "wedge_tube2, sliver_tube2, tube1_b_inner, snap1_tube2_a, snap1_tube2_b, snap2_tube2_a, snap2_tube2_b, snap3_tube2"
tag_tube3_a_inner = "nib_tube2_a"
tag_tube3_b_outer = "wedge_tube2, sliver_tube2, tube1_a_inner, snap1_tube2_a, snap1_tube2_b, snap2_tube2_a, snap2_tube2_b, snap3_tube2"
tag_tube3_b_inner = "nib_tube2_b"
tag_snap1_tube2_a = "tube2_a_outer, tube2_b_outer, tube3_a_outer, tube3_b_outer, nib_snap_a, nib_snap_b"
tag_snap1_tube2_b = "tube2_a_outer, tube2_b_outer, tube3_a_outer, tube3_b_outer, nib_snap_a, nib_snap_b"
tag_snap2_tube2_a = "tube2_a_outer, tube2_b_outer, tube3_a_outer, tube3_b_outer, nib_snap_a, nib_snap_b"
tag_snap2_tube2_b = "tube2_a_outer, tube2_b_outer, tube3_a_outer, tube3_b_outer, nib_snap_a, nib_snap_b"
tag_snap3_tube1 = "tube1_a_outer, tube1_b_outer"
tag_snap3_tube2 = "tube2_a_outer, tube2_b_outer, tube3_a_outer, tube3_b_outer, nib_snap_a, nib_snap_b"
tag_arc_plug1_a = "arc_plug1_a, arc_plug1_b, sliver_plug1, wedge_plug1"
tag_arc_plug1_b = "arc_plug1_a, arc_plug1_b, sliver_plug1, wedge_plug1"
tag_arc_plug2 = "nib_plug2_a, nib_plug2_b"
tag_arc_tube1 = "tube1_a_outer, tube1_b_outer"
tag_wedge_plug1 = "arc_plug1_a, arc_plug1_b, sliver_plug1, wedge_plug1"
tag_wedge_plug2 = "nib_plug2_a, nib_plug2_b"
tag_wedge_tube2 = "tube2_a_outer, tube2_b_outer, tube3_a_outer, tube3_b_outer"
tag_nib_plug2_a = "arc_plug2, sliver_plug2, wedge_plug2"
tag_nib_plug2_b = "arc_plug2, sliver_plug2, wedge_plug2"
tag_nib_tube1_a = "tube1_a_inner"
tag_nib_tube1_b = "tube1_b_inner"
tag_nib_tube2_a = "tube2_a_inner, tube3_a_inner"
tag_nib_tube2_b = "tube2_a_inner, tube3_a_inner"
tag_nib_snap_a = "snap1_tube2_a, snap1_tube2_b, snap2_tube2_a, snap2_tube2_b, snap3_tube2"
tag_nib_snap_b = "snap1_tube2_a, snap1_tube2_b, snap2_tube2_a, snap2_tube2_b, snap3_tube2"


#----------Block Definitions----------------------------------------------------------------------------------------------------------


def generate_selection_pairs(selection, source_tag_names, target_tags):
    #Generate list of tuples containing indices for all permutations of available source/target pairs
    pair_list = []
    
    for i, target_tag in enumerate(target_tags):
        for j, source_tag in enumerate(source_tag_names):
            if source_tag in target_tag.split(", "):
                pair_list.append((j, i))
    
    return pair_list


def next_block(blocks, target_axes, target_guides, target_tags, count, nib_sequence):
    
    print " "
    print "Target tags:"
    for tag in target_tags:
        print tag
    print " "
    
    
    if len(block_list) > count:
        block = block_list[count]
        
        if block_list[count] == "Tube 1":
            try:
                tube1(blocks, target_axes, target_guides, target_tags, count, nib_sequence)
            except:
                count += 1
                next_block(blocks, target_axes, target_guides, target_tags, count, nib_sequence)
        
        elif block_list[count] == "Tube 2":
            try:
                tube2(blocks, target_axes, target_guides, target_tags, count, nib_sequence)
            except:
                count += 1
                next_block(blocks, target_axes, target_guides, target_tags, count, nib_sequence)
        
        elif block_list[count] == "Tube 3":
            try:
                tube3(blocks, target_axes, target_guides, target_tags, count, nib_sequence)
            except:
                count += 1
                next_block(blocks, target_axes, target_guides, target_tags, count, nib_sequence)
        
        elif block_list[count] == "Snap 1":
            try:
                snap1(blocks, target_axes, target_guides, target_tags, count, nib_sequence)
            except:
                count += 1
                next_block(blocks, target_axes, target_guides, target_tags, count, nib_sequence)
        
        elif block_list[count] == "Snap 2":
            try:
                snap2(blocks, target_axes, target_guides, target_tags, count, nib_sequence)
            except:
                count += 1
                next_block(blocks, target_axes, target_guides, target_tags, count, nib_sequence)
        
        elif block_list[count] == "Snap 3":
            try:
                snap3(blocks, target_axes, target_guides, target_tags, count, nib_sequence)
            except:
                count += 1
                next_block(blocks, target_axes, target_guides, target_tags, count, nib_sequence)
        
        elif block_list[count] == "Arc":
            
            #--------------------------------------------------------------------------------------------------------------------
            
            arc(blocks, target_axes, target_guides, target_tags, count, nib_sequence)
            #try:
                #arc(blocks, target_axes, target_guides, target_tags, count, nib_sequence)
            #except:
                #count += 1
                #next_block(blocks, target_axes, target_guides, target_tags, count, nib_sequence)
        
        elif block_list[count] == "Sliver":
            
            try:
                sliver(blocks, target_axes, target_guides, target_tags, count, nib_sequence)
            except:
                count +=1 
                next_block(blocks, target_axes, target_guides, target_tags, count, nib_sequence)
        
        elif block_list[count] == "Wedge":
            try:
                wedge(blocks, target_axes, target_guides, target_tags, count, nib_sequence)
            except:
                count += 1
                next_block(blocks, target_axes, target_guides, target_tags, count, nib_sequence)
        
        elif block_list[count] == "Nib":
            try:
                nib(blocks, target_axes, target_guides, target_tags, count, nib_sequence)
            except:
                count += 1
                next_block(blocks, target_axes, target_guides, target_tags, count, nib_sequence)
        
        else:
            print "Block does not exist."
            count += 1
            next_block(blocks, target_axes, target_guides, target_tags, count, nib_sequence)
        
    else:
        print "Done"
        return blocks


def angle_cross_product(target, source):
    #Expects target and source curves, drawn to represent vectors) 
    
    #Calculate target_normal
    target_pt_start = target.PointAt(0)
    target_pt_end = target.PointAt(1)
    target_normal = target_pt_end - target_pt_start
    
    #Calculate source_normal
    source_pt_start = source.PointAt(0)
    source_pt_end = source.PointAt(1)
    source_normal = source_pt_end - source_pt_start
    
    #Cross Product [cx, cy, cz] is the normal vector or axis of rotation
    #Note that Dot Product will only give angle between 0 and 180, so the sign of Cross Product will tell counter-clockwise (positive) vs. clockwise (negative)
    cx = (source_normal[1] * target_normal[2]) - (source_normal[2] * target_normal[1])
    cy = (source_normal[2] * target_normal[0]) - (source_normal[0] * target_normal[2])
    cz = (source_normal[0] * target_normal[1]) - (source_normal[1] * target_normal[0])
    cross_product = rg.Vector3d(cx, cy, cz)
    
    #Dot Product is used to find the angle between the two vectors (calculation is simplified for unit vectors)
    dot_product = (target_normal[0] * source_normal[0]) + (target_normal[1] * source_normal[1]) + (target_normal[2] * source_normal[2])
    dot_product = round(dot_product, 5)
    
    try: angle = math.acos(dot_product)
    except: angle = 0
    
    #Use dot product to avoid confusion of parallel vectors in same direction vs. opposite direction
    if dot_product == 1: angle = 0
    elif dot_product < -1: angle = math.pi
    else: pass
    
    return [angle, cross_product]


def orient3d(source_geo, source_axis, source_source_guide, source_axes_remaining, source_guides_remaining, target_axis, target_guide):
    
    #Note on guides
    #Target_geo has a target_guide to use for alignment bc axes vectors don't track rotation around themselves
    #Source_geo also has target_guides (called source_target_guides) that will be used once the geo is placed and becomes a target, but you don't need the target guide for the chosen plug b/c it's already taken
    #Source_geo has multiple source_guides which represent the possible orientations, from which one must be chosen
    
    #Step 1 is to align the two axes in 3d space
    #Step 2 is to align the guide axes, rotating the source geometry into the correct orientation
    #Step 3 is just moving the source geometry to the target geometry
    
    
    #Step 1
    
    #Flip source axis to plug souce into target
    flipped_source = source_axis.Duplicate()
    flipped_source.Reverse()
    
    angle, cross_product = angle_cross_product(target_axis, flipped_source)
    
    rotation = rg.Transform.Rotation(math.sin(angle), math.cos(angle), cross_product, source_axis.PointAt(0))
    
    #Transform (must be incremental b/c rotation center pt must be redefined at each step)
    source_geo.Transform(rotation)
    source_axis.Transform(rotation)
    source_source_guide.Transform(rotation)
    for i, axis in enumerate(source_axes_remaining):
        source_axes_remaining[i].Transform(rotation) 
    for i, guide in enumerate(source_guides_remaining):
        source_guides_remaining[i].Transform(rotation)
    
    
    
    #Step 2
    #Move source to target
    movement = rg.Transform.Translation(rg.Vector3d(target_axis.PointAt(0) - source_axis.PointAt(0)))
    source_geo.Transform(movement)
    source_axis.Transform(movement)
    source_source_guide.Transform(movement)
    for i, axis in enumerate(source_axes_remaining):
        source_axes_remaining[i].Transform(movement) 
    for i, guide in enumerate(source_guides_remaining):
        source_guides_remaining[i].Transform(movement)
    
    
    
    #Step 3
    angle, cross_product = angle_cross_product(target_guide, source_source_guide)
    new_cross_product = rg.Vector3d(source_axis.PointAt(0) - source_axis.PointAt(1)) #Cross product is unreliable when when original vectors are 180 degrees apart
    
    #Test rotation, if guides don't align, rotate at negative angle instead 
    test_source_guide = source_source_guide.Duplicate()
    test_rotation = rg.Transform.Rotation(math.sin(angle), math.cos(angle), new_cross_product, source_axis.PointAt(0))
    test_source_guide.Transform(test_rotation)
    test_angle, test_cross_product = angle_cross_product(target_guide, test_source_guide)
    
    if test_angle > 0.05 or test_angle < -0.05: #Reverse angle if larger than 3 degrees
        angle = angle * -1
        rotation = rg.Transform.Rotation(math.sin(angle), math.cos(angle), new_cross_product, source_axis.PointAt(0))
        source_geo.Transform(rotation)
        source_axis.Transform(rotation)
        source_source_guide.Transform(rotation)
        for i, axis in enumerate(source_axes_remaining):
            source_axes_remaining[i].Transform(rotation) 
        for i, guide in enumerate(source_guides_remaining):
            source_guides_remaining[i].Transform(rotation)
    else:
        source_geo.Transform(test_rotation)
        source_axis.Transform(test_rotation)
        source_source_guide.Transform(test_rotation)
        for i, axis in enumerate(source_axes_remaining):
            source_axes_remaining[i].Transform(test_rotation) 
        for i, guide in enumerate(source_guides_remaining):
            source_guides_remaining[i].Transform(test_rotation)
    
    
    #Don't return source_axis and source_source_guide b/c they aren't needed anymore
    return_objects = [source_geo, source_axes_remaining, source_guides_remaining]
    return return_objects


def base():
    #Define geometry
    sphere = base_sphere.Duplicate()
    tube = base_tube.Duplicate()
    axis = base_axis.Duplicate()
    guide = base_guide.Duplicate()
    
    #Transform
    axis_vector = rg.Vector3d(axis.PointAt(0) - axis.PointAt(0.5))
    rotation = rg.Transform.Rotation(rotation_sin, rotation_cos, axis_vector, axis.PointAt(0))
    sphere.Transform(rotation)
    tube.Transform(rotation)
    axis.Transform(rotation)
    guide.Transform(rotation)
    
    #Modify master lists (blocks, target_axes, target_guides, target_tags)
    nib_sequence = 0
    blocks = []
    target_axes = []
    target_guides = []
    target_tags = []
    
    print "Adding Base"
    blocks.append(sphere)
    blocks.append(tube)
    
    target_axes.append(axis)
    target_axes.append(axis)
    target_guides.append(guide)
    target_guides.append(guide)
    target_tags.append(tag_tube1_a_outer)
    target_tags.append(tag_tube1_a_inner)
    
    count = 0
    
    next_block(blocks, target_axes, target_guides, target_tags, count, nib_sequence)
    
    return blocks


def tube1(blocks, target_axes, target_guides, target_tags, count, nib_sequence):
    #Inputs
    data = inputs_tube1[0]
    source_axes = inputs_tube1[1]
    source_tags = inputs_tube1[2]
    
    try:
        selection_index = selection_list[count]
    except:
        selection_index = 0 #0 is default value if no selection provided
    
    #Define Geometry
    #Make duplicates or else recomputing will continuously modify planes
    tube1 = data[0].Duplicate()
    plane_tube1_a_outer = rg.Plane(data[1])
    plane_tube1_a_inner = rg.Plane(data[2])
    plane_tube1_b_outer = rg.Plane(data[3])
    plane_tube1_b_inner = rg.Plane(data[4])
    
    #Determine source and target planes
    pair_list = generate_selection_pairs(selection_index, source_tags, target_tags)
    source_target_pair = pair_list[selection_index % len(pair_list)]
    source_plane = source_axes[source_target_pair[0]]
    source_tag = source_tags[source_target_pair[0]]
    target_axis = target_axes.pop(source_target_pair[1])
    target_tag = target_tags.pop(source_target_pair[1])
    
    #Transform Orientation
    orient = rg.Transform.PlaneToPlane(source_plane, target_axis)
    tube1.Transform(orient)
    plane_tube1_a_outer.Transform(orient)
    plane_tube1_a_inner.Transform(orient)
    plane_tube1_b_outer.Transform(orient)
    plane_tube1_b_inner.Transform(orient)
    
    #Transform Rotation
    axis_vector = rg.Vector3d(plane_tube1_a_outer.Origin - plane_tube1_b_outer.Origin)
    rotation = rg.Transform.Rotation(rotation_angle, axis_vector, plane_tube1_b_outer.Origin)
    tube1.Transform(rotation)
    plane_tube1_a_outer.Transform(rotation)
    plane_tube1_a_inner.Transform(rotation)
    plane_tube1_b_outer.Transform(rotation)
    plane_tube1_b_inner.Transform(rotation)
    
    #Modify master lists (blocks, planes, tags)
    print "Adding Tube 1"
    blocks.append(tube1)
    
    #If Tube 1 is placed on Tube 2/3, then we have to remove the corresponding Tube 2/3 inner plane
    #I.E. you can't place a nib in the end of Tube 2/3 that is already in Tube 1
    if target_tag == tag_tube2_a_outer or target_tag == tag_tube2_b_outer or target_tag == tag_tube3_a_outer or target_tag == tag_tube3_b_outer:
        remove_plane = target_axes.pop(source_target_pair[1]) #Inner plane will always follow the available outer plane
        removve_tag = target_tags.pop(source_target_pair[1]) #Use source_target_pair[1] b/c the index has already been popped, shortening the list, so no need for +1
    
    temp_list_target_axes = [plane_tube1_a_outer, plane_tube1_a_inner, plane_tube1_b_outer, plane_tube1_b_inner]
    temp_list_target_tags = [tag_tube1_a_outer, tag_tube1_a_inner, tag_tube1_b_outer, tag_tube1_b_inner]
    temp_list_source_tags = ["tube1_a_outer", "tube1_a_inner", "tube1_b_outer", "tube1_b_inner"]
    
    for i, tag in enumerate(temp_list_source_tags):
        if tag == source_tag:
            pass
        else:
            target_axes.append(temp_list_target_axes[i])
            target_tags.append(temp_list_target_tags[i])
    
    #Create next block
    count += 1
    next_block(blocks, target_axes, target_tags, count, nib_sequence)


def tube2(blocks, target_axes, target_guides, target_tags, count, nib_sequence):
    #Inputs
    data = inputs_tube2[0]
    source_axes = inputs_tube2[1]
    source_tags = inputs_tube2[2]
    try:
        selection_index = selection_list[count]
    except:
        selection_index = 0
    
    #Define Geometry
    #Make duplicates or else recomputing will continuously modify planes
    tube2 = data[0].Duplicate()
    pt1 = rg.Point3d(data[1])
    pt2 = rg.Point3d(data[2])
    pt3 = rg.Point3d(data[3])
    pt4 = rg.Point3d(data[4])
    plane_tube2_a_outer = rg.Plane(data[5])
    plane_tube2_a_inner = rg.Plane(data[6])
    plane_tube2_b_outer = rg.Plane(data[7])
    plane_tube2_b_inner = rg.Plane(data[8])
    
    #Determine source and target planes
    pair_list = generate_selection_pairs(selection_index, source_tags, target_tags)
    source_target_pair = pair_list[selection_index % len(pair_list)]
    source_plane = source_axes[source_target_pair[0]]
    source_tag = source_tags[source_target_pair[0]]
    target_axis = target_axes.pop(source_target_pair[1])
    target_tag = target_tags.pop(source_target_pair[1])
    
    #Transform Orientation
    orient = rg.Transform.PlaneToPlane(source_plane, target_axis)
    tube2.Transform(orient)
    pt1.Transform(orient)
    pt2.Transform(orient)
    pt3.Transform(orient)
    pt4.Transform(orient)
    plane_tube2_a_outer.Transform(orient)
    plane_tube2_a_inner.Transform(orient)
    plane_tube2_b_outer.Transform(orient)
    plane_tube2_b_inner.Transform(orient)
    
    #Transform Rotation
    if source_tag == "tube2_a_outer":
        axis_vector = rg.Vector3d(pt2 - pt1)
        rotation = rg.Transform.Rotation(rotation_angle * 2, axis_vector, pt2)
    else:
        axis_vector = rg.Vector3d(pt3 - pt4)
        rotation = rg.Transform.Rotation(rotation_angle * 2, axis_vector, pt3)
    tube2.Transform(rotation)
    plane_tube2_a_outer.Transform(rotation)
    plane_tube2_a_inner.Transform(rotation)
    plane_tube2_b_outer.Transform(rotation)
    plane_tube2_b_inner.Transform(rotation)
    
    #Modify master lists (blocks, planes, tags)
    print "Adding Tube 2"
    blocks.append(tube2)
    
    #If Tube 2/3 is placed in Tube 1, then that end of Tube 2/3 does not add a tube2_inner plane for that end only
    #I.E. you can't place a nib in the end of Tube 2/3 that is already in Tube 1
    if target_tag == tag_tube1_a_inner:
        temp_list_target_axes = [plane_tube2_a_outer, plane_tube2_a_inner, plane_tube2_b_outer]
        temp_list_target_tags = [tag_tube2_a_outer, tag_tube2_a_inner, tag_tube2_b_outer]
        temp_list_source_tags = ["tube2_a_outer", "tube2_a_inner","tube2_b_outer"]
    elif target_tag == tag_tube1_b_inner:
        temp_list_target_axes = [plane_tube2_a_outer, plane_tube2_b_outer, plane_tube2_b_inner]
        temp_list_target_tags = [tag_tube2_a_outer, tag_tube2_b_outer, tag_tube2_b_inner]
        temp_list_source_tags = ["tube2_a_outer", "tube2_b_outer", "tube2_b_inner"]
    else:
        temp_list_target_axes = [plane_tube2_a_outer, plane_tube2_a_inner, plane_tube2_b_outer, plane_tube2_b_inner]
        temp_list_target_tags = [tag_tube2_a_outer, tag_tube2_a_inner, tag_tube2_b_outer, tag_tube2_b_inner]
        temp_list_source_tags = ["tube2_a_outer", "tube2_a_inner", "tube2_b_outer", "tube2_b_inner"]
    
    for i, tag in enumerate(temp_list_source_tags):
        if tag == source_tag:
            pass
        else:
            target_axes.append(temp_list_target_axes[i])
            target_tags.append(temp_list_target_tags[i])
    
    #Create next block
    count += 1
    next_block(blocks, target_axes, target_tags, count, nib_sequence)


def tube3(blocks, target_axes, target_guides, target_tags, count, nib_sequence):
    #Inputs
    data = inputs_tube3[0]
    source_axes = inputs_tube3[1]
    source_tags = inputs_tube3[2]
    try:
        selection_index = selection_list[count]
    except:
        selection_index = 0
    
    #Define Geometry
    #Make duplicates or else recomputing will continuously modify planes
    tube3 = data[0].Duplicate()
    pt1 = rg.Point3d(data[1])
    pt2 = rg.Point3d(data[2])
    pt3 = rg.Point3d(data[3])
    pt4 = rg.Point3d(data[4])
    plane_tube3_a_outer = rg.Plane(data[5])
    plane_tube3_a_inner = rg.Plane(data[6])
    plane_tube3_b_outer = rg.Plane(data[7])
    plane_tube3_b_inner = rg.Plane(data[8])
    
    #Determine source and target planes
    pair_list = generate_selection_pairs(selection_index, source_tags, target_tags)
    source_target_pair = pair_list[selection_index % len(pair_list)]
    source_plane = source_axes[source_target_pair[0]]
    source_tag = source_tags[source_target_pair[0]]
    target_axis = target_axes.pop(source_target_pair[1])
    target_tag = target_tags.pop(source_target_pair[1])
    
    #Transform Orientation
    orient = rg.Transform.PlaneToPlane(source_plane, target_axis)
    tube3.Transform(orient)
    pt1.Transform(orient)
    pt2.Transform(orient)
    pt3.Transform(orient)
    pt4.Transform(orient)
    plane_tube3_a_outer.Transform(orient)
    plane_tube3_a_inner.Transform(orient)
    plane_tube3_b_outer.Transform(orient)
    plane_tube3_b_inner.Transform(orient)
    
    #Transform Rotation
    if source_tag == "tube3_a_outer":
        axis_vector = rg.Vector3d(pt2 - pt1)
        rotation = rg.Transform.Rotation(rotation_angle * 2, axis_vector, pt2)
    else:
        axis_vector = rg.Vector3d(pt3 - pt4)
        rotation = rg.Transform.Rotation(rotation_angle * 2, axis_vector, pt3)
    tube3.Transform(rotation)
    plane_tube3_a_outer.Transform(rotation)
    plane_tube3_a_inner.Transform(rotation)
    plane_tube3_b_outer.Transform(rotation)
    plane_tube3_b_inner.Transform(rotation)
    
    #Modify master lists (blocks, planes, tags)
    print "Adding Tube 3"
    blocks.append(tube3)
    
    #If Tube 2/3 is placed in Tube 1, then that end of Tube 2/3 does not add a tube2_inner plane for that end only
    #I.E. you can't place a nib in the end of Tube 2/3 that is already in Tube 1
    if target_tag == tag_tube1_a_inner:
        temp_list_target_axes = [plane_tube3_a_outer, plane_tube3_a_inner, plane_tube3_b_outer]
        temp_list_target_tags = [tag_tube3_a_outer, tag_tube3_a_inner, tag_tube3_b_outer]
        temp_list_source_tags = ["tube3_a_outer", "tube3_a_inner","tube3_b_outer"]
    elif target_tag == tag_tube1_b_inner:
        temp_list_target_axes = [plane_tube3_a_outer, plane_tube3_b_outer, plane_tube3_b_inner]
        temp_list_target_tags = [tag_tube3_a_outer, tag_tube3_b_outer, tag_tube3_b_inner]
        temp_list_source_tags = ["tube3_a_outer", "tube3_b_outer", "tube3_b_inner"]
    else:
        temp_list_target_axes = [plane_tube3_a_outer, plane_tube3_a_inner, plane_tube3_b_outer, plane_tube3_b_inner]
        temp_list_target_tags = [tag_tube3_a_outer, tag_tube3_a_inner, tag_tube3_b_outer, tag_tube3_b_inner]
        temp_list_source_tags = ["tube3_a_outer", "tube3_a_inner", "tube3_b_outer", "tube3_b_inner"]
    
    for i, tag in enumerate(temp_list_source_tags):
        if tag == source_tag:
            pass
        else:
            target_axes.append(temp_list_target_axes[i])
            target_tags.append(temp_list_target_tags[i])
    
    #Create next block
    count += 1
    next_block(blocks, target_axes, target_tags, count, nib_sequence)


def snap1(blocks, target_axes, target_guides, target_tags, count, nib_sequence):
    #Inputs
    data = inputs_snap1[0]
    source_axes = inputs_snap1[1]
    source_tags = inputs_snap1[2]
    try:
        selection_index = selection_list[count]
    except:
        selection_index = 0
    
    #Define Geometry
    #Make duplicates or else recomputing will continuously modify planes
    snap = data[0].Duplicate()
    plane_snap_tube2_a = rg.Plane(data[1])
    plane_snap_tube2_b = rg.Plane(data[2])
    
    #Determine source and target planes
    pair_list = generate_selection_pairs(selection_index, source_tags, target_tags)
    source_target_pair = pair_list[selection_index % len(pair_list)]
    source_plane = source_axes[source_target_pair[0]]
    source_tag = source_tags[source_target_pair[0]]
    target_axis = target_axes.pop(source_target_pair[1])
    target_tag = target_tags.pop(source_target_pair[1])
    
    #Transform (geometry must be defined first so that transform happens in place)
    orient = rg.Transform.PlaneToPlane(source_plane, target_axis)
    snap.Transform(orient)
    plane_snap_tube2_a.Transform(orient)
    plane_snap_tube2_b.Transform(orient)
    
    #Modify master lists (blocks, planes, tags)
    print "Adding Snap 1"
    blocks.append(snap)
    temp_list_target_axes = [plane_snap_tube2_a, plane_snap_tube2_b]
    temp_list_target_tags = [tag_snap1_tube2_a, tag_snap1_tube2_b]
    temp_list_source_tags = ["snap1_tube2_a", "snap1_tube2_b"]
    
    for i, tag in enumerate(temp_list_source_tags):
        if tag == source_tag:
            pass
        else:
            target_axes.append(temp_list_target_axes[i])
            target_tags.append(temp_list_target_tags[i])
    
    #Create next block
    count += 1
    next_block(blocks, target_axes, target_tags, count, nib_sequence)


def snap2(blocks, target_axes, target_guides, target_tags, count, nib_sequence):
    #Inputs
    data = inputs_snap2[0]
    source_axes = inputs_snap2[1]
    source_tags = inputs_snap2[2]
    try:
        selection_index = selection_list[count]
    except:
        selection_index = 0
    
    #Define Geometry
    #Make duplicates or else recomputing will continuously modify planes
    snap = data[0].Duplicate()
    plane_snap_tube2_a = rg.Plane(data[1])
    plane_snap_tube2_b = rg.Plane(data[2])
    
    #Determine source and target planes
    pair_list = generate_selection_pairs(selection_index, source_tags, target_tags)
    source_target_pair = pair_list[selection_index % len(pair_list)]
    source_plane = source_axes[source_target_pair[0]]
    source_tag = source_tags[source_target_pair[0]]
    target_axis = target_axes.pop(source_target_pair[1])
    target_tag = target_tags.pop(source_target_pair[1])
    
    #Transform (geometry must be defined first so that transform happens in place)
    orient = rg.Transform.PlaneToPlane(source_plane, target_axis)
    snap.Transform(orient)
    plane_snap_tube2_a.Transform(orient)
    plane_snap_tube2_b.Transform(orient)
    
    #Modify master lists (blocks, planes, tags)
    print "Adding Snap 2"
    blocks.append(snap)
    temp_list_target_axes = [plane_snap_tube2_a, plane_snap_tube2_b]
    temp_list_target_tags = [tag_snap2_tube2_a, tag_snap2_tube2_b]
    temp_list_source_tags = ["snap2_tube2_a", "snap2_tube2_b"]
    
    for i, tag in enumerate(temp_list_source_tags):
        if tag == source_tag:
            pass
        else:
            target_axes.append(temp_list_target_axes[i])
            target_tags.append(temp_list_target_tags[i])
    
    #Create next block
    count += 1
    next_block(blocks, target_axes, target_tags, count, nib_sequence)


def snap3(blocks, target_axes, target_guides, target_tags, count, nib_sequence):
    #Inputs
    data = inputs_snap3[0]
    source_axes = inputs_snap3[1]
    source_tags = inputs_snap3[2]
    try:
        selection_index = selection_list[count]
    except:
        selection_index = 0
    
    #Define Geometry
    #Make duplicates or else recomputing will continuously modify planes
    snap = data[0].Duplicate()
    plane_snap_tube1 = rg.Plane(data[1])
    plane_snap_tube2 = rg.Plane(data[2])
    
    #Determine source and target planes
    pair_list = generate_selection_pairs(selection_index, source_tags, target_tags)
    source_target_pair = pair_list[selection_index % len(pair_list)]
    source_plane = source_axes[source_target_pair[0]]
    source_tag = source_tags[source_target_pair[0]]
    target_axis = target_axes.pop(source_target_pair[1])
    target_tag = target_tags.pop(source_target_pair[1])
    
    #Transform (geometry must be defined first so that transform happens in place)
    orient = rg.Transform.PlaneToPlane(source_plane, target_axis)
    snap.Transform(orient)
    plane_snap_tube1.Transform(orient)
    plane_snap_tube2.Transform(orient)
    
    #Modify master lists (blocks, planes, tags)
    print "Adding Snap 3"
    blocks.append(snap)
    temp_list_target_axes = [plane_snap_tube1, plane_snap_tube2]
    temp_list_target_tags = [tag_snap3_tube1, tag_snap3_tube2]
    temp_list_source_tags = ["snap3_tube1", "snap3_tube2"]
    
    for i, tag in enumerate(temp_list_source_tags):
        if tag == source_tag:
            pass
        else:
            target_axes.append(temp_list_target_axes[i])
            target_tags.append(temp_list_target_tags[i])
    
    #Create next block
    count += 1
    next_block(blocks, target_axes, target_tags, count, nib_sequence)


def arc(blocks, target_axes, target_guides, target_tags, count, nib_sequence):
    try:
        selection_index = selection_list[count]
    except:
        selection_index = 0 #In case selection not specified
    
    #Define Inputs
    #Make duplicates or else recomputing will continuously modify planes
    arc = arc_geo.Duplicate()
    plug1_a_axis = arc_plug1_a_axis.Duplicate()
    plug1_a_guide_target = arc_plug1_a_guide_target.Duplicate()
    plug1_a_guide_source1 = arc_plug1_a_guide_source1.Duplicate()
    plug1_a_guide_source2 = arc_plug1_a_guide_source2. Duplicate()
    plug1_b_axis = arc_plug1_b_axis.Duplicate()
    plug1_b_guide_target = arc_plug1_b_guide_target.Duplicate()
    plug1_b_guide_source1 = arc_plug1_b_guide_source1.Duplicate()
    plug1_b_guide_source2 = arc_plug1_b_guide_source2.Duplicate()
    plug2_axis = arc_plug2_axis.Duplicate()
    plug2_guide_target = arc_plug2_guide_target.Duplicate()
    plug2_guide_source1 = arc_plug2_guide_source1.Duplicate()
    plug2_guide_source2 = arc_plug2_guide_source2.Duplicate()
    tube1_axis = arc_tube1_axis.Duplicate()
    tube1_guide_target = arc_tube1_guide_target.Duplicate()
    tube1_guide_source1 = arc_tube1_guide_source1.Duplicate()
    tube1_guide_source2 = arc_tube1_guide_source2.Duplicate()
    tube1_guide_source3 = arc_tube1_guide_source3.Duplicate()
    tube1_guide_source4 = arc_tube1_guide_source4.Duplicate()
    
    
    
    #All available source info
    source_tag_names = ['arc_tube1', 'arc_tube1', 'arc_tube1', 'arc_tube1', 'arc_plug1_a', 'arc_plug1_a', 'arc_plug1_b', 'arc_plug1_b', 'arc_plug2', 'arc_plug2']
    source_axes = [tube1_axis, tube1_axis, tube1_axis, tube1_axis, plug1_a_axis, plug1_a_axis, plug1_b_axis, plug1_b_axis, plug2_axis, plug2_axis]
    source_source_guides = [tube1_guide_source1, tube1_guide_source2, tube1_guide_source3, tube1_guide_source4, plug1_a_guide_source1, plug1_a_guide_source2, plug1_b_guide_source1, plug1_b_guide_source2, plug2_guide_source1, plug2_guide_source2]
    
    #Choose source axis and remove target axis from list of all available
    #Note: don't pop source items b/c user can change selection (so items need to stay in the list)
    pair_list = generate_selection_pairs(selection_index, source_tag_names, target_tags)
    source_target_pair = pair_list[selection_index % len(pair_list)]
    source_tag_name = source_tag_names[source_target_pair[0]]
    source_axis = source_axes[source_target_pair[0]]
    source_source_guide = source_source_guides[source_target_pair[0]]
    target_axis = target_axes.pop(source_target_pair[1])
    target_guide = target_guides.pop(source_target_pair[1])
    target_tag = target_tags.pop(source_target_pair[1])
    
    print "Source tag: "
    print source_tag_name
    
    #Relevant source info to be transformed and converted into new targets
    #As above, don't pop source items b/c user can change selection (so items need to stay in the list)
    #Note: Try to keep in mind that each tag has a name (i.e. the type of block connector it is) and the tag itself (i.e. which other tag names it accepts)
    temp_source_tag_names = ['arc_tube1', 'arc_plug1_a', 'arc_plug1_b', 'arc_plug2']
    temp_source_tags = [tag_arc_tube1, tag_arc_plug1_a, tag_arc_plug1_b, tag_arc_plug2]
    temp_source_axes = [tube1_axis, plug1_a_axis, plug1_b_axis, plug2_axis]
    temp_source_guides = [tube1_guide_target, plug1_a_guide_target, plug1_b_guide_target, plug2_guide_target]
    source_tags_remaining = []
    source_axes_remaining = []
    source_guides_remaining = []
    
    for i, tag in enumerate(temp_source_tag_names):
        if tag == source_tag_name:
            pass
        else:
            source_tags_remaining.append(temp_source_tags[i])
            source_axes_remaining.append(temp_source_axes[i])
            source_guides_remaining.append(temp_source_guides[i])
    
    
    
    #Orient target geometry to source geometry
    returned_objects = orient3d(arc, source_axis, source_source_guide, source_axes_remaining, source_guides_remaining, target_axis, target_guide)
    arc = returned_objects[0]
    source_axes_remaining = returned_objects[1]
    source_guides_remaining = returned_objects[2]
    
    #Modify master lists (blocks, planes, tags)
    print "Adding Arc"
    blocks.append(arc)
    for i in range(len(source_tags_remaining)):
        target_tags.append(source_tags_remaining[i])
        target_axes.append(source_axes_remaining[i])
        target_guides.append(source_guides_remaining[i])
    
    #Create next block
    count += 1
    next_block(blocks, target_axes, target_guides, target_tags, count, nib_sequence)


def wedge(blocks, target_axes, target_guides, target_tags, count, nib_sequence):
    #Inputs
    data = inputs_wedge[0]
    source_axes = inputs_wedge[1]
    source_tags = inputs_wedge[2]
    try:
        selection_index = selection_list[count]
    except:
        selection_index = 0
    
    #Define Geometry
    #Make duplicates or else recomputing will continuously modify planes
    wedge = data[0].Duplicate()
    plane_wedge_plug1 = rg.Plane(data[1])
    plane_wedge_plug2 = rg.Plane(data[2])
    plane_wedge_tube2 = rg.Plane(data[3])
    
    #Determine source and target planes
    pair_list = generate_selection_pairs(selection_index, source_tags, target_tags)
    source_target_pair = pair_list[selection_index % len(pair_list)]
    source_plane = source_axes[source_target_pair[0]]
    source_tag = source_tags[source_target_pair[0]]
    target_axis = target_axes.pop(source_target_pair[1])
    target_tag = target_tags.pop(source_target_pair[1])
    
    #Transform (geometry must be defined first so that transform happens in place)
    orient = rg.Transform.PlaneToPlane(source_plane, target_axis)
    wedge.Transform(orient)
    plane_wedge_plug1.Transform(orient)
    plane_wedge_plug2.Transform(orient)
    plane_wedge_tube2.Transform(orient)
    
    #Modify master lists (blocks, planes, tags)
    print "Adding Wedge"
    blocks.append(wedge)
    temp_list_target_axes = [plane_wedge_plug1, plane_wedge_plug2, plane_wedge_tube2]
    temp_list_target_tags = [tag_wedge_plug1, tag_wedge_plug2, tag_wedge_tube2]
    temp_list_source_tags = ["wedge_plug1", "wedge_plug2", "wedge_tube2"]
    
    for i, tag in enumerate(temp_list_source_tags):
        if tag == source_tag:
            pass
        else:
            target_axes.append(temp_list_target_axes[i])
            target_tags.append(temp_list_target_tags[i])
    
    #Create next block
    count += 1
    next_block(blocks, target_axes, target_tags, count, nib_sequence)


def nib(blocks, target_axes, target_guides, target_tags, count, nib_sequence):
    #Inputs
    data = inputs_nib[0]
    source_axes = inputs_nib[1]
    source_tags = inputs_nib[2]
    try:
        selection_index = selection_list[count]
    except:
        selection_index = 0
    
    #Define Geometry
    #Make duplicates or else recomputing will continuously modify planes
    nib_brep = data[0].Duplicate()
    nib_pt = rg.Point3d(data[1])
    
    #Determine source and target planes
    pair_list = generate_selection_pairs(selection_index, source_tags, target_tags)
    source_target_pair = pair_list[selection_index % len(pair_list)]
    source_plane = source_axes[source_target_pair[0]]
    source_tag = source_tags[source_target_pair[0]]
    target_axis = target_axes.pop(source_target_pair[1])
    target_tag = target_tags.pop(source_target_pair[1])
    
    #Transform (geometry must be defined first so that transform happens in place)
    orient = rg.Transform.PlaneToPlane(source_plane, target_axis)
    nib_brep.Transform(orient)
    nib_pt.Transform(orient)
    
    #Modify master lists (blocks, planes, tags)
    print "Adding Nib"
    blocks.append(nib_brep)
    
    #If Nib is placed in Tube 2/3, then we have to ammend the corresponding Tube 2/3 outer plane tag so that a Tube 1 can't be placed over it (but a Wedge or Snap still could)
    #Step 1: confirm target is Tube 2/3
    if target_tag == "nib_tube2_a" or target_tag == "nib_tube2_b":
        #Step 2: confirm which outer plane (if any) still available
        if target_tags[source_target_pair[1] - 1] == tag_tube2_a_outer or target_tags[source_target_pair[1] - 1] == tag_tube2_b_outer or target_tags[source_target_pair[1] - 1] == tag_tube3_a_outer or target_tags[source_target_pair[1] - 1] == tag_tube3_b_outer:
            #Step 3: ammend tag
            target_tags[source_target_pair[1] - 1] = "wedge_tube2, sliver_tube2, snap1_tube2_a, snap1_tube2_b, snap2_tube2_a, snap2_tube2_b, snap3_tube2"
    
    #Add nib_pt to traces_points
    if rotation_angle == 0:
        trace_point = [nib_pt]
        traces_points.append(trace_point)
    else:
        traces_points[nib_sequence].append(nib_pt)
    nib_sequence += 1
    
    #Create next block
    count += 1
    next_block(blocks, target_axes, target_tags, count, nib_sequence)


#----------Run Script-----------------------------------------------------------------------------------------------------------------------------------------------


def get_edges(blocks):
    block_edges = []
    for block in blocks:
        for edge in block.Edges:
            block_edges.append(edge)
    return block_edges

def get_meshes(blocks):
    block_meshes = []
    for block in blocks:
        block_mesh = rg.Mesh.CreateFromBrep(block)
        for mesh in block_mesh:
            block_meshes.append(mesh)
    return block_meshes


if not run:
    #Build machine
    blocks = base()
#    block_edges = get_edges(blocks)
#    block_meshes = get_meshes(blocks)
else:
    #Run machine
    for i in range(91):
        rotation_angle = i * 0.0698132 #Convert to radians (i = 4 degrees)
        blocks = base()
#        block_edges = get_edges(blocks)
#        block_meshes = get_meshes(blocks)
    for point_list in traces_points:
        trace = rg.Curve.CreateControlPointCurve(point_list)
        traces_lines.append(trace)
# ---------- end python_13 ----------
number_slider_24 = Slider(10, range=0..10)  # disabled
previewlw = CustomPreviewLineweights(
    Geometry=crv_guide_2,
    Shader={diffuse=RGB(255, 105, 180), emission=RGB(76, 32, 54), shine=0.5, specular=RGB(255, 255, 255), transparency=0},
    Thickness=number_slider_20,
    Absolute=False)  # disabled
merge_64 = Merge(
    Data1=Slider(0, range=0..20),
    Data2=Slider(4, range=0..20),
    Data3=Slider(0, range=0..20),
    Data4=Slider(5, range=0..20),
    Data5=Slider(2, range=0..20),
    Data6=Slider(1, range=0..20),
    Data7=Slider(11, range=0..20),
    Data8=Slider(2, range=0..20),
    Data9=Slider(3, range=0..20),
    Data10=Slider(4, range=0..20))
merge_65 = Merge(
    Data1=list_106,
    Data2=list_104,
    Data3=list_105,
    Data4=list_107,
    Data5=list_109,
    Data6=list_108,
    Data7=list_110,
    Data8=list_111,
    Data9=list_112,
    Data10=list_113)
number_slider_25 = Slider(170.4, range=-360..359)  # disabled
rotate_4 = Rotate(Geometry=crv_guide_2, Angle=degrees(number_slider_25), Plane=pt_45)  # -> Geometry, Transform; disabled
id_2 = Guid(geo_2)  # disabled
dprod = DotProduct(VectorA=crv_guide_2, VectorB=rotate_4.Geometry, Unitize=False)  # disabled
xprod = CrossProduct(VectorA=crv_guide_2, VectorB=rotate_4.Geometry, Unitize=False)  # -> Vector, Length; disabled
angle = Angle(VectorA=crv_guide_2, VectorB=rotate_4.Geometry)  # -> Angle, Reflex; disabled
range = Range(Domain=Domain(0, 1), Steps=Slider(737, range=0..1000))
panel_8 = Panel(id_2)  # disabled
panel_9 = Panel(angle.Angle)  # disabled
panel_10 = Panel(xprod.Vector)  # disabled
lng = ListLength(List=block_list_11)
item_6 = ListItem(List=ma.PartialResults, Index=Slider(0, range=0..3687), Wrap=True)
previewlw_2 = CustomPreviewLineweights(
    Geometry=rotate_4.Geometry,
    Shader={diffuse=RGB(255, 105, 180), emission=RGB(76, 32, 54), shine=0.5, specular=RGB(255, 255, 255), transparency=0},
    Thickness=number_slider_20,
    Absolute=False)  # disabled
panel_11 = Panel(dprod)  # disabled
crv_17 = Curve(python_12.b)  # disabled
end = EndPoints(Curve=crv_17)  # -> Start, End; disabled
dup = DuplicateData(Data=range, Number=Slider(5, range=0..10), Order=True)
panel_12 = Panel(dup)
panel_13 = Panel(python_12.out)  # disabled
pt_46 = Point(end.Start)  # disabled
dom = ConstructDomain(DomainStart=0, DomainEnd=expr("x-1", lng))
dom_2 = ConstructDomain(DomainStart=0, DomainEnd=Slider(100, range=0..100))

# ---- group: Add Nibs last
division = Division(A=number_slider_22, B=Slider(8, range=0..10))
int = Integer(division)
random = Random(Range=dom_2, Number=int, Seed=Slider(0, range=0..10), Integers=True)
repeat_2 = RepeatData(Data="Nib", Length=int)

# ----
selection_list_10 = Data(merge_64)
previewlw_3 = CustomPreviewLineweights(
    Geometry=crv_17,
    Shader={diffuse=RGB(255, 105, 180), emission=RGB(76, 32, 54), shine=0.5, specular=RGB(255, 255, 255), transparency=0},
    Thickness=number_slider_24,
    Absolute=False)  # disabled
angle_2 = Angle(VectorA=rotate.Geometry, VectorB=crv_17)  # -> Angle, Reflex; disabled
block_list_12 = Data(merge_65)
merge_66 = Merge(Data1=flatten(dup), Data2=flatten("1"))
panel_14 = Panel(python_13.out)  # disabled
num_angle = Number(item_6)
geo_3 = Geometry(python_13.blocks)  # disabled
number_slider_26 = Slider(1, range=0..1)
random_2 = Random(Range=dom, Number=number_slider_22, Seed=number_slider_23, Integers=True)
random_3 = Random(Range=dom_2, Number=number_slider_22, Seed=number_slider_23, Integers=True)
panel_15 = Panel(python_12.b)  # disabled
panel_16 = Panel(angle_2.Angle)  # disabled
swatch = ColourSwatch(SwatchColor=RGB(255, 255, 255))  # disabled
selection_list_11 = Data(selection_list_10)
block_list_13 = Data(block_list_12)
item_7 = ListItem(List=merge_66, Index=num_angle, Wrap=True)
item_8 = ListItem(List=block_list_11, Index=random_2, Wrap=True)
crv_18 = Curve(reparameterize(<curve referenced from the Rhino model>))
preview = CustomPreview(Geometry=geo_3, Material=swatch)  # disabled
eval = EvaluateCurve(Curve=crv_18, Parameter=item_7)  # -> Point, Tangent, Angle
pt_47 = ConstructPoint(XCoordinate=0, YCoordinate=0, ZCoordinate=Slider(295, range=0..1000))
rad = Radians(Degrees=num_angle)
merge_67 = Merge(Data1=item_8, Data2=repeat_2)
larger = LargerThan(FirstNumber=num_angle, SecondNumber=0)  # -> LargerThan, OrEqualTo
merge_68 = Merge(Data1=random_3, Data2=random)
num_rotation_2 = Number(rad)

# ---- group: Clear undo to prevent memory leak
python_14 = PythonScript(x=larger.OrEqualTo)  # -> out, a
# ---------- python_14: Python ----------
import rhinoscriptsyntax as rs

if x == True:
    rs.Command('clearUndo')
else:
    pass
# ---------- end python_14 ----------

# ----
selection_list_12 = Data(merge_68)
block_list_14 = Data(merge_67)
Z = UnitZ(Factor=1)
panel_17 = Panel(block_list_14)
setcam = SetCamera(
    CameraLocation=eval.Point,
    TargetLocation=pt_47,
    LensLength=Slider(100, range=0..10000),
    UpDirection=Z,
    Activate=Toggle(True))
selection_list_13 = Data(selection_list_11)
block_list_15 = Data(block_list_13)
swatch_2 = ColourSwatch(SwatchColor=RGB(119, 255, 0))
swatch_3 = ColourSwatch(SwatchColor=RGB(255, 212, 0))
swatch_4 = ColourSwatch(SwatchColor=RGB(255, 110, 0))
swatch_5 = ColourSwatch(SwatchColor=RGB(119, 0, 255))
previewlw_4 = CustomPreviewLineweights(Shader=ColourSwatch(SwatchColor=RGB(255, 0, 111)), Absolute=False)
previewlw_5 = CustomPreviewLineweights(Shader=ColourSwatch(SwatchColor=RGB(0, 217, 255)), Absolute=False)
python_15 = GhPythonScript(
    run=Toggle(False),
    rotation_angle=num_rotation_2,
    block_list=block_list_15,
    selection_list=selection_list_13,
    inputs_base=data_inputs,
    inputs_tube1=data_inputs_2,
    inputs_tube2=data_inputs_3,
    inputs_tube3=data_inputs_4,
    inputs_snap1=data_inputs_7,
    inputs_snap2=data_inputs_5,
    inputs_snap3=data_inputs_6,
    inputs_wedge=data_inputs_8,
    inputs_arc=data_inputs_10,
    inputs_nib=data_inputs_9)  # -> out, blocks, block_meshes, block_edges, traces_lines, points; inputs run: Boolean, block_list: list, selection_list: list of Int32, inputs_base: list, inputs_tube1: list, inputs_tube2: list, inputs_tube3: list, inputs_snap1: list, inputs_snap2: list, inputs_snap3: list, inputs_wedge: list, inputs_arc: list, inputs_sliver: list, inputs_nib: list
# ---------- python_15: Python ----------
__author__ = "jason"
__version__ = "2020.02.05"

import Rhino
import System
import Rhino.Geometry as rg
from Grasshopper.Kernel.Data import GH_Path
from Grasshopper import DataTree

traces_points = []
traces_lines = []
manual_points = DataTree[object]()

#Inputs
global rotation_angle
global block_list
global selection_list
global inputs_base
global inputs_tube1
global inputs_tube2
global inputs_tube3
global inputs_snap1
global inputs_snap2
global inputs_snap3
global inputs_wedge
global inputs_arc
global inputs_sliver
global inputs_nib

global nib_item
global traces_points
global traces_lines

#----------Geometry Inputs----------------------------------------------------------------------------------------------------------

global tag_tube1_a_outer
global tag_tube1_a_inner
global tag_tube1_b_outer
global tag_tube1_b_inner

global tag_tube2_a_outer
global tag_tube2_a_inner
global tag_tube2_b_outer
global tag_tube2_b_inner

global tag_tube3_a_outer
global tag_tube3_a_inner
global tag_tube3_b_outer
global tag_tube3_b_inner

global tag_snap1_tube2_a
global tag_snap1_tube2_b

global tag_snap2_tube2_a
global tag_snap2_tube2_b

global tag_snap3_tube1
global tag_snap3_tube2

global arc_geo
global arc_plug1_a_normal
global arc_plug1_b_normal
global arc_plug2_normal
global arc_tube1_normal


guid_wedge = System.Guid.Parse('eb296063-3d52-4b88-9eb2-cfd48d1ac48d')
guid_wedge_normal = System.Guid.Parse('e9ad7953-3d01-4a29-8a1f-b1ccf05097d3')
guid_arc = System.Guid.Parse('6c7ffd52-cabd-4e25-974e-585b6c76012d')
guid_arc_normal = System.Guid.Parse('f79be8d4-32a7-47b4-9e8b-3040f41ef409')


for rObj in Rhino.RhinoDoc.ActiveDoc.Objects:
    if rObj.Id == guid_wedge: wedge = rObj.Geometry
    elif rObj.Id == guid_wedge_normal: wedge_normal = rObj.Geometry
    elif rObj.Id == guid_arc: arc = rObj.Geometry
    elif rObj.Id == guid_arc_normal: arc_normal = rObj.Geometry



#----------Tags----------------------------------------------------------------------------------------------------------

global tag_tube1_a_outer
global tag_tube1_a_inner
global tag_tube1_b_outer
global tag_tube1_b_inner

global tag_tube2_a_outer
global tag_tube2_a_inner
global tag_tube2_b_outer
global tag_tube2_b_inner

global tag_tube3_a_outer
global tag_tube3_a_inner
global tag_tube3_b_outer
global tag_tube3_b_inner

global tag_snap1_tube2_a
global tag_snap1_tube2_b

global tag_snap2_tube2_a
global tag_snap2_tube2_b

global tag_snap3_tube1
global tag_snap3_tube2

global tag_arc_plug1_a
global tag_arc_plug1_b
global tag_arc_plug2
global tag_arc_tube1

global tag_wedge_plug1
global tag_wedge_plug2
global tag_wedge_tube2

global tag_nib_plug
global tag_nib_tube1_a
global tag_nib_tube1_b
global tag_nib_tube2_a
global tag_nib_tube2_b
global tag_nib_snap

tag_tube1_a_outer = "arc_tube1, sliver_tube1, snap3_tube1" 
tag_tube1_a_inner = "tube2_b_outer, tube3_b_outer, nib_tube1_a"
tag_tube1_b_outer = "arc_tube1, sliver_tube1, snap3_tube1"
tag_tube1_b_inner = "tube2_a_outer, tube3_a_outer, nib_tube1_b"

tag_tube2_a_outer = "wedge_tube2, sliver_tube2, tube1_b_inner, snap1_tube2_a, snap1_tube2_b, snap2_tube2_a, snap2_tube2_b, snap3_tube2"
tag_tube2_a_inner = "nib_tube2_a"
tag_tube2_b_outer = "wedge_tube2, sliver_tube2, tube1_a_inner, snap1_tube2_a, snap1_tube2_b, snap2_tube2_a, snap2_tube2_b, snap3_tube2"
tag_tube2_b_inner = "nib_tube2_b"

#This is a little wonky, but tube3 accepts tube 2 tags (b/c those targets share the same locations)
tag_tube3_a_outer = "wedge_tube2, sliver_tube2, tube1_b_inner, snap1_tube2_a, snap1_tube2_b, snap2_tube2_a, snap2_tube2_b, snap3_tube2"
tag_tube3_a_inner = "nib_tube2_a"
tag_tube3_b_outer = "wedge_tube2, sliver_tube2, tube1_a_inner, snap1_tube2_a, snap1_tube2_b, snap2_tube2_a, snap2_tube2_b, snap3_tube2"
tag_tube3_b_inner = "nib_tube2_b"

tag_snap1_tube2_a = "tube2_a_outer, tube2_b_outer, tube3_a_outer, tube3_b_outer, nib_snap_a, nib_snap_b"
tag_snap1_tube2_b = "tube2_a_outer, tube2_b_outer, tube3_a_outer, tube3_b_outer, nib_snap_a, nib_snap_b"

tag_snap2_tube2_a = "tube2_a_outer, tube2_b_outer, tube3_a_outer, tube3_b_outer, nib_snap_a, nib_snap_b"
tag_snap2_tube2_b = "tube2_a_outer, tube2_b_outer, tube3_a_outer, tube3_b_outer, nib_snap_a, nib_snap_b"

tag_snap3_tube1 = "tube1_a_outer, tube1_b_outer"
tag_snap3_tube2 = "tube2_a_outer, tube2_b_outer, tube3_a_outer, tube3_b_outer, nib_snap_a, nib_snap_b"

tag_arc_plug1_a = "arc_plug1_a, arc_plug1_b, sliver_plug1, wedge_plug1"
tag_arc_plug1_b = "arc_plug1_a, arc_plug1_b, sliver_plug1, wedge_plug1"
tag_arc_plug2 = "nib_plug2_a, nib_plug2_b"
tag_arc_tube1 = "tube1_a_outer, tube1_b_outer"

tag_wedge_plug1 = "arc_plug1_a, arc_plug1_b, sliver_plug1, wedge_plug1"
tag_wedge_plug2 = "nib_plug2_a, nib_plug2_b"
tag_wedge_tube2 = "tube2_a_outer, tube2_b_outer, tube3_a_outer, tube3_b_outer"

tag_nib_plug2_a = "arc_plug2, sliver_plug2, wedge_plug2"
tag_nib_plug2_b = "arc_plug2, sliver_plug2, wedge_plug2"
tag_nib_tube1_a = "tube1_a_inner"
tag_nib_tube1_b = "tube1_b_inner"
tag_nib_tube2_a = "tube2_a_inner, tube3_a_inner"
tag_nib_tube2_b = "tube2_a_inner, tube3_a_inner"
tag_nib_snap_a = "snap1_tube2_a, snap1_tube2_b, snap2_tube2_a, snap2_tube2_b, snap3_tube2"
tag_nib_snap_b = "snap1_tube2_a, snap1_tube2_b, snap2_tube2_a, snap2_tube2_b, snap3_tube2"


#----------Block Definitions----------------------------------------------------------------------------------------------------------


def generate_selection_pairs(selection, source_tags, target_tags):
    #Generate list of tuples containing indices for all permutations of available source/target pairs
    pair_list = []
    
    for i, target_tag in enumerate(target_tags):
        for j, source_tag in enumerate(source_tags):
            if source_tag in target_tag.split(", "):
                pair_list.append((j, i))
    
    return pair_list


def next_block(blocks, target_planes, target_tags, count, nib_item):
    
    
    if len(block_list) > count:
        block = block_list[count]
        
        if block_list[count] == "Tube 1":
            try:
                tube1(blocks, target_planes, target_tags, count, nib_item)
            except:
                count += 1
                next_block(blocks, target_planes, target_tags, count, nib_item)
        
        elif block_list[count] == "Tube 2":
            try:
                tube2(blocks, target_planes, target_tags, count, nib_item)
            except:
                count += 1
                next_block(blocks, target_planes, target_tags, count, nib_item)
        
        elif block_list[count] == "Tube 3":
            try:
                tube3(blocks, target_planes, target_tags, count, nib_item)
            except:
                count += 1
                next_block(blocks, target_planes, target_tags, count, nib_item)
        
        elif block_list[count] == "Snap 1":
            try:
                snap1(blocks, target_planes, target_tags, count, nib_item)
            except:
                count += 1
                next_block(blocks, target_planes, target_tags, count, nib_item)
        
        elif block_list[count] == "Snap 2":
            try:
                snap2(blocks, target_planes, target_tags, count, nib_item)
            except:
                count += 1
                next_block(blocks, target_planes, target_tags, count, nib_item)
        
        elif block_list[count] == "Snap 3":
            try:
                snap3(blocks, target_planes, target_tags, count, nib_item)
            except:
                count += 1
                next_block(blocks, target_planes, target_tags, count, nib_item)
        
        elif block_list[count] == "Arc":
            try:
                arc(blocks, target_planes, target_tags, count, nib_item)
            except:
                count += 1
                next_block(blocks, target_planes, target_tags, count, nib_item)
        
        elif block_list[count] == "Sliver":
            
            try:
                sliver(blocks, target_planes, target_tags, count, nib_item)
            except:
                count +=1 
                next_block(blocks, target_planes, target_tags, count, nib_item)
        
        elif block_list[count] == "Wedge":
            try:
                wedge(blocks, target_planes, target_tags, count, nib_item)
            except:
                count += 1
                next_block(blocks, target_planes, target_tags, count, nib_item)
        
        elif block_list[count] == "Nib":
            try:
                nib(blocks, target_planes, target_tags, count, nib_item)
            except:
                count += 1
                next_block(blocks, target_planes, target_tags, count, nib_item)
        
        else:
            print "Block does not exist."
            count += 1
            next_block(blocks, target_planes, target_tags, count, nib_item)
        
    else:
        #print "Done"
        return blocks


def base():
    #Define geometry
    sphere = inputs_base[0]
    tube = inputs_base[1]
    axis = inputs_base[2]
    
    #Make duplicates of initial plane or else recomputing will continuously modify planes
    plane_tube1_a_outer = rg.Plane(inputs_base[3]) #For attaching blocks
    plane_tube1_a_inner = rg.Plane(inputs_base[4]) #For inserting Tube2
    
    #Transform
    axis_vector = rg.Vector3d(axis.PointAtEnd - axis.PointAtStart)
    rotation = rg.Transform.Rotation(rotation_angle, axis_vector, axis.PointAtEnd)
    sphere.Transform(rotation)
    tube.Transform(rotation)
    plane_tube1_a_outer.Transform(rotation)
    plane_tube1_a_inner.Transform(rotation)
    
    #Modify master lists (blocks, target_planes, target_tags)
    nib_item = 0
    blocks = []
    target_planes = []
    target_tags = []
    
    blocks.append(sphere)
    blocks.append(tube)
    
    target_planes.append(plane_tube1_a_outer)
    target_planes.append(plane_tube1_a_inner)
    target_tags.append(tag_tube1_a_outer)
    target_tags.append(tag_tube1_a_inner)
    
    count = 0
    
    next_block(blocks, target_planes, target_tags, count, nib_item)
    
    return blocks


def tube1(blocks, target_planes, target_tags, count, nib_item):
    #Inputs
    data = inputs_tube1[0]
    source_planes = inputs_tube1[1]
    source_tags = inputs_tube1[2]
    
    try:
        selection_index = selection_list[count]
    except:
        selection_index = 0 #0 is default value if no selection provided
    
    #Define Geometry
    #Make duplicates or else recomputing will continuously modify planes
    tube1 = data[0].Duplicate()
    plane_tube1_a_outer = rg.Plane(data[1])
    plane_tube1_a_inner = rg.Plane(data[2])
    plane_tube1_b_outer = rg.Plane(data[3])
    plane_tube1_b_inner = rg.Plane(data[4])
    
    #Determine source and target planes
    pair_list = generate_selection_pairs(selection_index, source_tags, target_tags)
    source_target_pair = pair_list[selection_index % len(pair_list)]
    source_plane = source_planes[source_target_pair[0]]
    source_tag_choice = source_tags[source_target_pair[0]]
    target_plane = target_planes.pop(source_target_pair[1])
    target_tag = target_tags.pop(source_target_pair[1])
    
    #Transform Orientation
    orient = rg.Transform.PlaneToPlane(source_plane, target_plane)
    tube1.Transform(orient)
    plane_tube1_a_outer.Transform(orient)
    plane_tube1_a_inner.Transform(orient)
    plane_tube1_b_outer.Transform(orient)
    plane_tube1_b_inner.Transform(orient)
    
    #Transform Rotation
    axis_vector = rg.Vector3d(plane_tube1_a_outer.Origin - plane_tube1_b_outer.Origin)
    rotation = rg.Transform.Rotation(rotation_angle * 0.9, axis_vector, plane_tube1_b_outer.Origin)
    tube1.Transform(rotation)
    plane_tube1_a_outer.Transform(rotation)
    plane_tube1_a_inner.Transform(rotation)
    plane_tube1_b_outer.Transform(rotation)
    plane_tube1_b_inner.Transform(rotation)
    
    #Modify master lists (blocks, planes, tags)
    #print "Adding Tube 1"
    blocks.append(tube1)
    
    #If Tube 1 is placed on Tube 2/3, then we have to remove the corresponding Tube 2/3 inner plane
    #I.E. you can't place a nib in the end of Tube 2/3 that is already in Tube 1
    if target_tag == tag_tube2_a_outer or target_tag == tag_tube2_b_outer or target_tag == tag_tube3_a_outer or target_tag == tag_tube3_b_outer:
        remove_plane = target_planes.pop(source_target_pair[1]) #Inner plane will always follow the available outer plane
        removve_tag = target_tags.pop(source_target_pair[1]) #Use source_target_pair[1] b/c the index has already been popped, shortening the list, so no need for +1
    
    temp_list_target_planes = [plane_tube1_a_outer, plane_tube1_a_inner, plane_tube1_b_outer, plane_tube1_b_inner]
    temp_list_target_tags = [tag_tube1_a_outer, tag_tube1_a_inner, tag_tube1_b_outer, tag_tube1_b_inner]
    temp_list_source_tags = ["tube1_a_outer", "tube1_a_inner", "tube1_b_outer", "tube1_b_inner"]
    
    for i, tag in enumerate(temp_list_source_tags):
        if tag == source_tag_choice:
            pass
        else:
            target_planes.append(temp_list_target_planes[i])
            target_tags.append(temp_list_target_tags[i])
    
    #Create next block
    count += 1
    next_block(blocks, target_planes, target_tags, count, nib_item)


def tube2(blocks, target_planes, target_tags, count, nib_item):
    #Inputs
    data = inputs_tube2[0]
    source_planes = inputs_tube2[1]
    source_tags = inputs_tube2[2]
    try:
        selection_index = selection_list[count]
    except:
        selection_index = 0
    
    #Define Geometry
    #Make duplicates or else recomputing will continuously modify planes
    tube2 = data[0].Duplicate()
    pt1 = rg.Point3d(data[1])
    pt2 = rg.Point3d(data[2])
    pt3 = rg.Point3d(data[3])
    pt4 = rg.Point3d(data[4])
    plane_tube2_a_outer = rg.Plane(data[5])
    plane_tube2_a_inner = rg.Plane(data[6])
    plane_tube2_b_outer = rg.Plane(data[7])
    plane_tube2_b_inner = rg.Plane(data[8])
    
    #Determine source and target planes
    pair_list = generate_selection_pairs(selection_index, source_tags, target_tags)
    source_target_pair = pair_list[selection_index % len(pair_list)]
    source_plane = source_planes[source_target_pair[0]]
    source_tag_choice = source_tags[source_target_pair[0]]
    target_plane = target_planes.pop(source_target_pair[1])
    target_tag = target_tags.pop(source_target_pair[1])
    
    #Transform Orientation
    orient = rg.Transform.PlaneToPlane(source_plane, target_plane)
    tube2.Transform(orient)
    pt1.Transform(orient)
    pt2.Transform(orient)
    pt3.Transform(orient)
    pt4.Transform(orient)
    plane_tube2_a_outer.Transform(orient)
    plane_tube2_a_inner.Transform(orient)
    plane_tube2_b_outer.Transform(orient)
    plane_tube2_b_inner.Transform(orient)
    
    #Transform Rotation
    if source_tag_choice == "tube2_a_outer":
        axis_vector = rg.Vector3d(pt2 - pt1)
        rotation = rg.Transform.Rotation(rotation_angle * 1.8, axis_vector, pt2)
    else:
        axis_vector = rg.Vector3d(pt3 - pt4)
        rotation = rg.Transform.Rotation(rotation_angle * 1.8, axis_vector, pt3)
    tube2.Transform(rotation)
    plane_tube2_a_outer.Transform(rotation)
    plane_tube2_a_inner.Transform(rotation)
    plane_tube2_b_outer.Transform(rotation)
    plane_tube2_b_inner.Transform(rotation)
    
    #Modify master lists (blocks, planes, tags)
    #print "Adding Tube 2"
    blocks.append(tube2)
    
    #If Tube 2/3 is placed in Tube 1, then that end of Tube 2/3 does not add a tube2_inner plane for that end only
    #I.E. you can't place a nib in the end of Tube 2/3 that is already in Tube 1
    if target_tag == tag_tube1_a_inner:
        temp_list_target_planes = [plane_tube2_a_outer, plane_tube2_a_inner, plane_tube2_b_outer]
        temp_list_target_tags = [tag_tube2_a_outer, tag_tube2_a_inner, tag_tube2_b_outer]
        temp_list_source_tags = ["tube2_a_outer", "tube2_a_inner","tube2_b_outer"]
    elif target_tag == tag_tube1_b_inner:
        temp_list_target_planes = [plane_tube2_a_outer, plane_tube2_b_outer, plane_tube2_b_inner]
        temp_list_target_tags = [tag_tube2_a_outer, tag_tube2_b_outer, tag_tube2_b_inner]
        temp_list_source_tags = ["tube2_a_outer", "tube2_b_outer", "tube2_b_inner"]
    else:
        temp_list_target_planes = [plane_tube2_a_outer, plane_tube2_a_inner, plane_tube2_b_outer, plane_tube2_b_inner]
        temp_list_target_tags = [tag_tube2_a_outer, tag_tube2_a_inner, tag_tube2_b_outer, tag_tube2_b_inner]
        temp_list_source_tags = ["tube2_a_outer", "tube2_a_inner", "tube2_b_outer", "tube2_b_inner"]
    
    for i, tag in enumerate(temp_list_source_tags):
        if tag == source_tag_choice:
            pass
        else:
            target_planes.append(temp_list_target_planes[i])
            target_tags.append(temp_list_target_tags[i])
    
    #Create next block
    count += 1
    next_block(blocks, target_planes, target_tags, count, nib_item)


def tube3(blocks, target_planes, target_tags, count, nib_item):
    #Inputs
    data = inputs_tube3[0]
    source_planes = inputs_tube3[1]
    source_tags = inputs_tube3[2]
    try:
        selection_index = selection_list[count]
    except:
        selection_index = 0
    
    #Define Geometry
    #Make duplicates or else recomputing will continuously modify planes
    tube3 = data[0].Duplicate()
    pt1 = rg.Point3d(data[1])
    pt2 = rg.Point3d(data[2])
    pt3 = rg.Point3d(data[3])
    pt4 = rg.Point3d(data[4])
    plane_tube3_a_outer = rg.Plane(data[5])
    plane_tube3_a_inner = rg.Plane(data[6])
    plane_tube3_b_outer = rg.Plane(data[7])
    plane_tube3_b_inner = rg.Plane(data[8])
    
    #Determine source and target planes
    pair_list = generate_selection_pairs(selection_index, source_tags, target_tags)
    source_target_pair = pair_list[selection_index % len(pair_list)]
    source_plane = source_planes[source_target_pair[0]]
    source_tag_choice = source_tags[source_target_pair[0]]
    target_plane = target_planes.pop(source_target_pair[1])
    target_tag = target_tags.pop(source_target_pair[1])
    
    #Transform Orientation
    orient = rg.Transform.PlaneToPlane(source_plane, target_plane)
    tube3.Transform(orient)
    pt1.Transform(orient)
    pt2.Transform(orient)
    pt3.Transform(orient)
    pt4.Transform(orient)
    plane_tube3_a_outer.Transform(orient)
    plane_tube3_a_inner.Transform(orient)
    plane_tube3_b_outer.Transform(orient)
    plane_tube3_b_inner.Transform(orient)
    
    #Transform Rotation
    if source_tag_choice == "tube3_a_outer":
        axis_vector = rg.Vector3d(pt2 - pt1)
        rotation = rg.Transform.Rotation(rotation_angle * 1.8, axis_vector, pt2)
    else:
        axis_vector = rg.Vector3d(pt3 - pt4)
        rotation = rg.Transform.Rotation(rotation_angle * 1.8, axis_vector, pt3)
    tube3.Transform(rotation)
    plane_tube3_a_outer.Transform(rotation)
    plane_tube3_a_inner.Transform(rotation)
    plane_tube3_b_outer.Transform(rotation)
    plane_tube3_b_inner.Transform(rotation)
    
    #Modify master lists (blocks, planes, tags)
    #print "Adding Tube 3"
    blocks.append(tube3)
    
    #If Tube 2/3 is placed in Tube 1, then that end of Tube 2/3 does not add a tube2_inner plane for that end only
    #I.E. you can't place a nib in the end of Tube 2/3 that is already in Tube 1
    if target_tag == tag_tube1_a_inner:
        temp_list_target_planes = [plane_tube3_a_outer, plane_tube3_a_inner, plane_tube3_b_outer]
        temp_list_target_tags = [tag_tube3_a_outer, tag_tube3_a_inner, tag_tube3_b_outer]
        temp_list_source_tags = ["tube3_a_outer", "tube3_a_inner","tube3_b_outer"]
    elif target_tag == tag_tube1_b_inner:
        temp_list_target_planes = [plane_tube3_a_outer, plane_tube3_b_outer, plane_tube3_b_inner]
        temp_list_target_tags = [tag_tube3_a_outer, tag_tube3_b_outer, tag_tube3_b_inner]
        temp_list_source_tags = ["tube3_a_outer", "tube3_b_outer", "tube3_b_inner"]
    else:
        temp_list_target_planes = [plane_tube3_a_outer, plane_tube3_a_inner, plane_tube3_b_outer, plane_tube3_b_inner]
        temp_list_target_tags = [tag_tube3_a_outer, tag_tube3_a_inner, tag_tube3_b_outer, tag_tube3_b_inner]
        temp_list_source_tags = ["tube3_a_outer", "tube3_a_inner", "tube3_b_outer", "tube3_b_inner"]
    
    for i, tag in enumerate(temp_list_source_tags):
        if tag == source_tag_choice:
            pass
        else:
            target_planes.append(temp_list_target_planes[i])
            target_tags.append(temp_list_target_tags[i])
    
    #Create next block
    count += 1
    next_block(blocks, target_planes, target_tags, count, nib_item)


def snap1(blocks, target_planes, target_tags, count, nib_item):
    #Inputs
    data = inputs_snap1[0]
    source_planes = inputs_snap1[1]
    source_tags = inputs_snap1[2]
    try:
        selection_index = selection_list[count]
    except:
        selection_index = 0
    
    #Define Geometry
    #Make duplicates or else recomputing will continuously modify planes
    snap = data[0].Duplicate()
    plane_snap_tube2_a = rg.Plane(data[1])
    plane_snap_tube2_b = rg.Plane(data[2])
    
    #Determine source and target planes
    pair_list = generate_selection_pairs(selection_index, source_tags, target_tags)
    source_target_pair = pair_list[selection_index % len(pair_list)]
    source_plane = source_planes[source_target_pair[0]]
    source_tag_choice = source_tags[source_target_pair[0]]
    target_plane = target_planes.pop(source_target_pair[1])
    target_tag = target_tags.pop(source_target_pair[1])
    
    #Transform (geometry must be defined first so that transform happens in place)
    orient = rg.Transform.PlaneToPlane(source_plane, target_plane)
    snap.Transform(orient)
    plane_snap_tube2_a.Transform(orient)
    plane_snap_tube2_b.Transform(orient)
    
    #Modify master lists (blocks, planes, tags)
    #print "Adding Snap 1"
    blocks.append(snap)
    temp_list_target_planes = [plane_snap_tube2_a, plane_snap_tube2_b]
    temp_list_target_tags = [tag_snap1_tube2_a, tag_snap1_tube2_b]
    temp_list_source_tags = ["snap1_tube2_a", "snap1_tube2_b"]
    
    for i, tag in enumerate(temp_list_source_tags):
        if tag == source_tag_choice:
            pass
        else:
            target_planes.append(temp_list_target_planes[i])
            target_tags.append(temp_list_target_tags[i])
    
    #Create next block
    count += 1
    next_block(blocks, target_planes, target_tags, count, nib_item)


def snap2(blocks, target_planes, target_tags, count, nib_item):
    #Inputs
    data = inputs_snap2[0]
    source_planes = inputs_snap2[1]
    source_tags = inputs_snap2[2]
    try:
        selection_index = selection_list[count]
    except:
        selection_index = 0
    
    #Define Geometry
    #Make duplicates or else recomputing will continuously modify planes
    snap = data[0].Duplicate()
    plane_snap_tube2_a = rg.Plane(data[1])
    plane_snap_tube2_b = rg.Plane(data[2])
    
    #Determine source and target planes
    pair_list = generate_selection_pairs(selection_index, source_tags, target_tags)
    source_target_pair = pair_list[selection_index % len(pair_list)]
    source_plane = source_planes[source_target_pair[0]]
    source_tag_choice = source_tags[source_target_pair[0]]
    target_plane = target_planes.pop(source_target_pair[1])
    target_tag = target_tags.pop(source_target_pair[1])
    
    #Transform (geometry must be defined first so that transform happens in place)
    orient = rg.Transform.PlaneToPlane(source_plane, target_plane)
    snap.Transform(orient)
    plane_snap_tube2_a.Transform(orient)
    plane_snap_tube2_b.Transform(orient)
    
    #Modify master lists (blocks, planes, tags)
    #print "Adding Snap 2"
    blocks.append(snap)
    temp_list_target_planes = [plane_snap_tube2_a, plane_snap_tube2_b]
    temp_list_target_tags = [tag_snap2_tube2_a, tag_snap2_tube2_b]
    temp_list_source_tags = ["snap2_tube2_a", "snap2_tube2_b"]
    
    for i, tag in enumerate(temp_list_source_tags):
        if tag == source_tag_choice:
            pass
        else:
            target_planes.append(temp_list_target_planes[i])
            target_tags.append(temp_list_target_tags[i])
    
    #Create next block
    count += 1
    next_block(blocks, target_planes, target_tags, count, nib_item)


def snap3(blocks, target_planes, target_tags, count, nib_item):
    #Inputs
    data = inputs_snap3[0]
    source_planes = inputs_snap3[1]
    source_tags = inputs_snap3[2]
    try:
        selection_index = selection_list[count]
    except:
        selection_index = 0
    
    #Define Geometry
    #Make duplicates or else recomputing will continuously modify planes
    snap = data[0].Duplicate()
    plane_snap_tube1 = rg.Plane(data[1])
    plane_snap_tube2 = rg.Plane(data[2])
    
    #Determine source and target planes
    pair_list = generate_selection_pairs(selection_index, source_tags, target_tags)
    source_target_pair = pair_list[selection_index % len(pair_list)]
    source_plane = source_planes[source_target_pair[0]]
    source_tag_choice = source_tags[source_target_pair[0]]
    target_plane = target_planes.pop(source_target_pair[1])
    target_tag = target_tags.pop(source_target_pair[1])
    
    #Transform (geometry must be defined first so that transform happens in place)
    orient = rg.Transform.PlaneToPlane(source_plane, target_plane)
    snap.Transform(orient)
    plane_snap_tube1.Transform(orient)
    plane_snap_tube2.Transform(orient)
    
    #Modify master lists (blocks, planes, tags)
    #print "Adding Snap 3"
    blocks.append(snap)
    temp_list_target_planes = [plane_snap_tube1, plane_snap_tube2]
    temp_list_target_tags = [tag_snap3_tube1, tag_snap3_tube2]
    temp_list_source_tags = ["snap3_tube1", "snap3_tube2"]
    
    for i, tag in enumerate(temp_list_source_tags):
        if tag == source_tag_choice:
            pass
        else:
            target_planes.append(temp_list_target_planes[i])
            target_tags.append(temp_list_target_tags[i])
    
    #Create next block
    count += 1
    next_block(blocks, target_planes, target_tags, count, nib_item)


def arc(blocks, target_planes, target_tags, count, nib_item):
    #Inputs
    data = inputs_arc[0]
    source_planes = inputs_arc[1]
    source_tags = inputs_arc[2]
    try:
        selection_index = selection_list[count]
    except:
        selection_index = 0
    
    #Define Geometry
    #Make duplicates or else recomputing will continuously modify planes
    arc = data[0].Duplicate()
    plane_arc_plug1_a = rg.Plane(data[1])
    plane_arc_plug1_b = rg.Plane(data[2])
    plane_arc_plug2 = rg.Plane(data[3])
    plane_arc_tube1 = rg.Plane(data[4])
    
    #Determine source and target planes
    pair_list = generate_selection_pairs(selection_index, source_tags, target_tags)
    source_target_pair = pair_list[selection_index % len(pair_list)]
    source_plane = source_planes[source_target_pair[0]]
    source_tag_choice = source_tags[source_target_pair[0]]
    target_plane = target_planes.pop(source_target_pair[1])
    target_tag = target_tags.pop(source_target_pair[1])
    
    #Transform (geometry must be defined first so that transform happens in place)
    orient = rg.Transform.PlaneToPlane(source_plane, target_plane)
    arc.Transform(orient)
    plane_arc_plug1_a.Transform(orient)
    plane_arc_plug1_b.Transform(orient)
    plane_arc_plug2.Transform(orient)
    plane_arc_tube1.Transform(orient)
    
    #Modify master lists (blocks, planes, tags)
    #print "Adding Arc"
    blocks.append(arc)
    temp_list_target_planes = [plane_arc_plug1_a, plane_arc_plug1_b, plane_arc_plug2, plane_arc_tube1]
    temp_list_target_tags = [tag_arc_plug1_a, tag_arc_plug1_b, tag_arc_plug2, tag_arc_tube1]
    temp_list_source_tags = ["arc_plug1_a", "arc_plug1_b", "arc_plug2","arc_tube1"]
    
    for i, tag in enumerate(temp_list_source_tags):
        if tag == source_tag_choice:
            pass
        else:
            target_planes.append(temp_list_target_planes[i])
            target_tags.append(temp_list_target_tags[i])
    
    #Create next block
    count += 1
    next_block(blocks, target_planes, target_tags, count, nib_item)


def wedge(blocks, target_planes, target_tags, count, nib_item):
    #Inputs
    data = inputs_wedge[0]
    source_planes = inputs_wedge[1]
    source_tags = inputs_wedge[2]
    try:
        selection_index = selection_list[count]
    except:
        selection_index = 0
    
    #Define Geometry
    #Make duplicates or else recomputing will continuously modify planes
    wedge = data[0].Duplicate()
    plane_wedge_plug1 = rg.Plane(data[1])
    plane_wedge_plug2 = rg.Plane(data[2])
    plane_wedge_tube2 = rg.Plane(data[3])
    
    #Determine source and target planes
    pair_list = generate_selection_pairs(selection_index, source_tags, target_tags)
    source_target_pair = pair_list[selection_index % len(pair_list)]
    source_plane = source_planes[source_target_pair[0]]
    source_tag_choice = source_tags[source_target_pair[0]]
    target_plane = target_planes.pop(source_target_pair[1])
    target_tag = target_tags.pop(source_target_pair[1])
    
    #Transform (geometry must be defined first so that transform happens in place)
    orient = rg.Transform.PlaneToPlane(source_plane, target_plane)
    wedge.Transform(orient)
    plane_wedge_plug1.Transform(orient)
    plane_wedge_plug2.Transform(orient)
    plane_wedge_tube2.Transform(orient)
    
    #Modify master lists (blocks, planes, tags)
    #print "Adding Wedge"
    blocks.append(wedge)
    temp_list_target_planes = [plane_wedge_plug1, plane_wedge_plug2, plane_wedge_tube2]
    temp_list_target_tags = [tag_wedge_plug1, tag_wedge_plug2, tag_wedge_tube2]
    temp_list_source_tags = ["wedge_plug1", "wedge_plug2", "wedge_tube2"]
    
    for i, tag in enumerate(temp_list_source_tags):
        if tag == source_tag_choice:
            pass
        else:
            target_planes.append(temp_list_target_planes[i])
            target_tags.append(temp_list_target_tags[i])
    
    #Create next block
    count += 1
    next_block(blocks, target_planes, target_tags, count, nib_item)


def nib(blocks, target_planes, target_tags, count, nib_item):
    #Inputs
    data = inputs_nib[0]
    source_planes = inputs_nib[1]
    source_tags = inputs_nib[2]
    try:
        selection_index = selection_list[count]
    except:
        selection_index = 0
    
    #Define Geometry
    #Make duplicates or else recomputing will continuously modify planes
    nib_brep = data[0].Duplicate()
    nib_pt = rg.Point3d(data[1])
    
    #Determine source and target planes
    pair_list = generate_selection_pairs(selection_index, source_tags, target_tags)
    source_target_pair = pair_list[selection_index % len(pair_list)]
    source_plane = source_planes[source_target_pair[0]]
    source_tag_choice = source_tags[source_target_pair[0]]
    target_plane = target_planes.pop(source_target_pair[1])
    target_tag = target_tags.pop(source_target_pair[1])
    
    #Transform (geometry must be defined first so that transform happens in place)
    orient = rg.Transform.PlaneToPlane(source_plane, target_plane)
    nib_brep.Transform(orient)
    nib_pt.Transform(orient)
    
    #Modify master lists (blocks, planes, tags)
    #print "Adding Nib"
    blocks.append(nib_brep)
    
    #If Nib is placed in Tube 2/3, then we have to ammend the corresponding Tube 2/3 outer plane tag so that a Tube 1 can't be placed over it (but a Wedge or Snap still could)
    #Step 1: confirm target is Tube 2/3
    if target_tag == "nib_tube2_a" or target_tag == "nib_tube2_b":
        #Step 2: confirm which outer plane (if any) still available
        if target_tags[source_target_pair[1] - 1] == tag_tube2_a_outer or target_tags[source_target_pair[1] - 1] == tag_tube2_b_outer or target_tags[source_target_pair[1] - 1] == tag_tube3_a_outer or target_tags[source_target_pair[1] - 1] == tag_tube3_b_outer:
            #Step 3: ammend tag
            target_tags[source_target_pair[1] - 1] = "wedge_tube2, sliver_tube2, snap1_tube2_a, snap1_tube2_b, snap2_tube2_a, snap2_tube2_b, snap3_tube2"
    
    #Add nib_pt to traces_points
    
    if not run:
        path = GH_Path(nib_item)
        manual_points.Add(nib_pt, path)
    
    if rotation_angle == 0:
        trace_point = [nib_pt]
        traces_points.append(trace_point)
    else:
        traces_points[nib_item].append(nib_pt)
    nib_item += 1     
    
    #nib_item refers to reach individual nib
    #traces_points is a list of lists, and each list contains the points for a particular nib
    #note how the initial point for each nib (when rotation_angle == 0) is added to traces_points as [nib_pt]
    #so nib_item locates that particular nib
    
    #Create next block
    count += 1
    next_block(blocks, target_planes, target_tags, count, nib_item)


#----------Run Script-----------------------------------------------------------------------------------------------------------------------------------------------


def get_edges(blocks):
    block_edges = []
    for block in blocks:
        for edge in block.Edges:
            block_edges.append(edge)
    return block_edges

def get_meshes(blocks):
    block_meshes = []
    for block in blocks:
        block_mesh = rg.Mesh.CreateFromBrep(block)
        for mesh in block_mesh:
            block_meshes.append(mesh)
    return block_meshes

if not run:
    #Build machine
    blocks = base()
    block_edges = get_edges(blocks)
    block_meshes = get_meshes(blocks)
    points = manual_points
    
else:
    #Run machine
    for i in range(721):
        rotation_angle = i * 0.0698132 #Convert to radians (i = 4 degrees)
        blocks = base()
        block_edges = get_edges(blocks)
        block_meshes = get_meshes(blocks)
    for point_list in traces_points:
        trace = rg.Curve.CreateControlPointCurve(point_list)
        
        
        print "# Points: ", len(point_list)
        
        
        
        traces_lines.append(trace)
# ---------- end python_15 ----------
panel_18 = Panel(python_15.out)
pt_48 = Point(python_15.points)
mesh_2 = Mesh(python_15.block_meshes)
crv_19 = Curve(python_15.block_edges)
item_9 = ListItem(List=pt_48, Index=0, Wrap=True)  # -> Item, Item1

rec = DataRecorder(item_9.Item, DataLimit=-10, RecordData=True)
rec_2 = DataRecorder(item_9.Item1, DataLimit=-10, RecordData=True)

preview_2 = CustomPreview(Geometry=mesh_2, Material=ColourSwatch(SwatchColor=RGB(255, 255, 255)))
previewlw_6 = CustomPreviewLineweights(Geometry=crv_19, Shader=ColourSwatch(SwatchColor=RGB(117, 117, 117)), Absolute=False)
pt_49 = Point([Point(-5.912899092, 350.2584134, 276.859414), Point(-5.933829602, 350.2583318, 276.862979), Point(-5.980101379, 350.2581469, 276.8708602), Point(-6.060995048, 350.2578083, 276.8846385), Point(-6.185388058, 350.2572498, 276.9058263), Point(-6.361803692, 350.2563792, 276.9358759)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])
pt_50 = Point([Point(6.203971572, 124.7480539, 108.9250112), Point(6.199132126, 124.7459002, 108.9246324), Point(6.188434365, 124.7411386, 108.9237951), Point(6.169735425, 124.7328126, 108.9223322), Point(6.140989344, 124.720005, 108.9200845), Point(6.100237786, 124.7018324, 108.9169009)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])
lng_2 = ListLength(List=pt_50)
panel_19 = Panel(lng_2)

# ---- group: Doesn't work the way you'd expect...
list_114 = ValueList({"Tube 1", "Tube 2", "Tube 3", "Snap 1", "Snap 2", "Snap 3", "Arc", "Sliver", "Wedge", "Nib"}, selected="Nib")
list_115 = ValueList({"Tube 1", "Tube 2", "Tube 3", "Snap 1", "Snap 2", "Snap 3", "Arc", "Sliver", "Wedge", "Nib"}, selected="Tube 3")
list_116 = ValueList({"Tube 1", "Tube 2", "Tube 3", "Snap 1", "Snap 2", "Snap 3", "Arc", "Sliver", "Wedge", "Nib"}, selected="Snap 2")
list_117 = ValueList({"Tube 1", "Tube 2", "Tube 3", "Snap 1", "Snap 2", "Snap 3", "Arc", "Sliver", "Wedge", "Nib"}, selected="Tube 2")
list_118 = ValueList({"Tube 1", "Tube 2", "Tube 3", "Snap 1", "Snap 2", "Snap 3", "Arc", "Sliver", "Wedge", "Nib"}, selected="Nib")
merge_69 = Merge(Data1=list_115, Data2=list_116, Data3=list_117, Data4=list_118, Data5=list_114)
merge_70 = Merge(
    Data1=Slider(0, range=0..20),
    Data2=Slider(0, range=0..20),
    Data3=Slider(0, range=0..20),
    Data4=Slider(1, range=0..20),
    Data5=Slider(1, range=0..20))

# ----
merge_71 = Merge(
    Data1=ColourSwatch(SwatchColor=RGB(255, 212, 0)),
    Data2=ColourSwatch(SwatchColor=RGB(119, 255, 0)),
    Data3=ColourSwatch(SwatchColor=RGB(0, 217, 255)),
    Data4=ColourSwatch(SwatchColor=RGB(255, 0, 111)),
    Data5=ColourSwatch(SwatchColor=RGB(119, 0, 255)),
    Data6=ColourSwatch(SwatchColor=RGB(255, 110, 0)))

culln = CullNth(List=pt_49, CullFrequency=panel_19)
culln_2 = CullNth(List=pt_50, CullFrequency=panel_19)
bang = ExplodeTree(Data=rec)  # -> Branch0, Branch1
bang_2 = ExplodeTree(Data=rec_2)  # -> Branch0, Branch1
intcrv = Interpolate(Vertices=bang_2.Branch0, Degree=3, Periodic=False, KnotStyle=1)  # -> Curve, Length, Domain
intcrv_2 = Interpolate(Vertices=bang.Branch0, Degree=3, Periodic=False, KnotStyle=1)  # -> Curve, Length, Domain
crv_20 = Curve(flatten(python_15.traces_lines))

# ---- group: Why aren't tubes straight?
list_119 = ValueList({"Tube 1", "Tube 2", "Tube 3", "Snap 1", "Snap 2", "Snap 3", "Arc", "Sliver", "Wedge", "Nib"}, selected="Wedge")
list_120 = ValueList({"Tube 1", "Tube 2", "Tube 3", "Snap 1", "Snap 2", "Snap 3", "Arc", "Sliver", "Wedge", "Nib"}, selected="Tube 1")
list_121 = ValueList({"Tube 1", "Tube 2", "Tube 3", "Snap 1", "Snap 2", "Snap 3", "Arc", "Sliver", "Wedge", "Nib"}, selected="Tube 2")
list_122 = ValueList({"Tube 1", "Tube 2", "Tube 3", "Snap 1", "Snap 2", "Snap 3", "Arc", "Sliver", "Wedge", "Nib"}, selected="Snap 3")
list_123 = ValueList({"Tube 1", "Tube 2", "Tube 3", "Snap 1", "Snap 2", "Snap 3", "Arc", "Sliver", "Wedge", "Nib"}, selected="Tube 2")
list_124 = ValueList({"Tube 1", "Tube 2", "Tube 3", "Snap 1", "Snap 2", "Snap 3", "Arc", "Sliver", "Wedge", "Nib"}, selected="Tube 2")
list_125 = ValueList({"Tube 1", "Tube 2", "Tube 3", "Snap 1", "Snap 2", "Snap 3", "Arc", "Sliver", "Wedge", "Nib"}, selected="Snap 2")
list_126 = ValueList({"Tube 1", "Tube 2", "Tube 3", "Snap 1", "Snap 2", "Snap 3", "Arc", "Sliver", "Wedge", "Nib"}, selected="Tube 2")
list_127 = ValueList({"Tube 1", "Tube 2", "Tube 3", "Snap 1", "Snap 2", "Snap 3", "Arc", "Sliver", "Wedge", "Nib"}, selected="Nib")
list_128 = ValueList({"Tube 1", "Tube 2", "Tube 3", "Snap 1", "Snap 2", "Snap 3", "Arc", "Sliver", "Wedge", "Nib"}, selected="Nib")
list_129 = ValueList({"Tube 1", "Tube 2", "Tube 3", "Snap 1", "Snap 2", "Snap 3", "Arc", "Sliver", "Wedge", "Nib"}, selected="Arc")
merge_72 = Merge(
    Data1=list_121,
    Data2=list_119,
    Data3=list_129,
    Data4=list_120,
    Data5=list_122,
    Data6=list_124,
    Data7=list_123,
    Data8=list_125,
    Data9=list_126,
    Data10=list_127,
    Data11=list_128)
merge_73 = Merge(
    Data1=Slider(0, range=0..20),
    Data2=Slider(0, range=0..20),
    Data3=Slider(4, range=0..20),
    Data4=Slider(0, range=0..20),
    Data5=Slider(5, range=0..20),
    Data6=Slider(2, range=0..20),
    Data7=Slider(1, range=0..20),
    Data8=Slider(11, range=0..20),
    Data9=Slider(2, range=0..20),
    Data10=Slider(7, range=0..20),
    Data11=Slider(8, range=0..20))
selection_list_14 = Data(merge_73)
block_list_16 = Data(merge_72)

# ----
jitter = Jitter(List=merge_71, Jitter=1, Seed=Slider(3, range=0..10))  # -> Values, Indices

swatch_6 = ColourSwatch(SwatchColor=RGB(119, 255, 0))
swatch_7 = ColourSwatch(SwatchColor=RGB(119, 0, 255))
swatch_8 = ColourSwatch(SwatchColor=RGB(255, 110, 0))
merge_74 = Merge(
    Data1=ColourSwatch(SwatchColor=RGB(255, 212, 0)),
    Data2=ColourSwatch(SwatchColor=RGB(0, 217, 255)),
    Data3=ColourSwatch(SwatchColor=RGB(255, 0, 111)))

lng_3 = ListLength(List=crv_20)
dom_3 = ConstructDomain(DomainStart=Slider(1, range=0..10), DomainEnd=Slider(10, range=0..10))
repeat_3 = RepeatData(Data=jitter.Values, Length=lng_3)
random_4 = Random(Range=dom_3, Number=lng_3, Seed=2, Integers=True)
swatch_9 = ColourSwatch(SwatchColor=RGB(0, 128, 150))
panel_20 = Panel(crv_20)
previewlw_7 = CustomPreviewLineweights(
    Geometry=intcrv_2.Curve,
    Shader=ColourSwatch(SwatchColor=RGB(255, 0, 111)),
    Thickness=Slider(4, range=0..10),
    Absolute=False)
previewlw_8 = CustomPreviewLineweights(
    Geometry=intcrv.Curve,
    Shader=ColourSwatch(SwatchColor=RGB(2, 94, 110)),
    Thickness=Slider(1, range=0..10),
    Absolute=False)
panel_21 = Panel(merge_74)
previewlw_9 = CustomPreviewLineweights(Geometry=crv_20, Shader=merge_74, Thickness=Slider(2, range=0..10), Absolute=False)

# ==== cluster Cluster
pln = ClusterInput()
pln_2 = Plane(pln)
vec = Vector(pln_2)
pt = Point(pln_2)
amp = Amplitude(Vector=vec, Amplitude=Slider(15, range=0..100))
vdis = VectorDisplay(Anchor=pt, Vector=amp)

# ==== cluster TarPlug
pt_group_source = ClusterInput()
pt_group_source_2 = Point(pt_group_source)
merge = Merge(Data1=Slider(3, range=0..3), Data2=Slider(0, range=0..3), Data3=Slider(1, range=0..3))
item = ListItem(List=pt_group_source_2, Index=merge, Wrap=True)

# ---- group: Center Pt
avr = Average(Input=pt_group_source_2)

# ----
item_2 = ListItem(List=item, Index=0, Wrap=True)  # -> Item, Item1, Item2
pl_3pt = Plane3Pt(PointA=item_2.Item, PointB=item_2.Item1, PointC=item_2.Item2)
item_3 = ListItem(List=pl_3pt, Index=0, Wrap=True)
pl_origin = PlaneOrigin(Base=item_3, Origin=avr)
pl = ClusterOutput(pl_origin)

# ==== cluster TarTube
pt_tube_2 = ClusterInput()
pt_tube_2_2 = Point(pt_tube_2)
item = ListItem(List=pt_tube_2_2, Index=0, Wrap=True)  # -> Item, Item1
vec2pt = Vector2Pt(PointA=item.Item, PointB=item.Item1, Unitize=False)  # -> Vector, Length
pl = PlaneNormal(Origin=item.Item, ZAxis=vec2pt.Vector)
P = ClusterOutput(pl)

# ==== cluster SrcTube
P = ClusterInput()
series = Series(Start=0, Step=Slider(90, range=0..100), Count=Slider(4, range=0..10))
prot = RotatePlane(Plane=P, Angle=degrees(series))
item = ListItem(List=prot, Index=0, Wrap=True)  # -> Item, Item1, Item2, Item3
i = ClusterOutput(item.Item)
item_1 = ClusterOutput(item.Item1)
item_2 = ClusterOutput(item.Item2)
item_3 = ClusterOutput(item.Item3)

# ==== cluster SrcPlug
pt_group_1 = ClusterInput()
pt_group_1_2 = Point(pt_group_1)
merge = Merge(Data1=Slider(1, range=0..3), Data2=Slider(2, range=0..3), Data3=Slider(3, range=0..3))
item = ListItem(List=pt_group_1_2, Index=merge, Wrap=True)

# ---- group: Center Pt
avr = Average(Input=pt_group_1_2)

# ----
item_2 = ListItem(List=item, Index=0, Wrap=True)  # -> Item, Item1, Item2
pl_3pt = Plane3Pt(PointA=item_2.Item, PointB=item_2.Item1, PointC=item_2.Item2)
item_3 = ListItem(List=pl_3pt, Index=0, Wrap=True)
pl_origin = PlaneOrigin(Base=item_3, Origin=avr)
pflip = FlipPlane(Plane=pl_origin, ReverseX=False, ReverseY=False, SwapAxes=True)
P = ClusterOutput(pflip)
prot = RotatePlane(Plane=pflip, Angle=degrees(Slider(180, range=0..1000)))
P_2 = ClusterOutput(prot)

# ==== cluster SrcPlug_2
pt_group_1 = ClusterInput()
pt_group_1_2 = Point(pt_group_1)
merge = Merge(Data1=Slider(1, range=0..3), Data2=Slider(2, range=0..3), Data3=Slider(3, range=0..3))
item = ListItem(List=pt_group_1_2, Index=merge, Wrap=True)

# ---- group: Center Pt
avr = Average(Input=pt_group_1_2)

# ----
item_2 = ListItem(List=item, Index=0, Wrap=True)  # -> Item, Item1, Item2
pl_3pt = Plane3Pt(PointA=item_2.Item, PointB=item_2.Item1, PointC=item_2.Item2)
item_3 = ListItem(List=pl_3pt, Index=0, Wrap=True)
pl_origin = PlaneOrigin(Base=item_3, Origin=avr)
pflip = FlipPlane(Plane=pl_origin, ReverseX=False, ReverseY=False, SwapAxes=True)
prot = RotatePlane(Plane=pflip, Angle=degrees(Slider(90, range=0..100)))
prot_2 = RotatePlane(Plane=pflip, Angle=degrees(Slider(270, range=0..360)))
P = ClusterOutput(prot_2)
P_2 = ClusterOutput(prot)

# ==== cluster TarTube_2
pt_tube_2 = ClusterInput()
pt_tube_2_2 = Point(pt_tube_2)
item = ListItem(List=pt_tube_2_2, Index=0, Wrap=True)  # -> Item, Item1, Item2
vec2pt = Vector2Pt(PointA=item.Item, PointB=item.Item1, Unitize=False)  # -> Vector, Length
pl = PlaneNormal(Origin=item.Item, ZAxis=vec2pt.Vector)
pflip = FlipPlane(Plane=pl, ReverseX=False, ReverseY=False, SwapAxes=True)
pl_2 = PlaneNormal(Origin=item.Item1, ZAxis=vec2pt.Vector)
pl_3 = PlaneNormal(Origin=item.Item2, ZAxis=vec2pt.Vector)
pflip_2 = FlipPlane(Plane=pl_3, ReverseX=False, ReverseY=False, SwapAxes=True)
pflip_3 = FlipPlane(Plane=pl_2, ReverseX=False, ReverseY=False, SwapAxes=True)
P = ClusterOutput(pl)
P_2 = ClusterOutput(pflip)
P_3 = ClusterOutput(pl_2)
P_4 = ClusterOutput(pflip_2)
P_5 = ClusterOutput(pflip_3)
P_6 = ClusterOutput(pl_3)
